# Grasshopper definition BridgeGeneration_model_v20_10d_adj+mesh_v2.gh (Grasshopper 1.0.7)
# plug-ins: karambaGH, LunchBoxML, LunchBox

panel = Panel("C:\\Users\\MaBu\\Desktop\\MA_Martin\\train-samples\\run-22-03-28-large130k")

# ---- group: Import generated Bridge Parameters
panel_2 = Panel("1.796582031250000000e+02,2.072851562500000000e+01,7.865234375000000888e-01,3.759765625000000520e-03")
csv = ReadCSV(CSVString=panel_2, Delimiter=",")  # -> Headers, Values
panel_3 = Panel(csv.Headers)
item = ListItem(List=panel_3, Index=1, Wrap=True)
item_2 = ListItem(List=panel_3, Index=2, Wrap=True)
item_3 = ListItem(List=panel_3, Index=0, Wrap=True)
item_4 = ListItem(List=panel_3, Index=3, Wrap=True)
tie_and_arch_cs_depth_m = Number(item_2)
hanger_spacing = Number(item)
rise_of_arch = Number(item_3)
hanger_cs_area_m2 = Number(item_4)

# ----
relation_for_cross_section_area_for_the = Panel("A(m2) = a* Width(m) + b")  # "Relation for Cross Section Area for the Hanger"
a = Panel("0.0001538")
b = Panel("-0.0009193")
relation_for_cross_section_hight_for_tie = Panel("h(m) = a* Span(m) + b")  # "Relation for Cross Section Hight for Tie and Arch"
a_2 = Panel("0.00451722")
b_2 = Panel("0.68857777")
license = LicenseKaramba3D()
panel_4 = Panel(license)
toggle = BooleanToggle(False)

# ---- group: Import generated Bridge Parameters
tie_and_arch_cs_depth_m_2 = Number(tie_and_arch_cs_depth_m)
hanger_cs_area_m2_2 = Number(hanger_cs_area_m2)
hanger_spacing_2 = Number(hanger_spacing)
rise_of_arch_2 = Number(rise_of_arch)
panel_5 = Panel(rise_of_arch_2)
panel_6 = Panel(hanger_spacing_2)
panel_7 = Panel(tie_and_arch_cs_depth_m_2)
panel_8 = Panel(hanger_cs_area_m2_2)

# ----
do_full_loop = Boolean(simplify(False))  # disabled

# ---- group: Typical Tie/Arch Box Cross Section Ratios
panel_9 = Panel("1.28")
panel_10 = Panel("0.021")
panel_11 = Panel("0.036")

# ----
panel_12 = Panel(toggle)
readcsv = GhPythonScript(root_dir=panel, do_full_loop=toggle)  # -> out, curr_row, idx
# ---------- readcsv: Python ----------
import csv
import os
import json

datafile = root_dir + "\\x-10d-orig-large-131072.csv"
#datafile = root_dir + "\\sobol-samples-10d.csv"

indexfile = root_dir + "\\index.txt"

#if do_full_loop == True:
if True == True:
    if os.path.isfile(datafile) and os.path.isfile(indexfile):
        with open(datafile) as dfile:
            
            all_rows = []
            cf = csv.reader(dfile)
            
            for row in cf:
                all_rows.append([float(i) for i in row])
        
            with open(indexfile) as ifile:
             
                idx = int(ifile.readline().decode("utf-8-sig"))
                
                print(len(all_rows))
                print(idx)
                
                if idx < len(all_rows):
                    print("not done yet:", idx)
                    curr_row = all_rows[idx]
                else:
                    #idx = len(all_rows) - 1
                    print("index >= length of csv. taking last row")
                    #curr_row = all_rows[idx]
                    curr_row = None
    else:
        print("files do not exist")
else:
    print("full loop disabled")
# ---------- end readcsv ----------
panel_13 = Panel(readcsv.idx)

# ---- group: Box Cross Section Ratios
number_slider = Slider(0.0194, range=0.007..0.04)
number_slider_2 = Slider(1.991, range=0.35..2)
number_slider_3 = Slider(0.0301, range=0.01..0.06)

# ----
panel_14 = Panel(readcsv.curr_row)
youngs_modulus_kn_cm2 = Panel("19700")
youngs_modulus_kn_cm2_2 = Panel("7580")
specific_weight_kn_m2 = Panel("78.5")

name = Panel("Wire Rope (ASTM A-416, Grade 270)")
family = Panel("Steel")
fy_kn_cm2 = Panel("167")
matselect = MaterialSelectionKaramba3D(menu=[dropdown(1), dropdown(0)])
matprops = MaterialPropertiesKaramba3D(
    FamilyOfMaterial=family,
    Name=name,
    YoungsModulus_kN_cm2=youngs_modulus_kn_cm2,
    InPlaneShearModulus_kN_cm2=youngs_modulus_kn_cm2_2,
    TransverseShearModulus_kN_cm2=youngs_modulus_kn_cm2_2,
    SpecificWeight_kN_m3=specific_weight_kn_m2,
    CoefficientOfThermalExpansion_1_C=1e-05,
    YieldStrength_kN_cm2=fy_kn_cm2,
    mode="Isotrop")
material_defined = Panel(matprops)

fy_hanger_kn_cm2 = Number(fy_kn_cm2)
readmattable = ReadMaterialTableFromFileKaramba3D()
matselect_2 = MaterialSelectionKaramba3D(Materials=readmattable, menu=[dropdown(1), dropdown(0)])
matselect_3 = MaterialSelectionKaramba3D(menu=[dropdown(1), dropdown(0)])

material_list = MaterialKaramba3D(flatten([matselect, matprops]))
panel_15 = Panel(material_list)

readcstable = ReadCrossSectionTableFromFileKaramba3D()  # -> CrossSection, Info
crosecrselect = CrossSectionRangeSelectorKaramba3D(
    CrossSections=readcstable.CrossSection,
    MaximumHeight_cm=-1,
    MaximumWidth_cm=-1,
    menu=[dropdown(0), dropdown(0), dropdown(0)])
col = Colour(reverse([ColourSwatch(SwatchColor=RGB(117, 0, 0)), ColourSwatch(SwatchColor=RGB(214, 94, 94)), ColourSwatch(SwatchColor=RGB(255, 255, 255)), ColourSwatch(SwatchColor=RGB(53, 46, 255)), ColourSwatch(SwatchColor=RGB(0, 43, 153))]))
panel_16 = Panel("G:\04._Masterarbeit\05_Bridge Generation\Model\aesthetic_rating_data_V1.xlsx")
excelread = ExcelReader(ReadExcelData=Toggle(True), WorkbookPath=panel_16, WorksheetName="Tabelle1")  # -> Exceptions, ExcelData
item_5 = ListItem(List=excelread.ExcelData, Index=0, Wrap=True)  # -> flatten(Item)
panel_17 = Panel(item_5)
cull_i = CullIndex(List=excelread.ExcelData, Indices=0, Wrap=True)
panel_18 = Panel(cull_i)

# ---- group: Input Column Names
panel_19 = Panel(["0", "1"])
item_6 = ListItem(List=item_5, Index=panel_19, Wrap=True)  # -> flatten(Item)
panel_20 = Panel(item_6)

# ---- group: Output Column Name
item_7 = ListItem(List=item_5, Index="5", Wrap=True)  # -> flatten(Item)
panel_21 = Panel(item_7)

# ----
penalty_value = Panel("1000")
panel_22 = Panel(["0", "1"])
cost_hangers_chf_kg = Panel("18")
cost_structural_steel_chf_kg = Panel("4")
panel_23 = Panel("Penalty Function")
item_8 = ListItem(List=panel_18, Index="0", Wrap=True)  # -> flatten(Item)
panel_24 = Panel("Loss Function")
datatable = CreateDataTable(TableName="TrainingData", TableHeaders=item_5, ValueTree=cull_i)
item_9 = ListItem(List=panel_18, Index="5", Wrap=True)  # -> flatten(Item)
panel_25 = Panel(item_8)
panel_26 = Panel(item_9)
panel_27 = Panel(["TrainingData", "TrainingData"])
neural_network_trainer = NeuralNetworkTrainer(TrainingInputs=panel_25, TrainingOutputs=panel_26, HiddenNeurons=6, LearningAlgorithm=1)  # -> TrainedNueralNetwork, ErrorsDynamics
threshhold_ratio_t = Panel("0.5")
threshhold_ratio_t_2 = Panel("0.5")
p2 = Panel("1000")
p2_2 = Panel("1000")
num = Number(p2_2)
threshhold_ratio_t_3 = Panel("0.5")
p2_3 = Panel("1000")
p1 = Panel("5")
panel_28 = Panel(neural_network_trainer.TrainedNueralNetwork)
p1_2 = Panel("100")
p1_3 = Panel("50")
num_2 = Number(p1)
num_3 = Number(p1_2)
num_4 = Number(p2)
num_5 = Number(threshhold_ratio_t)
num_6 = Number(threshhold_ratio_t_2)
num_7 = Number(p1_3)
num_8 = Number(p2_3)
num_9 = Number(threshhold_ratio_t_3)
neural_network_tester = NeuralNetworkTester(TrainedNeuralNetwork=neural_network_trainer.TrainedNueralNetwork, TestInputData=panel_25)
panel_29 = Panel("Sum(p*(u-1)^2) (-)")
panel_30 = Panel(neural_network_tester)
merge = Merge(Data1=flatten("Material. Cost (T. CHF)   "), Data2=flatten("Maximum Utilisation (-)"), Data3=flatten("Total Loss (-)"))
merge_2 = Merge(
    Data1=flatten("Material. Cost (T. CHF)   "),
    Data2=flatten("Maximum Utilisation (-)"),
    Data3=flatten("Utilisation Loss (-)"))
objective_names = Text(merge)
objective_names_2 = Text(merge_2)
objectives_names = Panel(objective_names)
objectives_names_2 = Panel(objective_names_2)
neg = Negative()
objectives = Number(flatten(neg))
merge_3 = Merge(Data1=flatten("Struct. Mass (kg)   "), Data2=flatten("Maximum Utilisation (-)"), Data3=flatten("Utilisation Loss (-)"))
objectives_to_maximize = Panel(objectives)
objective_names_3 = Text(merge_3)
objectives_to_maximize_2 = Panel(objective_names_3)

# ---- group: Predicted Parameters
hanger_spacing_m = Slider(40, range=1..40)
# Currently only the chosen categorial properties work.
# 
# If the others are not implemented then change back to only steel option??
# 
# Or A error message when a differnt material etc is chosen
material_arch = ValueList({"Steel": 0, "Reinforced Concrete": 1, "Prestressed Concrete": 2, "Wood": 3}, selected="Steel")
material_tieback = ValueList({"Steel": 0, "Tendon Cables": 1, "Reinforced Concrete": 2, "Prestressed Concrete": 3, "Steel-Concrete Composite": 4}, selected="Steel")
# Predicted Parameters
# Rise of Arch: 25.62 m
# Hanger Spacing 11.37 m
material_deck = ValueList({"Steel": 0, "Reinforced Concrete": 1, "Prestressed Concrete": 2, "Steel-Concrete Composite": 3}, selected="Steel-Concrete Composite")
rise_of_arch_m_f = Slider(52.19, range=5..180)
hanger_arrangement = ValueList({"Parallel": 0, "Radial": 1, "Increasing Inclination": 2, "Constant Distance": 3}, selected="Parallel")
span_m = Slider(159.4, range=3..400)
width_m = Slider(20.6, range=0..50)

# ----
selected_material_list = Panel([material_arch, material_tieback, material_deck])
chosen_materiasls = Number(selected_material_list)

# ---- group: Further Advisory
# Hanger Material: Wire Rope (ASTM A-416, Grade 270)
typical_hanger_inlcination = Panel("""60°
experienced Range: 50-70°""")
typical_tie_and_arch_material = Panel("A572Grade50")

# ---- group: Further necessary input parameters
tie_and_arch_cs_depth_m_3 = Slider(0.812, range=0.2..3.5)
cross_section_type_arch_and_tie = Panel("Box-CrossSection")
hangers_cross_section_m2 = Slider(0.006, range=0.001..0.006)
cross_sectiontype_hangers = Panel("O-Profile")
hanger_material = Panel("Wire Rope (ASTM A-416, Grade 270)")
tie_and_arch_material = Panel("S355")
alpha0 = Slider(29, range=25..80)
zeta = Slider(0, range=-1..1.01)
deltaalpha = Slider(0, range=-3..2)
deltaalpha_2 = Number(deltaalpha)
zeta_2 = Number(zeta)

# ----
paramgate = GhPythonScript(
    x=readcsv.curr_row,
    p1=span_m,
    p2=rise_of_arch_m_f,
    p3=width_m,
    p4=hanger_spacing_m,
    p5=alpha0,
    p6=tie_and_arch_cs_depth_m_3,
    p7=hangers_cross_section_m2,
    p8=number_slider_2,
    p9=number_slider,
    p10=number_slider_3)  # -> out, p1, p2, p3, p4, p5, p6, p7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; inputs x: list
# ---------- paramgate: Python ----------
import rhinoscriptsyntax as rs

# Order: Span [m], Rise of Arch [m]; Width [m]; Hanger Spacing [m]; Alpha0 [°]; Tie and Arch CS-Depth [m], Hanger CS-Area [m^2]; h/b Box CS [-]; tw/h Box [-], tf/b Box [-]

if isinstance(x, list) and len(x) > 0 and x[0] != None:
    p1 = x[0]
    p2 = x[1]
    p3 = x[2]
    p4 = x[3]
    p5 = x[4]
    p6 = x[5]
    p7 = x[6]
    p8 = x[7]
    p9 = x[8]
    p10 = x[9]
    
    print(x)

else:
    p1 = _p1
    p2 = _p2
    p3 = _p3
    p4 = _p4
    p5 = _p5
    p6 = _p6
    p7 = _p7
    p8 = _p8
    p9 = _p9
    p10 = _p10
# ---------- end paramgate ----------

# ---- group: Predicted Parameters (continued)
rise_of_arch_3 = Number(paramgate.p2)
hanger_spacing_3 = Number(paramgate.p4)
span = Number(paramgate.p1)
width = Number(paramgate.p3)

# ----
width_2 = Number(width)
span_2 = Number(span)
eval = Evaluate(F="a*Width+b", Width=width_2, a=a, b=b)
eval_2 = Evaluate(F="a*Span+b", Span=span_2, a=a_2, b=b_2)

# ---- group: Further Advisory (continued)
tie_and_arch_cross_section_hight = Panel(eval_2)
hanger_cs_area_m2_3 = Panel(eval)

# ----
hanger_cs_area_m2_4 = Number(paramgate.p7)
tie_and_arch_cs_depth_m_4 = Number(paramgate.p6)
division = Division(A=rise_of_arch_3, B=span)

# ---- group: Parameter Calculation
division_2 = Division(A=span, B=hanger_spacing_3)
round = Round(Number=division_2)  # -> Nearest, Floor, Ceiling
number_of_hangers = Panel(round.Nearest)
number_of_hangers_2 = Number(number_of_hangers)

# ----
rise_to_span_ratio = Number(division)

# ---- group: Further necessary input parameters (continued)
alpha0_2 = Number(paramgate.p5)

# ----
panel_32 = Panel(rise_to_span_ratio)

# ---- group: Geometry / TIE CREATION
span_3 = Number(span)
division_3 = Division(A=span_3, B="2")
multiplication = Multiplication(A=division_3, B="-1")
pt = ConstructPoint(XCoordinate=multiplication, YCoordinate="0", ZCoordinate="0")
pt_2 = ConstructPoint(XCoordinate=division_3, YCoordinate="0", ZCoordinate="0")
ln = Line(StartPoint=pt, EndPoint=pt_2)
tie = Line(ln)

# ---- group: Geometry / ARCH CREATION
rise_of_arch_4 = Number(rise_of_arch_3)
span_4 = Number(span)
divide = DivideCurve(Curve=tie, Count=Slider(200, range=0..200), Kinks=False)  # -> Points, Tangents, Parameters
pdecon = Deconstruct(Point=divide.Points)  # -> XComponent, YComponent, ZComponent
eval_3 = Evaluate(F="-(4/(L*L))*f*x*x+f", x=pdecon.XComponent, L=span_4, f=rise_of_arch_4)
pt_3 = ConstructPoint(XCoordinate=pdecon.XComponent, YCoordinate=pdecon.YComponent, ZCoordinate=eval_3)
intcrv = Interpolate(Vertices=pt_3, Degree=3, Periodic=False, KnotStyle=1)  # -> Curve, Length, Domain
pline = PolyLine(Vertices=pt_3, Closed=False)
arch = Curve(pline)

# ---- group: Geometry / CREATION HANGERS (adapted from Riccardo)
nummber_of_hangers = Number(number_of_hangers_2)
deltaalpha_3 = Number(deltaalpha_2)
alpha0_3 = Number(alpha0_2)
zeta_3 = Number(zeta_2)
arch_2 = Curve(arch)
span_m_2 = Number(span)
rad = Radians(Degrees=deltaalpha_3)
rad_2 = Radians(Degrees=alpha0_3)
n_last_hangerindex = Evaluate(F="n-1", n=nummber_of_hangers)
n_range = Range(Domain=n_last_hangerindex, Steps=n_last_hangerindex)
n_help_hanger = Evaluate(F="(L-L*(i+1)/(n+1)-Zeta*L/(4*(n+1)))-L/2", L=span_m_2, i=n_range, n=nummber_of_hangers, Zeta=zeta_3)
n_help_hanger_2 = Evaluate(
    F="(L-L*(i+1)/(n+1)+Zeta*L/(4*(n+1)))*tan(a0-da*i)",
    L=span_m_2,
    da=rad,
    a0=rad_2,
    i=n_range,
    n=nummber_of_hangers,
    Zeta=zeta_3)
p_nodes_tie = ConstructPoint(XCoordinate=n_help_hanger, YCoordinate=0, ZCoordinate=0)  # -> reverse(Point)
n_help_hanger_3 = Evaluate(F="l/2", l=span_m_2)
p_help_hangers = ConstructPoint(XCoordinate=n_help_hanger_3, YCoordinate=0, ZCoordinate=n_help_hanger_2)
vec2pt = Vector2Pt(PointA=p_nodes_tie, PointB=p_help_hangers, Unitize=False)  # -> reverse(Vector), Length
p_nodes_tie_2 = Mirror(Geometry=p_nodes_tie, Plane=PlaneYZ(0, 0, 0))  # -> Geometry, Transform
p_help_hangers_2 = Vector(vec2pt.Vector)
p_help_hangers_3 = VectorLength(Vector=p_help_hangers_2)
p_help_hangers_4 = Multiplication(A=p_help_hangers_3, B=2)
p_help_hangers_5 = Amplitude(Vector=p_help_hangers_2, Amplitude=p_help_hangers_4)
p_help_hangers_6 = Reverse(Vector=p_help_hangers_5)
p_help_hangers_7 = Move(Geometry=reverse(p_help_hangers), Motion=p_help_hangers_6)  # -> reverse(Geometry), Transform
l_hangers_bl_tr = Line(StartPoint=p_help_hangers_7.Geometry, EndPoint=p_help_hangers)  # -> reverse(Line)
l_hangers_br_tl = Mirror(Geometry=l_hangers_bl_tr, Plane=PlaneYZ(0, 0, 0))  # -> Geometry, Transform
arch_3 = Curve(arch_2)
p_nodes_arch = CurveLine(Curve=arch_3, Line=l_hangers_br_tl.Geometry)  # -> flatten(Points), Params, Count
l_hangers_br_tl_2 = Line(StartPoint=reverse(p_nodes_tie_2.Geometry), EndPoint=p_nodes_arch.Points)  # -> reverse(Line)
l_hangers_bl_tr_2 = Mirror(Geometry=l_hangers_br_tl_2, Plane=PlaneYZ(0, 0, 0))  # -> Geometry, Transform
hangers = Curve([l_hangers_br_tl_2, l_hangers_bl_tr_2.Geometry])
end = EndPoints(Curve=hangers)  # -> Start, End
arch_nodes = Point(end.End)
tie_nodes = Point(end.Start)

# ---- group: Geometry
tie_nodes_2 = Point(tie_nodes)
tie_2 = Line(tie)
end_2 = EndPoints(Curve=tie_2)  # -> Start, End
sort_pt = SortPoints(Points=tie_nodes_2)  # -> Points, Indices
lng = ListLength(List=sort_pt.Points)
panel_33 = Panel(lng)
ins = InsertItems(List=sort_pt.Points, Item=end_2.Start, Indices="0", Wrap=True)
ins_2 = InsertItems(List=sort_pt.Points, Item=end_2.End, Indices=panel_33, Wrap=True)
ln_2 = Line(StartPoint=ins, EndPoint=ins_2)
tie_pieces = Line(ln_2)
lng_2 = ListLength(List=tie_pieces)
subtraction = Subtraction(A=lng_2, B="1")
item_10 = ListItem(List=tie_pieces, Index="0", Wrap=True)
item_11 = ListItem(List=tie_pieces, Index=subtraction, Wrap=True)

arch_nodes_2 = Point(arch_nodes)
arch_4 = Curve(arch)
end_3 = EndPoints(Curve=arch_4)  # -> Start, End
sort_pt_2 = SortPoints(Points=arch_nodes_2)  # -> Points, Indices
lng_3 = ListLength(List=sort_pt_2.Points)
ins_3 = InsertItems(List=sort_pt_2.Points, Item=end_3.Start, Indices="0", Wrap=True)
panel_34 = Panel(lng_3)
ins_4 = InsertItems(List=sort_pt_2.Points, Item=end_3.End, Indices=panel_34, Wrap=True)
ln_3 = Line(StartPoint=ins_3, EndPoint=ins_4)
arch_pieces = Line(ln_3)
item_12 = ListItem(List=arch_pieces, Index="28", Wrap=True)

# ---- group: Cross Sections / Box
panel_35 = Panel(tie_and_arch_cs_depth_m_4)
material_list_2 = MaterialKaramba3D(material_list)
multiplication_2 = Multiplication(A=panel_35, B="100")
number = Number(paramgate.p9)
number_2 = Number(paramgate.p8)
number_3 = Number(paramgate.p10)
panel_36 = Panel(tie_and_arch_material)
division_4 = Division(A=multiplication_2, B=number_2)
multiplication_3 = Multiplication(A=multiplication_2, B=number)
matselect_4 = MaterialSelectionKaramba3D(Materials=material_list_2, NameOrListIndexOfMaterial=panel_36, menu=[dropdown(0), dropdown(0)])
disassemble = DisassembleMaterialKaramba3D(Material=matselect_4)  # -> Material, TypeOfMaterial, FamilyNameOfMaterial, NameOfMaterial, ElemIdentifiers, Color, YoungsModulusKNCm2Dir12, InPlaneShearModulus_kN_cm2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
fy_kn_cm2_2 = Panel(disassemble.YieldStrengthKNCm2Dir12)
web_thickness = Panel(multiplication_3)
cs_width = Panel(division_4)
multiplication_4 = Multiplication(A=cs_width, B=number_3)
flange_thickness = Panel(multiplication_4)
fy_box_cs_kn_cm2 = Number(fy_kn_cm2_2)
cross_section = CrossSectionKaramba3D(
    FamilyNameOfCrossSection="DefaultCroSec",
    NameOfCrossSection="Box-CrossSection",
    Material=matselect_4,
    Height_cm=multiplication_2,
    UpperFlangeWidth_cm=cs_width,
    LowerFlangeWidth_cm=cs_width,
    UpperFlangeThickness_cm=flange_thickness,
    LowerFlangeThickness_cm=flange_thickness,
    SidewallsThickness_cm=web_thickness,
    FilletRadius_cm=0.6,
    mode="Box")
panel_37 = Panel(cross_section)
box_cross_section = CrossSectionKaramba3D(cross_section)
crosecrselect_2 = CrossSectionRangeSelectorKaramba3D(MaximumHeight_cm=-1, MaximumWidth_cm=-1, menu=[dropdown(0), dropdown(0), dropdown(0)])
disassemble_2 = DisassembleCrossSectionKaramba3D(CroSec=box_cross_section)  # -> CrossSection, FamilyNameOfCrossSection, TypeNameOfCrossSection, ElemIdentifiers, Color, Material, LocalEccentricity_cm, Heights_cm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
modify_crosec = ModifyCrossSectionKaramba3D(mode="Beam")

# ---- group: Cross Sections / Rope
thickness_cm = Panel("2")
panel_38 = Panel(hanger_material)
hanger_cs_area_m2_5 = Panel(hanger_cs_area_m2_4)
material_list_3 = MaterialKaramba3D(material_list)
multiplication_5 = Multiplication(A=thickness_cm, B=0.01)
matselect_5 = MaterialSelectionKaramba3D(Materials=material_list_3, NameOrListIndexOfMaterial=panel_38, menu=[dropdown(0), dropdown(0)])
eval_4 = Evaluate(F="(1/2)*((t/4) + ((A*4)/(π*t)))", A=hanger_cs_area_m2_5, t=multiplication_5)
multiplication_6 = Multiplication(A=eval_4, B=100)
panel_39 = Panel(multiplication_6)
eval_5 = Evaluate(F="(π*d²)/4 - (π*(d-2*t)²)/4", d=panel_39, t=thickness_cm)
disassemble_3 = DisassembleMaterialKaramba3D(Material=matselect_5)  # -> Material, TypeOfMaterial, FamilyNameOfMaterial, NameOfMaterial, ElemIdentifiers, Color, YoungsModulusKNCm2Dir12, InPlaneShearModulus_kN_cm2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
check_a_cm2 = Panel(eval_5)
panel_40 = Panel("O-Profile")
cross_section_2 = CrossSectionKaramba3D(
    FamilyNameOfCrossSection="DefaultCroSec",
    NameOfCrossSection=panel_40,
    Material=matselect_5,
    Diameter_cm=panel_39,
    WallThickness_cm=thickness_cm,
    mode="Circular Hollow")
panel_41 = Panel(cross_section_2)
o_cross_section = CrossSectionKaramba3D(cross_section_2)
disassemble_4 = DisassembleCrossSectionKaramba3D(CroSec=o_cross_section)  # -> CrossSection, FamilyNameOfCrossSection, TypeNameOfCrossSection, ElemIdentifiers, Color, Material, LocalEccentricity_cm, Heights_cm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
rope_a_cm2 = Number(disassemble_4.Area_cm2)
panel_42 = Panel(disassemble_4.Area_cm2)

# ----
e_box_cs_kn_cm2 = Number(disassemble.YoungsModulusKNCm2Dir12)

# ---- group: Geometry / Check for doubbles
arch_pieces_2 = Line(arch_pieces)
tie_pieces_2 = Line(tie_pieces)
hangers_2 = Curve(hangers)
rdlines = RemoveDuplicateLinesKaramba3D(Line=tie_pieces_2, LimitDistance=0.005)  # -> OutLine, Info, Indexes
rdlines_2 = RemoveDuplicateLinesKaramba3D(Line=hangers_2, LimitDistance=0.005)  # -> OutLine, Info, Indexes
rdlines_3 = RemoveDuplicateLinesKaramba3D(Line=arch_pieces_2, LimitDistance=0.005)  # -> OutLine, Info, Indexes
panel_43 = Panel(rdlines.Indexes)
panel_44 = Panel(rdlines_2.Indexes)
panel_45 = Panel(rdlines_3.Indexes)

# ----
endpointarch = Point(end_3.End)
arch_nodes_3 = Point(arch_nodes)
line = Line(arch_pieces_2)
merge_4 = Merge(Data1=arch_nodes_3, Data2=endpointarch)
midpt = CurveMiddle(Curve=line)
sort_pt_3 = SortPoints(Points=merge_4)  # -> Points, Indices
ln_4 = Line(StartPoint=sort_pt_3.Points, EndPoint=midpt)
xy = XYPlane(Origin=midpt)
len = Length(Curve=ln_4)
arch_5 = Curve(arch)
sph = Sphere(Base=xy, Radius=len)
trim = TrimWithBrep(Curve=arch_5, Brep=sph)  # -> flatten(Inside), Outside
subtraction_2 = Subtraction(A="10", B="1")
divide_2 = DivideCurve(Curve=trim.Inside, Count="10", Kinks=False)  # -> Points, Tangents, Parameters
cull_i_2 = CullIndex(List=divide_2.Points, Indices=0, Wrap=True)
cull_i_3 = CullIndex(List=cull_i_2, Indices=subtraction_2, Wrap=True)
archpiecesdivisionpoints = Point(cull_i_3)
archpiecesdivisionpoints_2 = Point(flatten(archpiecesdivisionpoints))
pt_4 = Point(sort_pt_2.Points)
merge_5 = Merge(Data1=pt_4, Data2=archpiecesdivisionpoints_2)  # -> flatten(Result)
sort_pt_4 = SortPoints(Points=merge_5)  # -> Points, Indices
lng_4 = ListLength(List=sort_pt_4.Points)
startpointarch = Point(end_3.Start)
endpointarch_2 = Point(end_3.End)
panel_46 = Panel(lng_4)
ins_5 = InsertItems(List=sort_pt_4.Points, Item=startpointarch, Indices="0", Wrap=True)
ins_6 = InsertItems(List=sort_pt_4.Points, Item=endpointarch_2, Indices=panel_46, Wrap=True)
ln_5 = Line(StartPoint=ins_5, EndPoint=ins_6)
arch_pieces_round_small = Line(ln_5)

# ---- group: Geometry / Output Geometry
arch_pieces_3 = Line(rdlines_3.OutLine)
tie_3 = Line(tie)
hangers_3 = Curve(rdlines_2.OutLine)
tie_pieces_3 = Line(rdlines.OutLine)
merge_6 = Merge(Data1=flatten(tie_pieces_3), Data2=flatten(arch_pieces_3), Data3=flatten(hangers_3))
arch_6 = Curve(arch)
complete_geometry = Curve(merge_6)

# ----
e_rope_kn_cm2 = Number(disassemble_3.YoungsModulusKNCm2Dir12)
item_13 = ListItem(List=cross_section_2, Index=-1, Wrap=True)

# ---- group: Geometry / Split Middle Tie Piece for a even number of Hangers
lng_5 = ListLength(List=tie_pieces_3)
panel_47 = Panel(lng_5)
division_5 = Division(A=panel_47, B="2")
panel_48 = Panel(division_5)
round_2 = Round(Number=panel_48)  # -> Nearest, Floor, Ceiling
split = SplitList(List=tie_pieces_3, Index=round_2.Floor)  # -> ListA, ListB
left_tie_pieces = Line(split.ListB)
right_tie_pieces = Line(split.ListA)

# ----
disassemble_5 = DisassembleCrossSectionKaramba3D(CroSec=item_13)  # -> CrossSection, FamilyNameOfCrossSection, TypeNameOfCrossSection, ElemIdentifiers, Color, Material, LocalEccentricity_cm, Heights_cm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
box_wel_cm3 = Number(disassemble_2.Wely_cm3)
panel_49 = Panel(disassemble_2.Area_cm2)
box_a_cm2 = Number(disassemble_2.Area_cm2)
panel_50 = Panel(disassemble_2.Wely_cm3)
panel_51 = Panel(disassemble_2.Wely_cm3_2)
box_i_cm4 = Number(disassemble_2.Iyy_cm4)

# ---- group: Geometry / Split Middle Tie Piece for a even number of Hangers
subtraction_3 = Subtraction(A=panel_48, B=round_2.Floor)
panel_52 = Panel(subtraction_3)
num_10 = Number(panel_52)
python = GhPythonScript(x=num_10)  # -> out, a
# ---------- python: Python ----------
__author__ = "Sophia"
__version__ = "2021.05.27"

import rhinoscriptsyntax as rs

if x==0:
    a=1
    print("The Number of Hanger is odd.")
else:
    a=2
    print("The Number of Hanger is even.")
# ---------- end python ----------
panel_53 = Panel(python.out)
split_2 = SplitList(List=left_tie_pieces, Index=1)  # -> ListA, ListB
line_2 = Line(flatten(right_tie_pieces))
middle_line = Line(flatten(split_2.ListA))
divide_3 = DivideCurve(Curve=middle_line, Count=python.a, Kinks=False)  # -> Points, Tangents, Parameters
shift = ShiftList(List=divide_3.Points, Shift=1, Wrap=True)
line_3 = Line(flatten(split_2.ListB))
ln_6 = Line(StartPoint=divide_3.Points, EndPoint=shift)
item_14 = ListItem(List=ln_6, Index=1, Wrap=True)  # -> flatten(Item)
item_15 = ListItem(List=ln_6, Index=0, Wrap=True)  # -> flatten(Item)
right_tie_pieces_2 = Line([line_2, item_15])
left_tie_pieces_2 = Line([line_3, item_14])
line_4 = Line([right_tie_pieces_2, left_tie_pieces_2])
rdlines_4 = RemoveDuplicateLinesKaramba3D(Line=line_4, LimitDistance=0.005)  # -> OutLine, Info, Indexes
lng_6 = ListLength(List=rdlines_4.OutLine)
panel_54 = Panel(lng_6)
division_6 = Division(A=panel_54, B="2")
panel_55 = Panel(division_6)
split_3 = SplitList(List=rdlines_4.OutLine, Index=panel_55)  # -> ListA, ListB
right_tie_pieces_3 = Line(split_3.ListA)
left_tie_pieces_3 = Line(split_3.ListB)

# ---- group: Cross Sections
crosec_list = CrossSectionKaramba3D(flatten([box_cross_section, o_cross_section]))
panel_56 = Panel(crosec_list)

# ---- group: Structural Elements
# This group tranforms the geometry lines into structural elements which can be read by the structural analysiser. Each element here get a definition of its cross section and material.
# The Hangers are with FALSE Bending set to be truss elements which can only carry normal forces. There are joints at each end of the hangers.
panel_57 = Panel(cross_section_type_arch_and_tie)
panel_58 = Panel(cross_sectiontype_hangers)
crosec_list_2 = CrossSectionKaramba3D(crosec_list)
crosec_list_3 = CrossSectionKaramba3D(crosec_list)
crosecselect = CrossSectionSelectorKaramba3D(CrossSections=flatten(crosec_list_3), NameOrListIndexOfCrossSection=panel_58)  # -> CrossSection, Info
crosecselect_2 = CrossSectionSelectorKaramba3D(CrossSections=flatten(crosec_list_2), NameOrListIndexOfCrossSection=panel_57)  # -> CrossSection, Info
tie_and_arch_cross_section = CrossSectionKaramba3D(crosecselect_2.CrossSection)
hangers_cross_section = CrossSectionKaramba3D(crosecselect.CrossSection)
left_tie_pieces_4 = Line(left_tie_pieces_3)
panel_59 = Panel("Tie_Left Side")
right_tie_pieces_4 = Line(right_tie_pieces_3)
panel_60 = Panel("Tie_RightSide")
toggle_2 = BooleanToggle(False)
panel_61 = Panel("Hangers")
arch_pieces_4 = Line(arch_pieces_3)
hangers_4 = Curve(hangers_3)
linetobeam = LineToBeamKaramba3D(
    Line=left_tie_pieces_4,
    Identifier=panel_59,
    CrossSection=tie_and_arch_cross_section,
    New=True,
    Remove=True,
    LimitDistance_m=0.005)  # -> Element, Points, Info
linetobeam_2 = LineToBeamKaramba3D(
    Line=right_tie_pieces_4,
    Identifier=panel_60,
    CrossSection=tie_and_arch_cross_section,
    New=True,
    Remove=True,
    LimitDistance_m=0.005)  # -> Element, Points, Info
linetobeam_3 = LineToBeamKaramba3D(
    Line=arch_pieces_4,
    Identifier="Arch",
    CrossSection=tie_and_arch_cross_section,
    New=True,
    Remove=True,
    LimitDistance_m=0.005)  # -> Element, Points, Info
linetobeam_4 = LineToBeamKaramba3D(
    Line=hangers_4,
    Identifier=panel_61,
    CrossSection=hangers_cross_section,
    New=True,
    Remove=True,
    LimitDistance_m=0.005,
    Bending=toggle_2)  # -> Element, Points, Info
left_tie_element = ElementKaramba3D(linetobeam.Element)
right_tie_elements = ElementKaramba3D(linetobeam_2.Element)
arch_element = ElementKaramba3D(linetobeam_3.Element)
hanger_elements = ElementKaramba3D(linetobeam_4.Element)
tie_element = ElementKaramba3D([right_tie_elements, left_tie_element])
list_of_elements = Panel([panel_60, panel_59, "Arch", panel_61])
element = ElementKaramba3D(flatten([hanger_elements, arch_element, tie_element]))

# ----
geometryaslines = Data(flatten([right_tie_pieces_4, left_tie_pieces_4, arch_pieces_4, hangers_4]))
disassemble_6 = DisassembleCrossSectionKaramba3D(CroSec=tie_and_arch_cross_section)  # -> CrossSection, FamilyNameOfCrossSection, TypeNameOfCrossSection, ElemIdentifiers, Color, Material, LocalEccentricity_cm, Heights_cm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
entwine = Entwine(
    Branch00=disassemble_6.Heights_cm,
    Branch01=disassemble_6.MaximumWidth_cm,
    Branch02=disassemble_6.Area_cm2,
    Branch03=disassemble_6.Iyy_cm4,
    Branch04=disassemble_6.Izz_cm4,
    FlattenInputs=True)  # -> flatten(Result)
disassemble_7 = DisassembleCrossSectionKaramba3D(CroSec=crosecselect.CrossSection)  # -> CrossSection, FamilyNameOfCrossSection, TypeNameOfCrossSection, ElemIdentifiers, Color, Material, LocalEccentricity_cm, Heights_cm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
entwine_2 = Entwine(
    Branch00=disassemble_7.Heights_cm,
    Branch01=disassemble_7.MaximumWidth_cm,
    Branch02=disassemble_7.Area_cm2,
    Branch03=disassemble_7.Iyy_cm4,
    Branch04=disassemble_7.Izz_cm4,
    FlattenInputs=True)  # -> flatten(Result)
build2dgraph = GhPythonScript(geometry=geometryaslines, tiearchdata=entwine, hangerdata=entwine_2)  # -> out, a; inputs geometry: list, tiearchdata: list, hangerdata: list
# ---------- build2dgraph: Python ----------
from compas.rpc import Proxy
from compas.datastructures import Network
import Rhino.Geometry as rg

with Proxy('compas.datastructures') as datastructures:
    
    def add_node_to_network(a, network, idx_cnt):
        r = list(network.nodes_where({"x": a[0], "y": a[1], "z": a[2]}))
        if len(r) > 0:
            return r[0], idx_cnt
        else:
            n = network.add_node(key=idx_cnt, x=a[0], y=a[1], z=a[2])
            idx_cnt += 1
            return n, idx_cnt
    
    def add_nodes_and_edge(a,b, network, data, idx_cnt):
        n1, idx_cnt = add_node_to_network(a, network, idx_cnt)
        n2, idx_cnt = add_node_to_network(b, network, idx_cnt)
        e1 = network.add_edge(n1, n2, data=data)
        return idx_cnt
    
    if len(geometry) > 0:
        
        network = Network()
        idx_cnt = 0
        
        # get network from segments
        edges = []
        for line in geometry:
            
            # case 1: tie and arch
            if type(line) == rg.Line:
                a, b = line
                idx_cnt = add_nodes_and_edge(a,b,network, tiearchdata, idx_cnt)
            
            # case 2: hangers
            else:
                a = line.PointAtStart
                b = line.PointAtEnd	
                idx_cnt = add_nodes_and_edge(a,b,network, hangerdata, idx_cnt)
            
            edges.append([a, b])
        
        #network = Network.from_lines(edges)
        
        a = network
        
        #print(list(network.nodes()))
        
        #print(network.edge_attribute((0,1), "data"))
# ---------- end build2dgraph ----------

# ---- group: SUPPORTS
end_4 = EndPoints(Curve=tie_3)  # -> Start, End
pinn_supp = SupportKaramba3D(PosInd=end_4.Start, menu=[buttons(on, on, on, on, off, off)])
roller_supp = SupportKaramba3D(PosInd=end_4.End, menu=[buttons(off, on, on, off, off, off)])
support = SupportKaramba3D(flatten([pinn_supp, roller_supp]))

# ----
lng_7 = ListLength(List=left_tie_element)
panel_62 = Panel(lng_7)
division_7 = Division(A=panel_62, B="2")
panel_63 = Panel(division_7)
round_3 = Round(Number=panel_63)  # -> Nearest, Floor, Ceiling
subtraction_4 = Subtraction(A=round_3.Nearest, B="1")
split_4 = SplitList(List=left_tie_element, Index=subtraction_4)  # -> ListA, ListB
tie_elements_right_side = ElementKaramba3D(split_4.ListA)
tie_elements_left_side = ElementKaramba3D(split_4.ListB)

item_16 = ListItem(List=arch_pieces_4, Index=24, Wrap=True)
hanger_elements_2 = ElementKaramba3D(hanger_elements)
tie_element_2 = ElementKaramba3D(tie_element)
arch_element_2 = ElementKaramba3D(arch_element)
assemble = AssembleModelKaramba3D(Elem=flatten([tie_element_2, arch_element_2]), LimitDistance_m=0.005)  # -> Model, Info, Mass_kg, CenterOfGravity
assemble_2 = AssembleModelKaramba3D(Elem=flatten(hanger_elements_2), LimitDistance_m=0.005)  # -> Model, Info, Mass_kg, CenterOfGravity
panel_64 = Panel(assemble_2.Mass_kg)
panel_65 = Panel(assemble.Mass_kg)
addition = Addition(A=panel_65, B=panel_64)
ckeck = Panel(addition)
multiplication_7 = Multiplication(A=cost_structural_steel_chf_kg, B=panel_65)
multiplication_8 = Multiplication(A=cost_hangers_chf_kg, B=panel_64)
cost_structural_steel_chf = Panel(multiplication_7)
cost_hanger_chf = Panel(multiplication_8)
addition_2 = Addition(A=cost_structural_steel_chf, B=cost_hanger_chf)
total_cost_of_modeled_elements_chf = Panel(addition_2)
rise_to_span_ratio_2 = Number(rise_to_span_ratio)
rise_to_span_ratio_3 = Number(rise_to_span_ratio)
rise_to_span_ratio_4 = Number(rise_to_span_ratio)
material_cost_chf = Number(total_cost_of_modeled_elements_chf)
python_2 = GhPythonScript(ratio=rise_to_span_ratio_2, t=num_5, p1=num_2, p2=num_4)  # -> out, P
# ---------- python_2: Python ----------
__author__ = "Sophia"
__version__ = "2021.06.25"

import rhinoscriptsyntax as rs


if ratio < t:
    m=p1/t
    P=m*ratio
    
else:
    P=p2
# ---------- end python_2 ----------
python_3 = GhPythonScript(ratio=rise_to_span_ratio_3, t=num_6, p1=num_3, p2=num)  # -> out, P; same code as python_2
division_8 = Division(A=material_cost_chf, B="1000")
python_4 = GhPythonScript(ratio=rise_to_span_ratio_4, t=num_9, p1=num_7, p2=num_8)  # -> out, P; same code as python_2
material_cost_chf_2 = Number(material_cost_chf)
aesthetic_penalty_score_1 = Number(python_2.P)
aesthetic_penalty_score_2 = Number(python_3.P)
aesthetic_penalty_score_2_2 = Number(python_4.P)
material_cost_thausand_chf = Number(division_8)
material_cost_thausand_chf_2 = Number(division_8)
material_cost_thausand_chf_3 = Number(division_8)
material_cost_thausand_chf_4 = Number(division_8)

# ---- group: LOADS
# Load Cases
# 0: Dead Weight
# 1: Asymetrical Traffic Load
# 2: Dead Weight and Asymetrical Traffic Load
# Other units weights need to be defined here.
load_case_nr = Panel("2")
load_case_nr_2 = Panel("0")
load_case_nr_3 = Panel("1")
panel_66 = Panel(panel_59)

# SIA 261 Chapter 10: The traffic loads considered are caluclated acc. to SIA 261, Chapter 10.
# Here only the uniform distributed load is considered. The point traffic loads are not considered.
# Here the loads are a little over the middle...not conservative? but maybe not so bad
# (but for certain hanger arrangements maybe)
bridge_width_m = Panel(width)
panel_67 = Panel("Traffic (Live) Load")
sia_261_q_rk_remaining_lains_and_other_k = Panel("2.5")  # "SIA 261: q_rk (remaining lains and other) (kN/m2)"
sia_261_q_ik_1_lane_kn_m2 = Panel("9")
sia_261_alpha_qr = Panel("0.9")
sia_261_alpha_qi = Panel("0.9")
lanewidth_m = Panel("3")
yq = Panel("-1.5")
eval_6 = Evaluate(
    F="(a_qr*q_rk*w/2)+((a_qi*q_ik)-(a_qr*q_rk))*lane_w*(((w-lane_w/2)/w)+(((w/2)-lane_w/2)/w))",
    w=bridge_width_m,
    lane_w=lanewidth_m,
    a_qi=sia_261_alpha_qi,
    a_qr=sia_261_alpha_qr,
    q_ik=sia_261_q_ik_1_lane_kn_m2,
    q_rk=sia_261_q_rk_remaining_lains_and_other_k)
traffic_load_on_one_tie_kn_m = Panel(eval_6)
multiplication_9 = Multiplication(A=yq, B=traffic_load_on_one_tie_kn_m)
design_traffic_load_on_one_tie_kn_m = Panel(multiplication_9)
Z = UnitZ(Factor=design_traffic_load_on_one_tie_kn_m)
loads = LoadsKaramba3D(Vector=Z, BeamIdentifiers=panel_66, LCase=load_case_nr_3, mode="Uniform Line", menu=[buttons(on, off, off)])

# dead load of modeled structure
yg = Panel("-1.5")
Z_2 = UnitZ(Factor=yg)
loads_2 = LoadsKaramba3D(Vector=Z_2, LCase=load_case_nr_2, mode="Gravity")

assumed_unit_weight_steel_deck_kn_m3 = Panel("0")
assumed_unit_weight_composite_deck_kn_m3 = Panel("6")
assumed_unit_weight_reinforced_concrete = Panel("0")  # "Assumed Unit Weight Reinforced Concrete Deck ( kN/m3)"
assumed_unit_weight_prestressed_concrete = Panel("0")  # "Assumed Unit Weight Prestressed Concrete Deck ( kN/m3)"
chosen_materiasls_2 = Number(chosen_materiasls)
item_17 = ListItem(List=chosen_materiasls_2, Index=2, Wrap=True)
num_11 = Number([assumed_unit_weight_steel_deck_kn_m3, assumed_unit_weight_reinforced_concrete, assumed_unit_weight_prestressed_concrete, assumed_unit_weight_composite_deck_kn_m3])
panel_68 = Panel("Non_modles dead load")
item_18 = ListItem(List=num_11, Index=item_17, Wrap=True)
deck_unit_weight_kn_m3 = Panel(item_18)
tie_cross_section_hight = Panel(tie_and_arch_cs_depth_m_4)
bridge_width_m_2 = Panel(width)
eval_7 = Evaluate(F="y*w*h/2", y=deck_unit_weight_kn_m3, w=bridge_width_m_2, h=tie_cross_section_hight)
deck_line_load_kn_m = Panel(eval_7)
multiplication_10 = Multiplication(A=yg, B=deck_line_load_kn_m)
panel_69 = Panel([panel_59, panel_60])
Z_3 = UnitZ(Factor=multiplication_10)
loads_3 = LoadsKaramba3D(Vector=Z_3, BeamIdentifiers=panel_69, LCase=load_case_nr_2, mode="Uniform Line", menu=[buttons(on, off, off)])

loads_4 = LoadsKaramba3D(Vector=Z_2, LCase=load_case_nr, mode="Gravity")
loads_5 = LoadsKaramba3D(Vector=Z_3, BeamIdentifiers=panel_69, LCase=load_case_nr, mode="Uniform Line", menu=[buttons(on, off, off)])
loads_6 = LoadsKaramba3D(Vector=Z, BeamIdentifiers=panel_66, LCase=load_case_nr, mode="Uniform Line", menu=[buttons(on, off, off)])

load = LoadKaramba3D(flatten([loads_2, loads, loads_3, loads_4, loads_5, loads_6]))

# ---- group: Assemble and Analyse
# This Component removes Hanger elements if they are under Compression (Toggle has for that be on False) so only the hangers that carry tension are kept. This way it is ensured that the Hangers are only loaded in tension, as they are not capable to tranfer compression.
assemble_3 = AssembleModelKaramba3D(Elem=element, Support=support, Load=load, LimitDistance_m=0.005)  # -> Model, Info, Mass_kg, CenterOfGravity
mass = Panel(assemble_3.Mass_kg)
center_of_gravity = Panel(assemble_3.Info)
analyze = AnalyzeKaramba3D(Model=assemble_3.Model)  # -> CalculatedModel, MaximumDisplacement_cm, ResultingForceOfGravity_kN, ElasticEnergy_kNm
# So we want to look at the mostly critical load case: Gravity loading and Traffic loading over half of the span.
# 
# We want to neglect the moments following the gravity loads in the Beam and Tie. (As we assume that the prestressing of tha hangers will reduce these substentially with an good prestressing scheeme)
# 
# Problem: when we use the only compression eliminator element, then the element is fully removed from static calculation.
# 
# Does it make sense to calculate them sepearatly and then add the normal forces and moments only from live load? or is it then wrong due to the cable elimination somehow?
number_slider_4 = Slider(100, range=0..100)
panel_70 = Panel(panel_61)
load_case_nr_4 = Panel(load_case_nr_3)
tencomelim = TensionCompressionEliminatorKaramba3D(
    Model=analyze.CalculatedModel,
    MaximumIerations=number_slider_4,
    BeamIdentifiers=panel_70,
    LoadCaseToConsider=load_case_nr_4,
    CompressionElementsOnly=Toggle(False))  # -> MaximumDisplacement, OptimizedModel, ElementIsActive

# ---- group: Artificial Mesh Creation (only visualisation purpose! -thicker Hangers)
cross_section_3 = CrossSectionKaramba3D(
    FamilyNameOfCrossSection="DefaultCroSec",
    NameOfCrossSection=panel_40,
    Material=matselect_5,
    Diameter_cm="50",
    WallThickness_cm=thickness_cm,
    mode="Circular Hollow")
enlarged_cross_section = CrossSectionKaramba3D(cross_section_3)
hangers_cross_section_2 = CrossSectionKaramba3D(crosecselect.CrossSection)
hangers_5 = Curve(hangers_3)
linetobeam_5 = LineToBeamKaramba3D(
    Line=hangers_5,
    Identifier="Hangers",
    CrossSection=enlarged_cross_section,
    New=True,
    Remove=True,
    LimitDistance_m=0.005,
    Bending=toggle_2)  # -> Element, Points, Info
hanger_elements_3 = ElementKaramba3D(linetobeam_5.Element)
element_2 = ElementKaramba3D(flatten([tie_element, arch_element, hanger_elements_3]))
assemble_4 = AssembleModelKaramba3D(Elem=element_2, Support=support, Load=load, LimitDistance_m=0.005)  # -> Model, Info, Mass_kg, CenterOfGravity
analyze_2 = AnalyzeKaramba3D(Model=assemble_4.Model)  # -> CalculatedModel, MaximumDisplacement_cm, ResultingForceOfGravity_kN, ElasticEnergy_kNm
modelview = ModelViewKaramba3D(Model=analyze_2.CalculatedModel, ResultFactors=1, ResultCase=-1)  # -> Model, DeformedMesh, DeformedAxes, DeformedModel
beamview = BeamViewKaramba3D(Model=modelview.Model)  # -> Model, MeshesOfRenderedBeams, DeformedBeamAxes, LegendColors, LegendTags
mesh = Mesh(beamview.MeshesOfRenderedBeams)

# ---- group: Artificial Mesh Creation (only visualisation purpose!- Round Arch Pieces)
tie_and_arch_cross_section_2 = CrossSectionKaramba3D(tie_and_arch_cross_section)
arch_pieces_round_small_2 = Line(arch_pieces_round_small)
linetobeam_6 = LineToBeamKaramba3D(
    Line=arch_pieces_round_small_2,
    Identifier="Arch",
    CrossSection=tie_and_arch_cross_section_2,
    New=True,
    Remove=True,
    LimitDistance_m=0.005,
    Bending=toggle_2)  # -> Element, Points, Info
hanger_elements_4 = ElementKaramba3D(linetobeam_6.Element)
element_3 = ElementKaramba3D(flatten([tie_element, hanger_elements, linetobeam_6.Element]))  # disabled
element_4 = ElementKaramba3D(flatten([tie_element, arch_element, hanger_elements_4, hanger_elements]))
element_5 = ElementKaramba3D(flatten([tie_element, hanger_elements, hanger_elements_4]))
assemble_5 = AssembleModelKaramba3D(Elem=element_5, Support=support, Load=load, LimitDistance_m=0.005)  # -> Model, Info, Mass_kg, CenterOfGravity
analyze_3 = AnalyzeKaramba3D(Model=assemble_5.Model)  # -> CalculatedModel, MaximumDisplacement_cm, ResultingForceOfGravity_kN, ElasticEnergy_kNm
modelview_2 = ModelViewKaramba3D(Model=analyze_3.CalculatedModel, ResultFactors=1, ResultCase=-1)  # -> Model, DeformedMesh, DeformedAxes, DeformedModel
beamview_2 = BeamViewKaramba3D(Model=modelview_2.Model)  # -> Model, MeshesOfRenderedBeams, DeformedBeamAxes, LegendColors, LegendTags
mesh_2 = Mesh(beamview_2.MeshesOfRenderedBeams)

# ---- group: ModelViewer
modelview_3 = ModelViewKaramba3D(Model=analyze.CalculatedModel, ResultFactors=1, ResultCase=-1)  # -> Model, DeformedMesh, DeformedAxes, DeformedModel
modelview_4 = ModelViewKaramba3D(Model=analyze.CalculatedModel, ResultFactors=1, ResultCase=-1)  # -> Model, DeformedMesh, DeformedAxes, DeformedModel
beamview_3 = BeamViewKaramba3D(Model=modelview_3.Model)  # -> Model, MeshesOfRenderedBeams, DeformedBeamAxes, LegendColors, LegendTags
beamview_4 = BeamViewKaramba3D(Model=modelview_4.Model)  # -> Model, MeshesOfRenderedBeams, DeformedBeamAxes, LegendColors, LegendTags
legend = Legend(Colour=beamview_3.LegendColors, Tags=beamview_3.LegendTags, LegendType=101)

# ----
buildmesh = MeshJoin(Meshes=beamview_3.MeshesOfRenderedBeams)
storeadjacencymatrix = GhPythonScript(idx=readcsv.idx, mesh=buildmesh, graph=build2dgraph.a, root_dir=panel)  # -> out, idx_out, a
# ---------- storeadjacencymatrix: Python ----------
from compas.datastructures import Network
import Rhino.Geometry as rg
from compas_rhino import conversions


export_graph = True
export_mesh = True

if idx != None:
		
	# approach 1: export network/2d graph
	if export_graph:
		if graph is not None:
			print("exporting graph for idx:", idx)
			# graph.to_json(root_dir + "/graph/" + str(idx) + "_graph.json") 
		else:
			print("invalid graph!")
	else:
		print("not exporting graph")

	# approach 2: export mesh
	if export_mesh:
		if mesh is not None:
			# mesh = conversions.RhinoMesh.from_geometry(mesh).to_compas()
			print("writing for idx:", idx)
			# mesh.to_json(root_dir + "/mesh/" + str(idx) + "_mesh.json")
		else:
			print("invalid mesh!")
	else:
		print("not exporting mesh")
				 
	idx_out = idx
else:
	print("idx is None!")
# ---------- end storeadjacencymatrix ----------
panel_71 = Panel(storeadjacencymatrix.out)

# ---- group: DisplacementCalc
load_case_nr_5 = Panel("2")
nodedisp = NodalDisplacementsKaramba3D(AnalyzedModel=beamview_3.Model, ResultCase=load_case_nr_5)  # -> AnalyzedModel, NodalTranslations_m, NodalRotations_rad
translational_displacaments_m = Panel(nodedisp.NodalTranslations_m)
devec = DeconstructVector(Vector=nodedisp.NodalTranslations_m)  # -> XComponent, YComponent, ZComponent
sort = SortList(Keys=devec.XComponent, ValuesA=devec.XComponent)  # -> Keys, ValuesA
sort_2 = SortList(Keys=devec.ZComponent)  # -> Keys, ValuesA
item_19 = ListItem(List=sort.Keys, Index=-1, Wrap=True)
item_20 = ListItem(List=sort.Keys, Index=0, Wrap=True)
item_21 = ListItem(List=sort_2.Keys, Index=-1, Wrap=True)
item_22 = ListItem(List=sort_2.Keys, Index=0, Wrap=True)
min_displacement_in_x_direction = Panel(item_20)
min_displacement_in_z_direction = Panel(item_22)
max_displacement_in_x_direction = Panel(item_19)
max_displacement_in_z_direction = Panel(item_21)

# ----
translational_displacaments_m_2 = Panel(translational_displacaments_m)
mass_2 = Panel(assemble_3.Mass_kg)
abs = Absolute(Value=translational_displacaments_m_2)
ma = MassAddition(Input=abs)  # -> Result, PartialResults
weight_of_modeled_structural_elements = Number(mass_2)
panel_72 = Panel(ma.Result)
devec_2 = DeconstructVector(Vector=ma.Result)  # -> XComponent, YComponent, ZComponent
addition_3 = Addition(A=devec_2.XComponent, B=devec_2.YComponent, C=devec_2.ZComponent)
cumulative_displacement = Number(addition_3)
cumulative_displacement_m = Panel(cumulative_displacement)
weight_of_modeled_structural_elements_2 = Number(weight_of_modeled_structural_elements)
weight_of_modeled_structural_elements_3 = Number(weight_of_modeled_structural_elements)
mesh_3 = Mesh(flatten(mesh))
mesh_4 = Mesh(flatten(beamview_3.MeshesOfRenderedBeams))

# ---- group: Utilization (considering simplified 2nd order effects)
arch_pieces_5 = Line(arch_pieces_3)
len_2 = Length(Curve=arch_pieces_5)
sort_3 = SortList(Keys=len_2)  # -> Keys, ValuesA
item_23 = ListItem(List=sort_3.Keys, Index=-1, Wrap=True)
panel_73 = Panel("Arch-Utilization")
maxhangerspacing_on_arch = Number(item_23)
fy_box_cs_kn_cm2_2 = Number(fy_box_cs_kn_cm2)
e_box_cs_kn_cm2_2 = Number(e_box_cs_kn_cm2)
box_a_cm2_2 = Number(box_a_cm2)
box_i_cm4_2 = Number(box_i_cm4)
box_wel_cm3_2 = Number(box_wel_cm3)
multiplication_11 = Multiplication(A=fy_box_cs_kn_cm2_2, B="10000")
multiplication_12 = Multiplication(A=e_box_cs_kn_cm2_2, B="10000")
division_9 = Division(A=box_a_cm2_2, B="10000")
division_10 = Division(A=box_i_cm4_2, B="100000000")
division_11 = Division(A=box_wel_cm3_2, B="1000000")
max_l = Panel(maxhangerspacing_on_arch)
maxhangerspacing_on_arch_2 = Number(maxhangerspacing_on_arch)
beta = Panel("1.25")
fy_box_cs_kn_m2 = Number(multiplication_11)
e_box_cs_kn_m2 = Number(multiplication_12)
box_a_m2 = Number(division_9)
box_i_m4 = Number(division_10)
box_wel_m3 = Number(division_11)
multiplication_13 = Multiplication(A=len_2, B=beta)  # -> flatten(Result)
buckling_legth_m = Panel(multiplication_13)
eval_8 = Evaluate(F="(π*E*I)/(Lk)²", E=e_box_cs_kn_m2, I=box_i_m4, Lk=multiplication_13)
pcr = Number(eval_8)

panel_74 = Panel("Tie-Utilization")

ym1_sia_263_4_1_3_2013 = Panel("1.05")
ym1 = Number(ym1_sia_263_4_1_3_2013)

panel_75 = Panel("Hanger Utilization ")
fy_hanger_kn_cm2_2 = Number(fy_hanger_kn_cm2)
rope_a_cm2_2 = Number(rope_a_cm2)
multiplication_14 = Multiplication(A=fy_hanger_kn_cm2_2, B="10000")
division_12 = Division(A=rope_a_cm2_2, B="10000")
fy_hangercs_kn_m2 = Number(multiplication_14)
box_a_m2_2 = Number(division_12)
python_5 = GhPythonScript(fy=fy_hangercs_kn_m2, A=box_a_m2_2, ym1=ym1)  # -> out, Nrd
# ---------- python_5: Python ----------
__author__ = "Sophia"
__version__ = "2021.06.16"

import rhinoscriptsyntax as rs
import math as m


#a=A*fy
#b=P
#minimum=min(A*fy,Pcr)

Nrd=(A*fy)/ym1
# ---------- end python_5 ----------

# ---- group: ForcesCalc
# The Forces are calculated seperatedly for the defined load cases.
# 
# Definition of List levels:
# {0;Loadcase;Element}
# Bending Moments - My (kNm)
# Superposition of Load Cases
# Here the desired response combination is manually created. Here the Normal forces for both the Dead Load and the uniform traffic load are superimposed. For the Moments howver, only the Moments resulting from the life load (traffic) are here considered. This is / can be done as we assume that a preliminary prestressing of the hangers is reducing the moments in both the arch and the tie (so small that they can be neglected in comparison to the moments due to the life load).
# Bending Moments - My (kNm)
# Check: OK
# There are no moments in the hangers. Therefore, the definition as truss elements is done correctly.
# Check: OK
# Here all the normal forces in the Hangers are positive. As it is not possible of the Hangers to support compression forces. This is appropiate.
# This is not possible as the hangers are often built of wire ropes and therfore cannot support any compression forces, only tension.
# !!!!! Here Hanger 14 has in the combined load case a negative Normal force!!!!! This is not possible as the hangers are often built of wire ropes and therfore cannot support any compression forces, only tension.
# Check: OK
# There are no moments in the hangers. Therefore, the definition as truss elements is done correctly.
number_slider_5 = Slider(1, range=0..100)
list_of_elements_2 = Panel(list_of_elements)
load_case_nr_6 = Panel("1")
load_case_nr_7 = Panel("0")
load_case_nr_8 = Panel("2")
item_24 = ListItem(List=list_of_elements_2, Index=0, Wrap=True)
item_25 = ListItem(List=list_of_elements_2, Index=1, Wrap=True)
item_26 = ListItem(List=list_of_elements_2, Index=2, Wrap=True)
item_27 = ListItem(List=list_of_elements_2, Index=3, Wrap=True)
item_28 = ListItem(List=list_of_elements_2, Index=0, Wrap=True)
item_29 = ListItem(List=list_of_elements_2, Index=1, Wrap=True)
item_30 = ListItem(List=list_of_elements_2, Index=2, Wrap=True)
item_31 = ListItem(List=list_of_elements_2, Index=3, Wrap=True)
item_32 = ListItem(List=list_of_elements_2, Index=0, Wrap=True)
item_33 = ListItem(List=list_of_elements_2, Index=1, Wrap=True)
item_34 = ListItem(List=list_of_elements_2, Index=2, Wrap=True)
panel_76 = Panel(item_24)
item_35 = ListItem(List=list_of_elements_2, Index=3, Wrap=True)
panel_77 = Panel(item_25)
panel_78 = Panel(item_26)
panel_79 = Panel(item_27)
panel_80 = Panel(item_28)
panel_81 = Panel(item_29)
panel_82 = Panel(item_30)
panel_83 = Panel(item_31)
panel_84 = Panel(item_32)
panel_85 = Panel(item_33)
panel_86 = Panel(item_34)
panel_87 = Panel(item_35)
b_forces = BeamForcesKaramba3D(
    AnalyzedModel=beamview_3.Model,
    BeamIdentifiers=panel_76,
    LCase=load_case_nr_7,
    MaximumDistanceBetweenResults_m=-1,
    NumberOfResultsPerBeamElement=number_slider_5)  # -> AnalyzedModel, NormalForce_kN, ShearForceVz_kN, ShearForceVy_kN, BendingMomentMt_kNm, BendingMomentMy_kNm, BendingMomentMz_kNm
b_forces_2 = BeamForcesKaramba3D(
    AnalyzedModel=beamview_3.Model,
    BeamIdentifiers=panel_77,
    LCase=load_case_nr_7,
    MaximumDistanceBetweenResults_m=-1,
    NumberOfResultsPerBeamElement=number_slider_5)  # -> AnalyzedModel, NormalForce_kN, ShearForceVz_kN, ShearForceVy_kN, BendingMomentMt_kNm, BendingMomentMy_kNm, BendingMomentMz_kNm
b_forces_3 = BeamForcesKaramba3D(
    AnalyzedModel=beamview_3.Model,
    BeamIdentifiers=panel_78,
    LCase=load_case_nr_7,
    MaximumDistanceBetweenResults_m=-1,
    NumberOfResultsPerBeamElement=number_slider_5)  # -> AnalyzedModel, NormalForce_kN, ShearForceVz_kN, ShearForceVy_kN, BendingMomentMt_kNm, BendingMomentMy_kNm, BendingMomentMz_kNm
b_forces_4 = BeamForcesKaramba3D(
    AnalyzedModel=beamview_3.Model,
    BeamIdentifiers=panel_79,
    LCase=load_case_nr_7,
    MaximumDistanceBetweenResults_m=-1,
    NumberOfResultsPerBeamElement=number_slider_5)  # -> AnalyzedModel, NormalForce_kN, ShearForceVz_kN, ShearForceVy_kN, BendingMomentMt_kNm, BendingMomentMy_kNm, BendingMomentMz_kNm
b_forces_5 = BeamForcesKaramba3D(
    AnalyzedModel=beamview_3.Model,
    BeamIdentifiers=panel_80,
    LCase=load_case_nr_6,
    MaximumDistanceBetweenResults_m=-1,
    NumberOfResultsPerBeamElement=number_slider_5)  # -> AnalyzedModel, NormalForce_kN, ShearForceVz_kN, ShearForceVy_kN, BendingMomentMt_kNm, BendingMomentMy_kNm, BendingMomentMz_kNm
b_forces_6 = BeamForcesKaramba3D(
    AnalyzedModel=beamview_3.Model,
    BeamIdentifiers=panel_81,
    LCase=load_case_nr_6,
    MaximumDistanceBetweenResults_m=-1,
    NumberOfResultsPerBeamElement=number_slider_5)  # -> AnalyzedModel, NormalForce_kN, ShearForceVz_kN, ShearForceVy_kN, BendingMomentMt_kNm, BendingMomentMy_kNm, BendingMomentMz_kNm
b_forces_7 = BeamForcesKaramba3D(
    AnalyzedModel=beamview_3.Model,
    BeamIdentifiers=panel_82,
    LCase=load_case_nr_6,
    MaximumDistanceBetweenResults_m=-1,
    NumberOfResultsPerBeamElement=number_slider_5)  # -> AnalyzedModel, NormalForce_kN, ShearForceVz_kN, ShearForceVy_kN, BendingMomentMt_kNm, BendingMomentMy_kNm, BendingMomentMz_kNm
b_forces_8 = BeamForcesKaramba3D(
    AnalyzedModel=beamview_3.Model,
    BeamIdentifiers=panel_83,
    LCase=load_case_nr_6,
    MaximumDistanceBetweenResults_m=-1,
    NumberOfResultsPerBeamElement=number_slider_5)  # -> AnalyzedModel, NormalForce_kN, ShearForceVz_kN, ShearForceVy_kN, BendingMomentMt_kNm, BendingMomentMy_kNm, BendingMomentMz_kNm
b_forces_9 = BeamForcesKaramba3D(
    AnalyzedModel=beamview_3.Model,
    BeamIdentifiers=panel_84,
    LCase=load_case_nr_8,
    MaximumDistanceBetweenResults_m=-1,
    NumberOfResultsPerBeamElement=number_slider_5)  # -> AnalyzedModel, NormalForce_kN, ShearForceVz_kN, ShearForceVy_kN, BendingMomentMt_kNm, BendingMomentMy_kNm, BendingMomentMz_kNm
b_forces_10 = BeamForcesKaramba3D(
    AnalyzedModel=beamview_3.Model,
    BeamIdentifiers=panel_85,
    LCase=load_case_nr_8,
    MaximumDistanceBetweenResults_m=-1,
    NumberOfResultsPerBeamElement=number_slider_5)  # -> AnalyzedModel, NormalForce_kN, ShearForceVz_kN, ShearForceVy_kN, BendingMomentMt_kNm, BendingMomentMy_kNm, BendingMomentMz_kNm
b_forces_11 = BeamForcesKaramba3D(
    AnalyzedModel=beamview_3.Model,
    BeamIdentifiers=panel_86,
    LCase=load_case_nr_8,
    MaximumDistanceBetweenResults_m=-1,
    NumberOfResultsPerBeamElement=number_slider_5)  # -> AnalyzedModel, NormalForce_kN, ShearForceVz_kN, ShearForceVy_kN, BendingMomentMt_kNm, BendingMomentMy_kNm, BendingMomentMz_kNm
b_forces_12 = BeamForcesKaramba3D(
    AnalyzedModel=beamview_3.Model,
    BeamIdentifiers=panel_87,
    LCase=load_case_nr_8,
    MaximumDistanceBetweenResults_m=-1,
    NumberOfResultsPerBeamElement=number_slider_5)  # -> AnalyzedModel, NormalForce_kN, ShearForceVz_kN, ShearForceVy_kN, BendingMomentMt_kNm, BendingMomentMy_kNm, BendingMomentMz_kNm
panel_88 = Panel(b_forces_2.NormalForce_kN)
panel_89 = Panel(b_forces.NormalForce_kN)
panel_90 = Panel(b_forces_3.NormalForce_kN)
panel_91 = Panel(b_forces_4.NormalForce_kN)
panel_92 = Panel(b_forces_6.NormalForce_kN)
panel_93 = Panel(b_forces_5.NormalForce_kN)
panel_94 = Panel(b_forces_7.NormalForce_kN)
panel_95 = Panel(b_forces_8.NormalForce_kN)
panel_96 = Panel(b_forces_10.NormalForce_kN)
panel_97 = Panel(b_forces_9.NormalForce_kN)
panel_98 = Panel("Normal Forces - N (kN)")
panel_99 = Panel(b_forces_11.NormalForce_kN)
panel_100 = Panel(b_forces_12.NormalForce_kN)
panel_101 = Panel("Normal Forces - N")
panel_103 = Panel(b_forces_2.BendingMomentMy_kNm)
panel_104 = Panel(b_forces_4.BendingMomentMy_kNm)
panel_105 = Panel(b_forces.BendingMomentMy_kNm)
panel_106 = Panel(b_forces_3.BendingMomentMy_kNm)
panel_107 = Panel(b_forces_6.BendingMomentMy_kNm)
panel_108 = Panel(b_forces_8.BendingMomentMy_kNm)
panel_109 = Panel(b_forces_5.BendingMomentMy_kNm)
panel_110 = Panel(b_forces_7.BendingMomentMy_kNm)
panel_111 = Panel(b_forces_10.BendingMomentMy_kNm)
panel_112 = Panel(b_forces_12.BendingMomentMy_kNm)
panel_113 = Panel(b_forces_9.BendingMomentMy_kNm)
panel_114 = Panel(b_forces_11.BendingMomentMy_kNm)
panel_115 = Panel("Bending Moments - My")
panel_117 = Panel(panel_76)
panel_118 = Panel(panel_77)
panel_119 = Panel(panel_78)
panel_120 = Panel(panel_79)
addition_4 = Addition(A=panel_89, B=panel_93)
addition_5 = Addition(A=panel_88, B=panel_92)
addition_6 = Addition(A=panel_90, B=panel_94)
addition_7 = Addition(A=panel_91, B=panel_95)
panel_121 = Panel(addition_4)
panel_122 = Panel(addition_5)
panel_123 = Panel(addition_6)
panel_124 = Panel(addition_7)
panel_126 = Panel(b_forces_6.BendingMomentMy_kNm)
panel_128 = Panel(b_forces_5.BendingMomentMy_kNm)
panel_129 = Panel(b_forces_7.BendingMomentMy_kNm)
sort_4 = SortList(Keys=flatten([panel_128, panel_126]))  # -> Keys, ValuesA
sort_5 = SortList(Keys=flatten([panel_128, panel_126]))  # -> Keys, ValuesA
sort_6 = SortList(Keys=flatten(panel_129))  # -> Keys, ValuesA
sort_7 = SortList(Keys=flatten(panel_129))  # -> Keys, ValuesA
item_36 = ListItem(List=sort_4.Keys, Index=0, Wrap=True)
item_37 = ListItem(List=sort_5.Keys, Index=-1, Wrap=True)
item_38 = ListItem(List=sort_6.Keys, Index=0, Wrap=True)
item_39 = ListItem(List=sort_7.Keys, Index=-1, Wrap=True)
max_moment_knm = Panel(item_36)
max_moment_knm_2 = Panel(item_37)
max_moment_knm_3 = Panel(item_38)
max_moment_knm_4 = Panel(item_39)
abs_2 = Absolute(Value=max_moment_knm)
abs_3 = Absolute(Value=max_moment_knm_2)
abs_4 = Absolute(Value=max_moment_knm_3)
abs_5 = Absolute(Value=max_moment_knm_4)
merge_7 = Merge(Data1=abs_3, Data2=abs_2)
merge_8 = Merge(Data1=abs_5, Data2=abs_4)
sort_8 = SortList(Keys=flatten(merge_7))  # -> Keys, ValuesA
sort_9 = SortList(Keys=flatten(merge_8))  # -> Keys, ValuesA
item_40 = ListItem(List=sort_8.Keys, Index=-1, Wrap=True)
item_41 = ListItem(List=sort_9.Keys, Index=-1, Wrap=True)
max_moment_in_tie_knm = Number(item_40)
max_moment_in_arch_knm = Number(item_41)
max_moment_knm_5 = Panel(max_moment_in_tie_knm)
max_moment_knm_6 = Panel(max_moment_in_arch_knm)

# ----
division_13 = Division(A=panel_89, B=panel_93)
# Calculate Present Dead Load to Live Load Ratio
# 
# (from ratio of Tie Normal Force under eather)
panel_130 = Panel(division_13)
max_moment_in_arch_knm_2 = Number(max_moment_in_arch_knm)

# ---- group: Utilization (considering simplified 2nd order effects) (continued)
normal_foces_in_hanger_kn = Number(panel_124)
abs_6 = Absolute(Value=normal_foces_in_hanger_kn)
item_42 = ListItem(List=abs_6, Index=0, Wrap=True)
item_43 = ListItem(List=abs_6, Index=-1, Wrap=True)
num_12 = Number(flatten(item_43))
num_13 = Number(flatten(item_42))
python_6 = GhPythonScript(a=num_13, b=num_12)  # -> out, max
# ---------- python_6: Python ----------
__author__ = "Sophia"
__version__ = "2021.06.16"

import rhinoscriptsyntax as rs


if a>b:
    max=a
else:
    max=b
# ---------- end python_6 ----------
single_normal_forces_in_hangers_kn = Number(flatten(python_6.max))
eval_9 = Evaluate(F="(Ned/Nrd)", Ned=single_normal_forces_in_hangers_kn, Nrd=python_5.Nrd)
panel_131 = Panel(eval_9)

normal_foces_in_arch_kn = Number(panel_123)
moments_in_arch_knm = Number(panel_129)
abs_7 = Absolute(Value=normal_foces_in_arch_kn)
abs_8 = Absolute(Value=moments_in_arch_knm)
item_44 = ListItem(List=abs_7, Index=0, Wrap=True)
item_45 = ListItem(List=abs_8, Index=-1, Wrap=True)
item_46 = ListItem(List=abs_8, Index=0, Wrap=True)
single_normal_foces_in_arch_kn = Number(flatten(item_44))
num_14 = Number(flatten(item_45))
num_15 = Number(flatten(item_46))
python_7 = GhPythonScript(a=num_15, b=num_14)  # -> out, max; same code as python_6
single_moments_in_arch_kn = Number(flatten(python_7.max))
python_8 = GhPythonScript(fy=fy_box_cs_kn_m2, A=box_a_m2, Pcr=pcr, ym1=ym1)  # -> out, flatten(Nkrd)
# ---------- python_8: Python ----------
__author__ = "Sophia"
__version__ = "2021.06.16"

import rhinoscriptsyntax as rs
import math as m


#a=A*fy
#b=P
#minimum=min(A*fy,Pcr)

Nkrd=(min(A*fy,Pcr))/ym1
# ---------- end python_8 ----------
python_9 = GhPythonScript(fy=fy_box_cs_kn_m2, A=box_a_m2, ym1=ym1)  # -> out, Nrd; same code as python_5
eval_10 = Evaluate(F="(fy*Wel)/ym1", fy=fy_box_cs_kn_m2, Wel=box_wel_m3, ym1=ym1)
eval_11 = Evaluate(
    F="(Ned/Nkrd)+(1/(1-(Ned/Pcr)))*(Med/Mrd)",
    Ned=single_normal_foces_in_arch_kn,
    Nkrd=python_8.Nkrd,
    Pcr=eval_8,
    Med=single_moments_in_arch_kn,
    Mrd=eval_10)
eval_12 = Evaluate(
    F="(Ned/Nrd)+(Med/Mrd)",
    Ned=single_normal_foces_in_arch_kn,
    Nrd=python_9.Nrd,
    Med=single_moments_in_arch_kn,
    Mrd=eval_10)
panel_132 = Panel(eval_12)
panel_133 = Panel(eval_11)
sort_10 = SortList(Keys=panel_133)  # -> Keys, ValuesA
item_47 = ListItem(List=sort_10.Keys, Index=-1, Wrap=True)
item_48 = ListItem(List=sort_10.Keys, Index=0, Wrap=True)
minutilization = Number(item_48)
maxutilization = Number(item_47)
max_value = Panel(maxutilization)
min_value = Panel(minutilization)

# ---- group: UtilizationCalc
panel_134 = Panel(panel_76)
panel_135 = Panel(panel_77)
panel_136 = Panel(panel_78)
panel_137 = Panel(panel_79)
panel_138 = Panel([panel_134, panel_135])
load_case_nr_9 = Panel("2")
load_case_nr_10 = Panel("2")
load_case_nr_11 = Panel("2")
utilization = UtilizationOfElementsKaramba3D(
    AnalyzedModel=beamview_3.Model,
    ElemIdentifiers=panel_138,
    ResultCase=load_case_nr_9,
    NumberOfSamplePoints=3,
    ElasticDesign=True,
    GammaM0=1,
    GammaM1=1,
    WithDetails=False,
    mode="Beams")  # -> AnalyzedModel, Utilization, SigMax_kN_cm2, SigMin_kN_cm2, TauMax_kN_cm2, UtilN, UtilVy, UtilVz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
utilization_2 = UtilizationOfElementsKaramba3D(
    AnalyzedModel=beamview_3.Model,
    ElemIdentifiers=panel_136,
    ResultCase=load_case_nr_10,
    NumberOfSamplePoints=3,
    ElasticDesign=True,
    GammaM0=1,
    GammaM1=1,
    WithDetails=False,
    mode="Beams")  # -> AnalyzedModel, Utilization, SigMax_kN_cm2, SigMin_kN_cm2, TauMax_kN_cm2, UtilN, UtilVy, UtilVz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
load_case_nr_12 = Panel("1")
utilization_3 = UtilizationOfElementsKaramba3D(
    AnalyzedModel=beamview_3.Model,
    ElemIdentifiers=panel_137,
    ResultCase=load_case_nr_11,
    NumberOfSamplePoints=3,
    ElasticDesign=True,
    GammaM0=1,
    GammaM1=1,
    WithDetails=False,
    mode="Beams")  # -> AnalyzedModel, Utilization, SigMax_kN_cm2, SigMin_kN_cm2, TauMax_kN_cm2, UtilN, UtilVy, UtilVz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
load_case_nr_13 = Panel("1")
panel_139 = Panel(utilization.UtilN)
utilization_4 = UtilizationOfElementsKaramba3D(
    AnalyzedModel=beamview_3.Model,
    ElemIdentifiers=panel_138,
    ResultCase=load_case_nr_13,
    NumberOfSamplePoints=3,
    ElasticDesign=True,
    GammaM0=1,
    GammaM1=1,
    WithDetails=False,
    mode="Beams")  # -> AnalyzedModel, Utilization, SigMax_kN_cm2, SigMin_kN_cm2, TauMax_kN_cm2, UtilN, UtilVy, UtilVz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
utilization_5 = UtilizationOfElementsKaramba3D(
    AnalyzedModel=beamview_3.Model,
    ElemIdentifiers=panel_136,
    ResultCase=load_case_nr_12,
    NumberOfSamplePoints=3,
    ElasticDesign=True,
    GammaM0=1,
    GammaM1=1,
    WithDetails=False,
    mode="Beams")  # -> AnalyzedModel, Utilization, SigMax_kN_cm2, SigMin_kN_cm2, TauMax_kN_cm2, UtilN, UtilVy, UtilVz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
panel_140 = Panel(utilization_2.UtilN)
panel_141 = Panel(utilization_4.UtilMy)
panel_142 = Panel(utilization_5.UtilMy)
addition_8 = Addition(A=panel_139, B=panel_141)
addition_9 = Addition(A=panel_140, B=panel_142)
panel_143 = Panel(addition_8)
panel_144 = Panel(addition_9)
panel_145 = Panel(utilization_3.Utilization)
sort_11 = SortList(Keys=[panel_145, panel_143, panel_144])  # -> Keys, ValuesA
panel_146 = Panel(sort_11.Keys)
item_49 = ListItem(List=sort_11.Keys, Index=-1, Wrap=True)
item_50 = ListItem(List=sort_11.Keys, Index=0, Wrap=True)
minutilization_2 = Number(item_50)
maxutilization_2 = Number(item_49)
max_value_2 = Panel(maxutilization_2)
min_value_2 = Panel(minutilization_2)

# ---- group: Check V-Utilization
v_utilisation = Panel([utilization.UtilVz, utilization_2.UtilVz])
# Ok if all False.
# Then Ved<0.5Vrd is fulfilled.
larger = LargerThan(FirstNumber=v_utilisation, SecondNumber="0.5")  # -> flatten(LargerThan), OrEqualTo
panel_147 = Panel(larger.LargerThan)

# ----
sort_12 = SortList(Keys=flatten([panel_121, panel_122]))  # -> Keys, ValuesA
item_51 = ListItem(List=panel_122, Index=0, Wrap=True)
sort_13 = SortList(Keys=flatten(panel_123))  # -> Keys, ValuesA
sort_14 = SortList(Keys=flatten(panel_124))  # -> Keys, ValuesA
sort_15 = SortList(Keys=flatten(panel_124))  # -> Keys, ValuesA
item_52 = ListItem(List=panel_123, Index=0, Wrap=True)
item_53 = ListItem(List=sort_12.Keys, Index=-1, Wrap=True)
item_54 = ListItem(List=sort_13.Keys, Index=0, Wrap=True)
item_55 = ListItem(List=sort_14.Keys, Index=-1, Wrap=True)
abs_9 = Absolute(Value=item_52)
num_16 = Number(flatten(abs_9))
item_56 = ListItem(List=sort_15.Keys, Index=0, Wrap=True)
abs_10 = Absolute(Value=item_54)
max_normal_foce_in_tie_kn = Number(item_53)

# ---- group: Utilization (considering simplified 2nd order effects) (continued)
normal_foces_in_tie_kn = Number(flatten([panel_121, panel_122]))
moments_in_tie_knm = Number(flatten([panel_128, panel_126]))
max_normal_foce_in_tie_kn_2 = Number(max_normal_foce_in_tie_kn)
max_moment_in_tie_knm_2 = Number(max_moment_in_tie_knm)
nrd = Number(python_9.Nrd)
mrd = Number(eval_10)
eval_13 = Evaluate(F="(Ned/Nrd)+(Med/Mrd)", Ned=normal_foces_in_tie_kn, Nrd=nrd, Med=moments_in_tie_knm, Mrd=mrd)
panel_148 = Panel(eval_13)
sort_16 = SortList(Keys=panel_148)  # -> Keys, ValuesA
item_57 = ListItem(List=sort_16.Keys, Index=-1, Wrap=True)
item_58 = ListItem(List=sort_16.Keys, Index=0, Wrap=True)
minutilization_3 = Number(item_58)
maxutilization_3 = Number(item_57)
max_value_3 = Panel(maxutilization_3)
min_value_3 = Panel(minutilization_3)

# ----
max_normal_foce_in_hanger_kn = Number(item_55)
panel_149 = Panel(num_16)
max_normal_force_in_arch_knn = Number(abs_10)
max_normal_force_in_arch_knn_2 = Number(max_normal_force_in_arch_knn)
min_normal_foce_in_hanger_kn = Number(item_56)
max_normal_force_kn = Panel(max_normal_foce_in_tie_kn)
max_normal_force_kn_2 = Panel(max_normal_foce_in_hanger_kn)
max_normal_force_kn_3 = Panel(max_normal_force_in_arch_knn)
max_normal_force_kn_4 = Panel(min_normal_foce_in_hanger_kn)

# ---- group: ForcesCalc (continued)
larger_2 = LargerThan(FirstNumber=max_normal_force_kn_4, SecondNumber="0")  # -> flatten(LargerThan), OrEqualTo
check_for_no_compression_in_hangers_true = Panel(larger_2.LargerThan)  # "Check for no Compression in Hangers -> True -> ok"

# ---- group: Utilization (considering simplified 2nd order effects) (continued)
# This altered definition of Utilization also captures 2nd order effects by including an approach similar to SIA 263 5.1.9 -> buckling
# 
# However local buckling is not considered here !!!
sort_17 = SortList(Keys=flatten([eval_9, panel_133, eval_13]))  # -> Keys, ValuesA
panel_150 = Panel(sort_17.Keys)
item_59 = ListItem(List=sort_17.Keys, Index=-1, Wrap=True)
item_60 = ListItem(List=sort_17.Keys, Index=0, Wrap=True)
minutilization_4 = Number(item_60)
maxutilization_4 = Number(item_59)
max_value_4 = Panel(maxutilization_4)
min_value_4 = Panel(minutilization_4)

# ----
item_61 = ListItem(List=panel_129, Index=1, Wrap=True)
abs_11 = Absolute(Value=item_61)
num_17 = Number(flatten(abs_11))
panel_151 = Panel(num_17)
utilizationlist = Number(sort_17.Keys)
panel_152 = Panel(utilizationlist)
python_10 = GhPythonScript(x=flatten(utilizationlist), y=penalty_value)  # -> out, a
# ---------- python_10: Python ----------
__author__ = "Sophia"
__version__ = "2021.06.08"

import rhinoscriptsyntax as rs

if 1-x >= 0:
    a=1
else:
    a=y
# ---------- end python_10 ----------
eval_14 = Evaluate(F="(1-u)²", u=utilizationlist)
# Objective Definition and including penealties an loss functions.
ma_2 = MassAddition(Input=panel_152)  # -> Result, PartialResults
lng_8 = ListLength(List=panel_152)
panel_153 = Panel(python_10.a)
division_14 = Division(A=ma_2.Result, B=lng_8)
multiplication_15 = Multiplication(A=eval_14, B=python_10.a)
ma_3 = MassAddition(Input=eval_14)  # -> Result, PartialResults
ma_4 = MassAddition(Input=multiplication_15)  # -> Result, PartialResults
panel_154 = Panel(multiplication_15)
weighted_summ_of_eucledian_distance_to_a = Panel(ma_4.Result)  # "Weighted Summ of Eucledian Distance to a Utilization of 1"
summ_of_eucledian_distance_to_a_utilizat = Panel(ma_3.Result)  # "Summ of Eucledian Distance to a Utilization of 1"
utilization_distance_sum = Number(summ_of_eucledian_distance_to_a_utilizat)
utilization_loss = Number(weighted_summ_of_eucledian_distance_to_a)
weighted_utilisation_distance_sum = Number(utilization_loss)
addition_10 = Addition(A=utilization_loss, B=aesthetic_penalty_score_1)
maxutilisation = Number(maxutilization_2)
addition_11 = Addition(A=utilization_loss, B=aesthetic_penalty_score_2)
addition_12 = Addition(A=utilization_loss, B=aesthetic_penalty_score_2_2)
maxutilization_5 = Number(maxutilization_4)
maxutilization_6 = Number(maxutilization_4)
maxutilization_7 = Number(maxutilization_4)
maxutilization_8 = Number(maxutilization_4)
lossvalue1 = Number(addition_10)
lossvalue1_2 = Number(lossvalue1)
lossvalue3 = Number(addition_11)
lossvalue2 = Number(addition_12)
lossvalue2_2 = Number(lossvalue2)
lossvalue2_3 = Number(lossvalue2)
lossvalue3_2 = Number(lossvalue3)
merge_9 = Merge(Data1=flatten(material_cost_thausand_chf), Data2=flatten(maxutilization_5), Data3=flatten(lossvalue1_2))
merge_10 = Merge(Data1=flatten(material_cost_thausand_chf_2), Data2=flatten(maxutilization_6), Data3=flatten(lossvalue2_2))
merge_11 = Merge(Data1=flatten(material_cost_thausand_chf_3), Data2=flatten(maxutilization_7), Data3=flatten(lossvalue2_3))
merge_12 = Merge(
    Data1=flatten(material_cost_thausand_chf_4),
    Data2=flatten(maxutilization_8),
    Data3=flatten(weighted_utilisation_distance_sum))
objectives_2 = Number(flatten(merge_9))
objectives_3 = Number(flatten(merge_10))
objectives_4 = Number(flatten(merge_11))
objectives_5 = Number(flatten(merge_12))
storeoutput = GhPythonScript(idx=storeadjacencymatrix.idx_out, y=objectives_5, curr_row=readcsv.curr_row, root_dir=panel, do_full_loop=toggle)  # -> out, b, a; inputs y: list, curr_row: list
# ---------- storeoutput: Python ----------
import rhinoscriptsyntax as rs
import Grasshopper as gh
import System
import os
import json


outputdir = root_dir + "\\output"
indexfile = root_dir + "\\index.txt"

if isinstance(curr_row, list) and len(curr_row) > 0 and curr_row[0] != None and len(y) == 3:

    with open(outputdir + "\\" + str(idx) + "_output.csv", "w+") as ofp:
        
        print("writing: ", y)
        ofp.write(json.dumps(y[0]) + "," + json.dumps(y[1]) + "," + json.dumps(y[2]) + "\n")
        
        with open(indexfile, "r+") as idxfp:
            print("curr idx:", idx)
            old_index = idx
            idxfp.seek(0)
            new_index = old_index + 1
            print("writing: ", new_index)
            idxfp.write(str(new_index))
            idxfp.truncate()

            # if not finished yet (idx <= max_idx)
            # start full pipeline from scratch
            
            if do_full_loop:
                print("do full loop")
                ghdoc = ghenv.Component.Attributes.Owner.OnPingDocument()
                names = System.Collections.Generic.List[str](["ReadCSV"])
                comp = ghdoc.FindObjects(names, 1)[0]
                comp.ExpireSolution(True)
            else:
                print("not doing full loop")
            
            a = new_index
            #gh.Instances.ActiveCanvas.Document.NewSolution(True)

else:
    print("pipeline may have finished or an error occurred")
# ---------- end storeoutput ----------
panel_155 = Panel(storeoutput.b)
panel_156 = Panel(storeoutput.out)
panel_157 = Panel(storeoutput.a)
weighted_utilisation_distance_sum_2 = Number(utilization_loss)
objectives_to_minimize = Panel(objectives_2)
objectives_to_minimize_2 = Panel(objectives_3)
objectives_to_minimize_3 = Panel(objectives_4)
maxutilisation_2 = Number(maxutilization_2)
# Octopus tries to minimize everything.
# -> to maximize an objective needs to be multiplied by -1 (so the algorithm can also minimize the objective)
objectives_to_minimize_4 = Panel(objectives_5)
merge_13 = Merge(
    Data1=flatten(weight_of_modeled_structural_elements_3),
    Data2=flatten(maxutilisation_2),
    Data3=flatten(weighted_utilisation_distance_sum_2))
objectives_6 = Number(flatten(merge_13))
objectives_to_minimize_5 = Panel(objectives_6)
