# Grasshopper definition BridgeGeneration_model_v20_test_01_debug.gh (Grasshopper 1.0.7)
# plug-ins: ExcelReadWrite, sof_gh_sofistik-2022, karambaGH, LunchBoxML, LunchBox

# ---- group: Import generated Bridge Parameters
panel = Panel("""1.682267102102426293e+02,9.159628127144816290e+01,2.004094759120238933e+01,3.885199625607832985e+01,3.970464005272767594e+01,1.500525244042680617e+00,3.830996611448962783e-03,1.256864063318183788e+00,1.481649674606284536e-02,2.710767968369895420e-02
7.822671021024261506e+01,4.409628127144814869e+01,1.254094759120239111e+01,1.935199625607833696e+01,7.970464005272768304e+01,3.150525244042680750e+00,8.330996611448964612e-03,5.068640633181835664e-01,3.231649674606285050e-02,5.710767968369895309e-02
1.232267102102426151e+02,2.034628127144814869e+01,1.629094759120238933e+01,9.601996256078336955e+00,1.970464005272766883e+01,2.325525244042681017e+00,1.580996611448961652e-03,1.631864063318183788e+00,2.356649674606284967e-02,1.210767968369895128e-02
3.322671021024261506e+01,6.784628127144814869e+01,2.379094759120238933e+01,2.910199625607833696e+01,5.970464005272767594e+01,6.755252440426806615e-01,6.080996611448963481e-03,8.818640633181835664e-01,6.066496746062846265e-03,4.210767968369895364e-02
5.572671021024261506e+01,3.222128127144814869e+01,1.441594759120239111e+01,4.726996256078336955e+00,2.970464005272766883e+01,1.088025244042680750e+00,4.955996611448963349e-03,6.943640633181835664e-01,1.919149674606284578e-02,1.960767968369895101e-02
1.457267102102426293e+02,7.972128127144814869e+01,2.191594759120238933e+01,2.422699625607833696e+01,6.970464005272768304e+01,2.738025244042680661e+00,9.455996611448962141e-03,1.444364063318183788e+00,3.669149674606284744e-02,4.960767968369895337e-02
1.007267102102426151e+02,8.471281271448148686e+00,1.066594759120239111e+01,1.447699625607833696e+01,4.970464005272767594e+01,2.630252440426807392e-01,2.705996611448961784e-03,1.069364063318183566e+00,2.794149674606285008e-02,3.460767968369895392e-02
1.907267102102426293e+02,5.597128127144814869e+01,1.816594759120238933e+01,3.397699625607833696e+01,8.970464005272768304e+01,1.913025244042680706e+00,7.205996611448963612e-03,1.819364063318183788e+00,1.044149674606284668e-02,6.460767968369895975e-02
2.197671021024261151e+01,2.628378127144814869e+01,2.472844759120238933e+01,2.666449625607833696e+01,8.470464005272768304e+01,2.119275244042680750e+00,4.393496611448962849e-03,1.163114063318183566e+00,2.137899674606284772e-02,3.085767968369895059e-02
1.119767102102426151e+02,7.378378127144814869e+01,1.722844759120238933e+01,7.164496256078336955e+00,4.470464005272767594e+01,4.692752440426807281e-01,8.893496611448965111e-03,1.913114063318183788e+00,3.887899674606284939e-02,6.085767968369895642e-02
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""")
csv = ReadCSV(CSVString=panel, Delimiter=",")  # -> Headers, Values
panel_2 = Panel(csv.Headers)
item = ListItem(List=panel_2, Index=1, Wrap=True)
item_2 = ListItem(List=panel_2, Index=2, Wrap=True)
item_3 = ListItem(List=panel_2, Index=0, Wrap=True)
item_4 = ListItem(List=panel_2, Index=3, Wrap=True)
tie_and_arch_cs_depth_m = Number(item_2)
hanger_spacing = Number(item)
rise_of_arch = Number(item_3)
hanger_cs_area_m2 = Number(item_4)

tie_and_arch_cs_depth_m_2 = Number(tie_and_arch_cs_depth_m)
hanger_cs_area_m2_2 = Number(hanger_cs_area_m2)
hanger_spacing_2 = Number(hanger_spacing)
rise_of_arch_2 = Number(rise_of_arch)
panel_3 = Panel(rise_of_arch_2)
panel_4 = Panel(hanger_spacing_2)
panel_5 = Panel(tie_and_arch_cs_depth_m_2)
panel_6 = Panel(hanger_cs_area_m2_2)

# ----
readfullcsv = GhPythonScript()  # -> out, all_rows
# ---------- readfullcsv: Python ----------
import csv
import os


root_dir = "C:\\Users\idl_user1\\Desktop\\MA_Martin\\gen-samples\\model-15-v2"
datafile = root_dir + "\\newsamples-x-only.csv"
indexfile = root_dir + "\\index.txt"

with open(datafile) as dfile:
    
    all_rows = []
    cf = csv.reader(dfile)
    
    for row in cf:
        all_rows.append([float(i) for i in row])
        
    print(len(all_rows))
# ---------- end readfullcsv ----------
row_i = GhPythonScript(x=readfullcsv.all_rows)  # -> out, a; inputs x: list
# ---------- row_i: Python ----------
idx = 129

if len(x) > 0 and x[0] != None:
    a = x[idx]
else:
    a = None
# ---------- end row_i ----------
panel_7 = Panel(readfullcsv.out)
panel_8 = Panel(row_i.a)
num = Number([23.95, 24.95])
relation_for_cross_section_area_for_the = Panel("A(m2) = a* Width(m) + b")  # "Relation for Cross Section Area for the Hanger"
a = Panel("0.0001538")
b = Panel("-0.0009193")
relation_for_cross_section_hight_for_tie = Panel("h(m) = a* Span(m) + b")  # "Relation for Cross Section Hight for Tie and Arch"
a_2 = Panel("0.00451722")
b_2 = Panel("0.68857777")
license = LicenseKaramba3D()
panel_9 = Panel(license)

# ---- group: Typical Tie/Arch Box Cross Section Ratios
panel_10 = Panel("1.28")
panel_11 = Panel("0.021")
panel_12 = Panel("0.036")

# ---- group: Box Cross Section Ratios
number_slider = Slider(0.0077, range=0.007..0.04)
number_slider_2 = Slider(1.28, range=0.35..2)
number_slider_3 = Slider(0.0401, range=0.01..0.06)

# ----
youngs_modulus_kn_cm2 = Panel("19700")
youngs_modulus_kn_cm2_2 = Panel("7580")
specific_weight_kn_m2 = Panel("78.5")

name = Panel("Wire Rope (ASTM A-416, Grade 270)")
family = Panel("Steel")
fy_kn_cm2 = Panel("167")
matselect = MaterialSelectionKaramba3D(menu=[dropdown(1), dropdown(0)])
matprops = MaterialPropertiesKaramba3D(
    FamilyOfMaterial=family,
    Name=name,
    YoungsModulus_kN_cm2=youngs_modulus_kn_cm2,
    InPlaneShearModulus_kN_cm2=youngs_modulus_kn_cm2_2,
    TransverseShearModulus_kN_cm2=youngs_modulus_kn_cm2_2,
    SpecificWeight_kN_m3=specific_weight_kn_m2,
    CoefficientOfThermalExpansion_1_C=1e-05,
    YieldStrength_kN_cm2=fy_kn_cm2,
    mode="Isotrop")
material_defined = Panel(matprops)

fy_hanger_kn_cm2 = Number(fy_kn_cm2)
readmattable = ReadMaterialTableFromFileKaramba3D()
matselect_2 = MaterialSelectionKaramba3D(Materials=readmattable, menu=[dropdown(1), dropdown(0)])
matselect_3 = MaterialSelectionKaramba3D(menu=[dropdown(1), dropdown(0)])

material_list = MaterialKaramba3D(flatten([matselect, matprops]))
panel_13 = Panel(material_list)

readcstable = ReadCrossSectionTableFromFileKaramba3D()  # -> CrossSection, Info
crosecrselect = CrossSectionRangeSelectorKaramba3D(
    CrossSections=readcstable.CrossSection,
    MaximumHeight_cm=-1,
    MaximumWidth_cm=-1,
    menu=[dropdown(0), dropdown(0), dropdown(0)])
python = GhPythonScript()  # -> out, a
# ---------- python: Python ----------
__author__ = "Sophia"
__version__ = "2021.06.21"

import rhinoscriptsyntax as rs

import sys
print(sys.path)



sys.path.append('C:\\Users\\Sophia\\anaconda3\\envs\\research\\Lib\\site-packages')

import compas
from compas.datastructures import Mesh
from compas_ghpython.artists import MeshArtist

mesh = Mesh.from_obj(compas.get('faces.obj'))

a = MeshArtist(mesh).draw()
# ---------- end python ----------
xlsx_import = ExcelStaticRead(Connect=True, SheetNum=1, DataRange="all")  # -> DataOutput, Message
xlsx_import_2 = ExcelStaticRead(Connect=True, SheetNum=1, DataRange="all")  # -> DataOutput, Message
xlsx_import_3 = ExcelStaticRead(Connect=True, SheetNum=1, DataRange="all")  # -> DataOutput, Message
col = Colour(reverse([ColourSwatch(SwatchColor=RGB(117, 0, 0)), ColourSwatch(SwatchColor=RGB(214, 94, 94)), ColourSwatch(SwatchColor=RGB(255, 255, 255)), ColourSwatch(SwatchColor=RGB(53, 46, 255)), ColourSwatch(SwatchColor=RGB(0, 43, 153))]))
penalty_value = Panel("1000")
cost_hangers_chf_kg = Panel("18")
cost_structural_steel_chf_kg = Panel("4")
panel_14 = Panel("Penalty Function")
panel_15 = Panel("Loss Function")
naive_bayes_classification_trainer = NaiveBayesClassificationTrainer()  # -> TrainedNaiveBayesClassifier, ConfusionMatrix
load_model = LoadModel()
load_model_2 = LoadModel()
threshhold_ratio_t = Panel("0.5")
threshhold_ratio_t_2 = Panel("0.5")
p2 = Panel("1000")
p2_2 = Panel("1000")
num_2 = Number(p2_2)
threshhold_ratio_t_3 = Panel("0.5")
p2_3 = Panel("1000")
p1 = Panel("5")
p1_2 = Panel("100")
p1_3 = Panel("50")
num_3 = Number(p1)
num_4 = Number(p1_2)
num_5 = Number(p2)
num_6 = Number(threshhold_ratio_t)
num_7 = Number(threshhold_ratio_t_2)
num_8 = Number(p1_3)
num_9 = Number(p2_3)
num_10 = Number(threshhold_ratio_t_3)
naive_bayes_classification_tester = NaiveBayesClassificationTester(NaiveBayesClassifier=load_model_2)  # -> Classifications, Probabilties
panel_16 = Panel("Sum(p*(u-1)^2) (-)")
merge = Merge(
    Data1=flatten("Material. Cost (T. CHF)   "),
    Data2=flatten("Maximum Utilisation (-)"),
    Data3=flatten("Utilisation Loss (-)"))
objective_names = Text(merge)
panel_18 = Panel(objective_names)
dead_load_from_edge_arch_bracing = PointLoad(LoadCase=1, Force=Vector(0, 0, 0), Moment=Vector(0, 0, 0), RotationalDisplacement=Vector(0, 0, 0), HostLocal_2=False)
dead_load_of_arch = LineLoad(LoadCase=1, Force=Vector(0, 0, 0), Moment=Vector(0, 0, 0), HostLocal=False)
dead_load_of_tie_girder = LineLoad(LoadCase=1, Force=Vector(0, 0, 0), Moment=Vector(0, 0, 0), HostLocal=False)
dead_load_from_interior_arch_bracing = PointLoad(LoadCase=1, Force=Vector(0, 0, 0), Moment=Vector(0, 0, 0), RotationalDisplacement=Vector(0, 0, 0), HostLocal_2=False)
live_load_end_cross_girder_symmetric = PointLoad(LoadCase=1, Force=Vector(0, 0, 0), Moment=Vector(0, 0, 0), RotationalDisplacement=Vector(0, 0, 0), HostLocal_2=False)
live_load_interior_cross_girder_symmetri = PointLoad(LoadCase=1, Force=Vector(0, 0, 0), Moment=Vector(0, 0, 0), RotationalDisplacement=Vector(0, 0, 0), HostLocal_2=False)  # "Live Load - Interior Cross Girder - Symmetric"
dead_load_interior_cross_girder = PointLoad(LoadCase=1, Force=Vector(0, 0, 0), Moment=Vector(0, 0, 0), RotationalDisplacement=Vector(0, 0, 0), HostLocal_2=False)
dead_load_end_cross_girder = PointLoad(LoadCase=1, Force=Vector(0, 0, 0), Moment=Vector(0, 0, 0), RotationalDisplacement=Vector(0, 0, 0), HostLocal_2=False)
neg = Negative()
objectives = Number(flatten(neg))
merge_2 = Merge(Data1=flatten("Struct. Mass (kg)   "), Data2=flatten("Maximum Utilisation (-)"), Data3=flatten("Utilisation Loss (-)"))
objectives_to_maximize = Panel(objectives)
objective_names_2 = Text(merge_2)
dead_load_from_edge_arch_bracing_2 = PointLoad(LoadCase=1, Force=Vector(0, 0, 0), Moment=Vector(0, 0, 0), RotationalDisplacement=Vector(0, 0, 0), HostLocal_2=False)
dead_load_from_interior_arch_bracing_2 = PointLoad(LoadCase=1, Force=Vector(0, 0, 0), Moment=Vector(0, 0, 0), RotationalDisplacement=Vector(0, 0, 0), HostLocal_2=False)
dead_load_end_cross_girder_2 = PointLoad(LoadCase=1, Force=Vector(0, 0, 0), Moment=Vector(0, 0, 0), RotationalDisplacement=Vector(0, 0, 0), HostLocal_2=False)
dead_load_of_arch_2 = LineLoad(LoadCase=1, Force=Vector(0, 0, 0), Moment=Vector(0, 0, 0), HostLocal=False)
live_load_interior_cross_girder_assymmet = PointLoad(LoadCase=1, Force=Vector(0, 0, 0), Moment=Vector(0, 0, 0), RotationalDisplacement=Vector(0, 0, 0), HostLocal_2=False)  # "Live Load - Interior Cross Girder - Assymmetric 1"
dead_load_interior_cross_girder_2 = PointLoad(LoadCase=1, Force=Vector(0, 0, 0), Moment=Vector(0, 0, 0), RotationalDisplacement=Vector(0, 0, 0), HostLocal_2=False)
dead_load_of_tie_girder_2 = LineLoad(LoadCase=1, Force=Vector(0, 0, 0), Moment=Vector(0, 0, 0), HostLocal=False)
live_load_end_cross_girder_asymmetric_1 = PointLoad(LoadCase=1, Force=Vector(0, 0, 0), Moment=Vector(0, 0, 0), RotationalDisplacement=Vector(0, 0, 0), HostLocal_2=False)
objectives_to_maximize_2 = Panel(objective_names_2)
dead_load_of_arch_3 = LineLoad(LoadCase=1, Force=Vector(0, 0, 0), Moment=Vector(0, 0, 0), HostLocal=False)
dead_load_of_tie_girder_3 = LineLoad(LoadCase=1, Force=Vector(0, 0, 0), Moment=Vector(0, 0, 0), HostLocal=False)
dead_load_from_edge_arch_bracing_3 = PointLoad(LoadCase=1, Force=Vector(0, 0, 0), Moment=Vector(0, 0, 0), RotationalDisplacement=Vector(0, 0, 0), HostLocal_2=False)
dead_load_from_interior_arch_bracing_3 = PointLoad(LoadCase=1, Force=Vector(0, 0, 0), Moment=Vector(0, 0, 0), RotationalDisplacement=Vector(0, 0, 0), HostLocal_2=False)
dead_load_end_cross_girder_3 = PointLoad(LoadCase=1, Force=Vector(0, 0, 0), Moment=Vector(0, 0, 0), RotationalDisplacement=Vector(0, 0, 0), HostLocal_2=False)
dead_load_interior_cross_girder_3 = PointLoad(LoadCase=1, Force=Vector(0, 0, 0), Moment=Vector(0, 0, 0), RotationalDisplacement=Vector(0, 0, 0), HostLocal_2=False)
live_load_end_cross_girder_asymmetric_2 = PointLoad(LoadCase=1, Force=Vector(0, 0, 0), Moment=Vector(0, 0, 0), RotationalDisplacement=Vector(0, 0, 0), HostLocal_2=False)
live_load_interior_cross_girder_assymmet_2 = PointLoad(LoadCase=1, Force=Vector(0, 0, 0), Moment=Vector(0, 0, 0), RotationalDisplacement=Vector(0, 0, 0), HostLocal_2=False)  # "Live Load - Interior Cross Girder - Assymmetric 2"
dead_load_from_edge_arch_bracing_4 = PointLoad(LoadCase=1, Force=Vector(0, 0, 0), Moment=Vector(0, 0, 0), RotationalDisplacement=Vector(0, 0, 0), HostLocal_2=False)
dead_load_of_arch_4 = LineLoad(LoadCase=1, Force=Vector(0, 0, 0), Moment=Vector(0, 0, 0), HostLocal=False)
dead_load_of_tie_girder_4 = LineLoad(LoadCase=1, Force=Vector(0, 0, 0), Moment=Vector(0, 0, 0), HostLocal=False)
dead_load_from_interior_arch_bracing_4 = PointLoad(LoadCase=1, Force=Vector(0, 0, 0), Moment=Vector(0, 0, 0), RotationalDisplacement=Vector(0, 0, 0), HostLocal_2=False)
dead_load_end_cross_girder_4 = PointLoad(LoadCase=1, Force=Vector(0, 0, 0), Moment=Vector(0, 0, 0), RotationalDisplacement=Vector(0, 0, 0), HostLocal_2=False)
dead_load_interior_cross_girder_4 = PointLoad(LoadCase=1, Force=Vector(0, 0, 0), Moment=Vector(0, 0, 0), RotationalDisplacement=Vector(0, 0, 0), HostLocal_2=False)
loadcase = LoadCase(Facd=0)
sofiload = SOFiLOAD(
    Ld=flatten([live_load_interior_cross_girder_assymmet_2, live_load_end_cross_girder_asymmetric_2, live_load_end_cross_girder_asymmetric_1, live_load_interior_cross_girder_assymmet, live_load_end_cross_girder_symmetric, live_load_interior_cross_girder_symmetri, dead_load_interior_cross_girder, dead_load_end_cross_girder, dead_load_end_cross_girder_2, dead_load_end_cross_girder_3, dead_load_interior_cross_girder_3, dead_load_interior_cross_girder_2, dead_load_end_cross_girder_4, dead_load_interior_cross_girder_4, dead_load_from_edge_arch_bracing_3, dead_load_from_interior_arch_bracing_3, dead_load_from_edge_arch_bracing_2, dead_load_from_interior_arch_bracing_2, dead_load_from_edge_arch_bracing, dead_load_from_interior_arch_bracing, dead_load_of_tie_girder_4, dead_load_of_tie_girder_3, dead_load_of_arch_3, dead_load_of_tie_girder_2, dead_load_of_arch_2, dead_load_of_tie_girder, dead_load_of_arch]),
    LoadCase=loadcase)
export_teddy = TextFile(TextInput=sofiload, SOF_STREAM_CONTENT=True)
xlsx_import_4 = ExcelStaticRead(Connect=True, SheetNum=1, DataRange="all")  # -> DataOutput, Message
xlsx_import_5 = ExcelStaticRead(Connect=True, SheetNum=1, DataRange="all")  # -> DataOutput, Message
xlsx_import_6 = ExcelStaticRead(Connect=True, SheetNum=1, DataRange="all")  # -> DataOutput, Message
xlsx_import_7 = ExcelStaticRead(Connect=True, SheetNum=1, DataRange="all")  # -> DataOutput, Message
xlsx_import_8 = ExcelStaticRead(Connect=True, SheetNum=1, DataRange="all")  # -> DataOutput, Message
xlsx_import_9 = ExcelStaticRead(Connect=True, SheetNum=1, DataRange="all")  # -> DataOutput, Message
tie = StructuralLine(Number=0, Group=0, DirZ=Vector(0, 0, 0), ElementType="Beam", ElementSize_2=0)
hangers = StructuralLine(Number=0, Group=0, DirZ=Vector(0, 0, 0), ElementType="Beam", ElementSize_2=0)
arch = StructuralLine(Number=0, Group=0, DirZ=Vector(0, 0, 0), ElementType="Beam", ElementSize_2=0)
support = StructuralPoint(Number=0, DirX=Vector(0, 0, 0), DirZ=Vector(0, 0, 0))
xlsx_export_interior_cross_girder_f = ExcelWrite(SheetNum=1, Connect=True, DataRange="all")
xlsx_export_interior_cross_girder_x = ExcelWrite(SheetNum=1, Connect=True, DataRange="all")
xlsx_export_interior_cross_girder_y = ExcelWrite(SheetNum=1, Connect=True, DataRange="all")
xlsx_export_interior_cross_girder_z = ExcelWrite(SheetNum=1, Connect=True, DataRange="all")
support_2 = StructuralPoint(Number=0, DirX=Vector(0, 0, 0), DirZ=Vector(0, 0, 0))
xlsx_export = ExcelWrite(SheetNum=1, Connect=True, DataRange="BK57:BK72")
xlsx_export_2 = ExcelWrite(SheetNum=1, Connect=True, DataRange="BK57:BK72")
xlsx_export_3 = ExcelWrite(SheetNum=1, Connect=True, DataRange="all")
xlsx_export_4 = ExcelWrite(SheetNum=1, Connect=True, DataRange="BK57:BK72")
xlsx_export_5 = ExcelWrite(SheetNum=1, Connect=True, DataRange="BK57:BK72")
xlsx_export_6 = ExcelWrite(SheetNum=1, Connect=True, DataRange="BK57:BK72")
exwrite = ExcelWrite(SheetNum=1, Connect=True, DataRange="all")
exwrite_2 = ExcelWrite(SheetNum=1, Connect=True, DataRange="all")
sofimshc = SOFiMSHC(
    StructuralElements=flatten([support, tie, arch, hangers, support_2]),
    InitSystem=True,
    CreateMesh=True,
    MeshDensity=0,
    IntersectionTolerance=0.01,
    StartIndex=1000,
    GroupDivisor=-1000)
xlsx_import_10 = ExcelStaticRead(Connect=True, SheetNum=1, DataRange="all")  # -> DataOutput, Message
export_teddy_2 = TextFile(TextInput=sofimshc, SOF_STREAM_CONTENT=True)
xlsx_export_end_cross_girder_f = ExcelWrite(SheetNum=1, Connect=True, DataRange="all")
xlsx_export_end_cross_girder_x = ExcelWrite(SheetNum=1, Connect=True, DataRange="all")
xlsx_export_end_cross_girder_y = ExcelWrite(SheetNum=1, Connect=True, DataRange="all")
xlsx_export_end_cross_girder_z = ExcelWrite(SheetNum=1, Connect=True, DataRange="all")
xlsx_import_11 = ExcelStaticRead(Connect=True, SheetNum=1, DataRange="all")  # -> DataOutput, Message
xlsx_import_12 = ExcelStaticRead(Connect=True, SheetNum=1, DataRange="all")  # -> DataOutput, Message
xlsx_import_13 = ExcelStaticRead(Connect=True, SheetNum=1, DataRange="all")  # -> DataOutput, Message
xlsx_import_14 = ExcelStaticRead(Connect=True, SheetNum=1, DataRange="all")  # -> DataOutput, Message
xlsx_import_15 = ExcelStaticRead(Connect=True, SheetNum=1, DataRange="all")  # -> DataOutput, Message
xlsx_import_16 = ExcelStaticRead(Connect=True, SheetNum=1, DataRange="all")  # -> DataOutput, Message
xlsx_export_tie_y1 = ExcelWrite(SheetNum=1, Connect=True, DataRange="all")
xlsx_export_tie_y2 = ExcelWrite(SheetNum=1, Connect=True, DataRange="all")
xlsx_export_tie_z1 = ExcelWrite(SheetNum=1, Connect=True, DataRange="all")
xlsx_export_tie_x2 = ExcelWrite(SheetNum=1, Connect=True, DataRange="all")
xlsx_export_tie_z2 = ExcelWrite(SheetNum=1, Connect=True, DataRange="all")
xlsx_export_tie_x1 = ExcelWrite(SheetNum=1, Connect=True, DataRange="all")
xlsx_export_tie_f = ExcelWrite(SheetNum=1, Connect=True, DataRange="all")
xlsx_export_arch_y1 = ExcelWrite(SheetNum=1, Connect=True, DataRange="all")
xlsx_export_arch_y2 = ExcelWrite(SheetNum=1, Connect=True, DataRange="all")
xlsx_export_arch_z1 = ExcelWrite(SheetNum=1, Connect=True, DataRange="all")
xlsx_export_arch_x1 = ExcelWrite(SheetNum=1, Connect=True, DataRange="all")
xlsx_export_arch_x2 = ExcelWrite(SheetNum=1, Connect=True, DataRange="all")
xlsx_export_arch_f = ExcelWrite(SheetNum=1, Connect=True, DataRange="all")
xlsx_export_arch_z2 = ExcelWrite(SheetNum=1, Connect=True, DataRange="all")
export_teddy_3 = TextFile(SOF_STREAM_CONTENT=True)
xlsx_export_interior_arch_bracing_f = ExcelWrite(SheetNum=1, Connect=True, DataRange="all")
xlsx_export_interior_arch_bracing_x = ExcelWrite(SheetNum=1, Connect=True, DataRange="all")
xlsx_export_interior_arch_bracing_y = ExcelWrite(SheetNum=1, Connect=True, DataRange="all")
xlsx_export_interior_arch_bracing_z = ExcelWrite(SheetNum=1, Connect=True, DataRange="all")
xlsx_export_end_arch_bracing_f = ExcelWrite(SheetNum=1, Connect=True, DataRange="all")
xlsx_export_end_arch_bracing_x = ExcelWrite(SheetNum=1, Connect=True, DataRange="all")
xlsx_export_end_arch_bracing_y = ExcelWrite(SheetNum=1, Connect=True, DataRange="all")
xlsx_export_end_arch_bracing_z = ExcelWrite(SheetNum=1, Connect=True, DataRange="all")
xlsx_export_interior_cross_girder_lls_f = ExcelWrite(SheetNum=1, Connect=True, DataRange="all")
xlsx_export_interior_cross_girder_lls_x = ExcelWrite(SheetNum=1, Connect=True, DataRange="all")
xlsx_export_interior_cross_girder_lls_y = ExcelWrite(SheetNum=1, Connect=True, DataRange="all")
xlsx_export_interior_cross_girder_lls_z = ExcelWrite(SheetNum=1, Connect=True, DataRange="all")
xlsx_export_end_cross_girder_lls_f = ExcelWrite(SheetNum=1, Connect=True, DataRange="all")
xlsx_export_end_cross_girder_lls_x = ExcelWrite(SheetNum=1, Connect=True, DataRange="all")
xlsx_export_end_cross_girder_lls_y = ExcelWrite(SheetNum=1, Connect=True, DataRange="all")
xlsx_export_end_cross_girder_lls_z = ExcelWrite(SheetNum=1, Connect=True, DataRange="all")
xlsx_export_interior_cross_girder_llal_z = ExcelWrite(SheetNum=1, Connect=True, DataRange="all")
xlsx_export_interior_cross_girder_llal_f = ExcelWrite(SheetNum=1, Connect=True, DataRange="all")
xlsx_export_interior_cross_girder_llal_x = ExcelWrite(SheetNum=1, Connect=True, DataRange="all")
xlsx_export_interior_cross_girder_llal_y = ExcelWrite(SheetNum=1, Connect=True, DataRange="all")
xlsx_export_end_cross_girder_al_f = ExcelWrite(SheetNum=1, Connect=True, DataRange="all")
xlsx_export_end_cross_girder_llal_x = ExcelWrite(SheetNum=1, Connect=True, DataRange="all")
xlsx_export_end_cross_girder_llal_y = ExcelWrite(SheetNum=1, Connect=True, DataRange="all")
xlsx_export_end_cross_girder_llal_z = ExcelWrite(SheetNum=1, Connect=True, DataRange="all")
xlsx_export_interior_cross_girder_llar_z = ExcelWrite(SheetNum=1, Connect=True, DataRange="all")
xlsx_export_interior_cross_girder_llar_f = ExcelWrite(SheetNum=1, Connect=True, DataRange="all")
xlsx_export_interior_cross_girder_llar_x = ExcelWrite(SheetNum=1, Connect=True, DataRange="all")
xlsx_export_interior_cross_girder_llar_y = ExcelWrite(SheetNum=1, Connect=True, DataRange="all")
xlsx_export_end_cross_girder_ar_f = ExcelWrite(SheetNum=1, Connect=True, DataRange="all")
xlsx_export_end_cross_girder_llar_x = ExcelWrite(SheetNum=1, Connect=True, DataRange="all")
xlsx_export_end_cross_girder_llar_y = ExcelWrite(SheetNum=1, Connect=True, DataRange="all")
xlsx_export_end_cross_girder_llar_z = ExcelWrite(SheetNum=1, Connect=True, DataRange="all")

# ---- group: Predicted Parameters
# Currently only the chosen categorial properties work.
# 
# If the others are not implemented then change back to only steel option??
# 
# Or A error message when a differnt material etc is chosen
material_arch = ValueList({"Steel": 0, "Reinforced Concrete": 1, "Prestressed Concrete": 2, "Wood": 3}, selected="Steel")
material_tieback = ValueList({"Steel": 0, "Tendon Cables": 1, "Reinforced Concrete": 2, "Prestressed Concrete": 3, "Steel-Concrete Composite": 4}, selected="Steel")
material_deck = ValueList({"Steel": 0, "Reinforced Concrete": 1, "Prestressed Concrete": 2, "Steel-Concrete Composite": 3}, selected="Steel-Concrete Composite")
span_m = Slider(257.5, range=3..400)
rise_of_arch_m_f = Slider(5, range=5..180)
hanger_spacing_m = Slider(21.78, range=1..40)
hanger_arrangement = ValueList({"Parallel": 0, "Radial": 1, "Increasing Inclination": 2, "Constant Distance": 3}, selected="Parallel")
width_m = Slider(16, range=0..50)

# ----
selected_material_list = Panel([material_arch, material_tieback, material_deck])
chosen_materiasls = Number(selected_material_list)

# ---- group: Further Advisory
# Hanger Material: Wire Rope (ASTM A-416, Grade 270)
typical_hanger_inlcination = Panel("""60°
experienced Range: 50-70°""")
typical_tie_and_arch_material = Panel("A572Grade50")

# ---- group: Further necessary input parameters
tie_and_arch_cs_depth_m_3 = Slider(1.092, range=0.2..3.5)
cross_section_type_arch_and_tie = Panel("Box-CrossSection")
hangers_cross_section_m2 = Slider(0.0011, range=0.001..0.006)
cross_sectiontype_hangers = Panel("O-Profile")
hanger_material = Panel("Wire Rope (ASTM A-416, Grade 270)")
tie_and_arch_material = Panel("S355")
alpha0 = Slider(44, range=35..80)
zeta = Slider(0, range=-1..1.01)
deltaalpha = Slider(0, range=-3..2)
deltaalpha_2 = Number(deltaalpha)
zeta_2 = Number(zeta)

# ----
paramgate = GhPythonScript(
    x=row_i.a,
    p1=span_m,
    p2=rise_of_arch_m_f,
    p3=width_m,
    p4=hanger_spacing_m,
    p5=alpha0,
    p6=tie_and_arch_cs_depth_m_3,
    p7=hangers_cross_section_m2,
    p8=number_slider_2,
    p9=number_slider,
    p10=number_slider_3)  # -> out, p1, p2, p3, p4, p5, p6, p7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; inputs x: list
# ---------- paramgate: Python ----------
import rhinoscriptsyntax as rs

# Order: Span [m], Rise of Arch [m]; Width [m]; Hanger Spacing [m]; Alpha0 [°]; Tie and Arch CS-Depth [m], Hanger CS-Area [m^2]; h/b Box CS [-]; tw/h Box [-], tf/b Box [-]

if isinstance(x, list) and len(x) > 0 and x[0] != None:
    p1 = x[0]
    p2 = x[1]
    p3 = x[2]
    p4 = x[3]
    p5 = x[4]
    p6 = x[5]
    p7 = x[6]
    p8 = x[7]
    p9 = x[8]
    p10 = x[9]
    
    print(x)

else:
    p1 = _p1
    p2 = _p2
    p3 = _p3
    p4 = _p4
    p5 = _p5
    p6 = _p6
    p7 = _p7
    p8 = _p8
    p9 = _p9
    p10 = _p10
# ---------- end paramgate ----------

# ---- group: Predicted Parameters (continued)
rise_of_arch_3 = Number(paramgate.p2)
hanger_spacing_3 = Number(paramgate.p4)
width = Number(paramgate.p3)
span = Number(paramgate.p1)

# ----
# Predicted Parameters
# Rise of Arch: 25.62 m
# Hanger Spacing 11.37 m
panel_19 = Panel(span)
width_2 = Number(width)
span_2 = Number(span)
eval = Evaluate(F="a*Width+b", Width=width_2, a=a, b=b)
eval_2 = Evaluate(F="a*Span+b", Span=span_2, a=a_2, b=b_2)

# ---- group: Further Advisory (continued)
tie_and_arch_cross_section_hight = Panel(eval_2)
hanger_cs_area_m2_3 = Panel(eval)

# ----
hanger_cs_area_m2_4 = Number(paramgate.p7)
tie_and_arch_cs_depth_m_4 = Number(paramgate.p6)
division = Division(A=rise_of_arch_3, B=span)

# ---- group: Parameter Calculation
division_2 = Division(A=span, B=hanger_spacing_3)
round = Round(Number=division_2)  # -> Nearest, Floor, Ceiling
number_of_hangers = Panel(round.Nearest)
number_of_hangers_2 = Number(number_of_hangers)

# ----
rise_to_span_ratio = Number(division)

# ---- group: Further necessary input parameters (continued)
alpha0_2 = Number(paramgate.p5)

# ----
panel_20 = Panel(rise_to_span_ratio)

# ---- group: Geometry / TIE CREATION
span_3 = Number(span)
division_3 = Division(A=span_3, B="2")
multiplication = Multiplication(A=division_3, B="-1")
pt = ConstructPoint(XCoordinate=multiplication, YCoordinate="0", ZCoordinate="0")
pt_2 = ConstructPoint(XCoordinate=division_3, YCoordinate="0", ZCoordinate="0")
ln = Line(StartPoint=pt, EndPoint=pt_2)
tie_2 = Line(ln)

# ---- group: Geometry / ARCH CREATION
rise_of_arch_4 = Number(rise_of_arch_3)
span_4 = Number(span)
divide = DivideCurve(Curve=tie_2, Count=Slider(200, range=0..200), Kinks=False)  # -> Points, Tangents, Parameters
pdecon = Deconstruct(Point=divide.Points)  # -> XComponent, YComponent, ZComponent
eval_3 = Evaluate(F="-(4/(L*L))*f*x*x+f", x=pdecon.XComponent, L=span_4, f=rise_of_arch_4)
pt_3 = ConstructPoint(XCoordinate=pdecon.XComponent, YCoordinate=pdecon.YComponent, ZCoordinate=eval_3)
intcrv = Interpolate(Vertices=pt_3, Degree=3, Periodic=False, KnotStyle=1)  # -> Curve, Length, Domain
pline = PolyLine(Vertices=pt_3, Closed=False)
arch_2 = Curve(pline)

# ---- group: Geometry / CREATION HANGERS (adapted from Riccardo)
nummber_of_hangers = Number(number_of_hangers_2)
deltaalpha_3 = Number(deltaalpha_2)
alpha0_3 = Number(alpha0_2)
zeta_3 = Number(zeta_2)
arch_3 = Curve(arch_2)
span_m_2 = Number(span)
rad = Radians(Degrees=deltaalpha_3)
rad_2 = Radians(Degrees=alpha0_3)
n_last_hangerindex = Evaluate(F="n-1", n=nummber_of_hangers)
n_range = Range(Domain=n_last_hangerindex, Steps=n_last_hangerindex)
n_help_hanger = Evaluate(F="(L-L*(i+1)/(n+1)-Zeta*L/(4*(n+1)))-L/2", L=span_m_2, i=n_range, n=nummber_of_hangers, Zeta=zeta_3)
n_help_hanger_2 = Evaluate(
    F="(L-L*(i+1)/(n+1)+Zeta*L/(4*(n+1)))*tan(a0-da*i)",
    L=span_m_2,
    da=rad,
    a0=rad_2,
    i=n_range,
    n=nummber_of_hangers,
    Zeta=zeta_3)
p_nodes_tie = ConstructPoint(XCoordinate=n_help_hanger, YCoordinate=0, ZCoordinate=0)  # -> reverse(Point)
n_help_hanger_3 = Evaluate(F="l/2", l=span_m_2)
p_help_hangers = ConstructPoint(XCoordinate=n_help_hanger_3, YCoordinate=0, ZCoordinate=n_help_hanger_2)
vec2pt = Vector2Pt(PointA=p_nodes_tie, PointB=p_help_hangers, Unitize=False)  # -> reverse(Vector), Length
p_nodes_tie_2 = Mirror(Geometry=p_nodes_tie, Plane=PlaneYZ(0, 0, 0))  # -> Geometry, Transform
p_help_hangers_2 = Vector(vec2pt.Vector)
p_help_hangers_3 = VectorLength(Vector=p_help_hangers_2)
p_help_hangers_4 = Multiplication(A=p_help_hangers_3, B=2)
p_help_hangers_5 = Amplitude(Vector=p_help_hangers_2, Amplitude=p_help_hangers_4)
p_help_hangers_6 = Reverse(Vector=p_help_hangers_5)
p_help_hangers_7 = Move(Geometry=reverse(p_help_hangers), Motion=p_help_hangers_6)  # -> reverse(Geometry), Transform
l_hangers_bl_tr = Line(StartPoint=p_help_hangers_7.Geometry, EndPoint=p_help_hangers)  # -> reverse(Line)
l_hangers_br_tl = Mirror(Geometry=l_hangers_bl_tr, Plane=PlaneYZ(0, 0, 0))  # -> Geometry, Transform
arch_4 = Curve(arch_3)
p_nodes_arch = CurveLine(Curve=arch_4, Line=l_hangers_br_tl.Geometry)  # -> flatten(Points), Params, Count
l_hangers_br_tl_2 = Line(StartPoint=reverse(p_nodes_tie_2.Geometry), EndPoint=p_nodes_arch.Points)  # -> reverse(Line)
l_hangers_bl_tr_2 = Mirror(Geometry=l_hangers_br_tl_2, Plane=PlaneYZ(0, 0, 0))  # -> Geometry, Transform
hangers_2 = Curve([l_hangers_br_tl_2, l_hangers_bl_tr_2.Geometry])
end = EndPoints(Curve=hangers_2)  # -> Start, End
arch_nodes = Point(end.End)
tie_nodes = Point(end.Start)

# ---- group: Geometry
tie_nodes_2 = Point(tie_nodes)
tie_3 = Line(tie_2)
end_2 = EndPoints(Curve=tie_3)  # -> Start, End
sort_pt = SortPoints(Points=tie_nodes_2)  # -> Points, Indices
lng = ListLength(List=sort_pt.Points)
panel_21 = Panel(lng)
ins = InsertItems(List=sort_pt.Points, Item=end_2.Start, Indices="0", Wrap=True)
ins_2 = InsertItems(List=sort_pt.Points, Item=end_2.End, Indices=panel_21, Wrap=True)
ln_2 = Line(StartPoint=ins, EndPoint=ins_2)
tie_pieces = Line(ln_2)
lng_2 = ListLength(List=tie_pieces)
subtraction = Subtraction(A=lng_2, B="1")
item_5 = ListItem(List=tie_pieces, Index="0", Wrap=True)
item_6 = ListItem(List=tie_pieces, Index=subtraction, Wrap=True)

arch_nodes_2 = Point(arch_nodes)
arch_5 = Curve(arch_2)
end_3 = EndPoints(Curve=arch_5)  # -> Start, End
sort_pt_2 = SortPoints(Points=arch_nodes_2)  # -> Points, Indices
lng_3 = ListLength(List=sort_pt_2.Points)
ins_3 = InsertItems(List=sort_pt_2.Points, Item=end_3.Start, Indices="0", Wrap=True)
panel_22 = Panel(lng_3)
ins_4 = InsertItems(List=sort_pt_2.Points, Item=end_3.End, Indices=panel_22, Wrap=True)
ln_3 = Line(StartPoint=ins_3, EndPoint=ins_4)
arch_pieces = Line(ln_3)
item_7 = ListItem(List=arch_pieces, Index="28", Wrap=True)

# ---- group: Cross Sections / Box
panel_23 = Panel(tie_and_arch_cs_depth_m_4)
material_list_2 = MaterialKaramba3D(material_list)
multiplication_2 = Multiplication(A=panel_23, B="100")
number = Number(paramgate.p10)
number_2 = Number(paramgate.p8)
number_3 = Number(paramgate.p9)
panel_24 = Panel(tie_and_arch_material)
division_4 = Division(A=multiplication_2, B=number_2)
multiplication_3 = Multiplication(A=multiplication_2, B=number)
matselect_4 = MaterialSelectionKaramba3D(Materials=material_list_2, NameOrListIndexOfMaterial=panel_24, menu=[dropdown(0), dropdown(0)])
disassemble = DisassembleMaterialKaramba3D(Material=matselect_4)  # -> Material, TypeOfMaterial, FamilyNameOfMaterial, NameOfMaterial, ElemIdentifiers, Color, YoungsModulusKNCm2Dir12, InPlaneShearModulus_kN_cm2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
fy_kn_cm2_2 = Panel(disassemble.YieldStrengthKNCm2Dir12)
web_thickness = Panel(multiplication_3)
cs_width = Panel(division_4)
multiplication_4 = Multiplication(A=cs_width, B=number_3)
flange_thickness = Panel(multiplication_4)
fy_box_cs_kn_cm2 = Number(fy_kn_cm2_2)
cross_section = CrossSectionKaramba3D(
    FamilyNameOfCrossSection="DefaultCroSec",
    NameOfCrossSection="Box-CrossSection",
    Material=matselect_4,
    Height_cm=multiplication_2,
    UpperFlangeWidth_cm=cs_width,
    LowerFlangeWidth_cm=cs_width,
    UpperFlangeThickness_cm=flange_thickness,
    LowerFlangeThickness_cm=flange_thickness,
    SidewallsThickness_cm=web_thickness,
    FilletRadius_cm=0.6,
    mode="Box")
panel_25 = Panel(cross_section)
box_cross_section = CrossSectionKaramba3D(cross_section)
crosecrselect_2 = CrossSectionRangeSelectorKaramba3D(MaximumHeight_cm=-1, MaximumWidth_cm=-1, menu=[dropdown(0), dropdown(0), dropdown(0)])
disassemble_2 = DisassembleCrossSectionKaramba3D(CroSec=box_cross_section)  # -> CrossSection, FamilyNameOfCrossSection, TypeNameOfCrossSection, ElemIdentifiers, Color, Material, LocalEccentricity_cm, Heights_cm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
modify_crosec = ModifyCrossSectionKaramba3D(mode="Beam")

# ---- group: Cross Sections / Rope
thickness_cm = Panel("2")
panel_26 = Panel(hanger_material)
hanger_cs_area_m2_5 = Panel(hanger_cs_area_m2_4)
material_list_3 = MaterialKaramba3D(material_list)
multiplication_5 = Multiplication(A=thickness_cm, B=0.01)
matselect_5 = MaterialSelectionKaramba3D(Materials=material_list_3, NameOrListIndexOfMaterial=panel_26, menu=[dropdown(0), dropdown(0)])
eval_4 = Evaluate(F="(1/2)*((t/4) + ((A*4)/(π*t)))", A=hanger_cs_area_m2_5, t=multiplication_5)
multiplication_6 = Multiplication(A=eval_4, B=100)
panel_27 = Panel(multiplication_6)
eval_5 = Evaluate(F="(π*d²)/4 - (π*(d-2*t)²)/4", d=panel_27, t=thickness_cm)
disassemble_3 = DisassembleMaterialKaramba3D(Material=matselect_5)  # -> Material, TypeOfMaterial, FamilyNameOfMaterial, NameOfMaterial, ElemIdentifiers, Color, YoungsModulusKNCm2Dir12, InPlaneShearModulus_kN_cm2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
check_a_cm2 = Panel(eval_5)
panel_28 = Panel("O-Profile")
cross_section_2 = CrossSectionKaramba3D(
    FamilyNameOfCrossSection="DefaultCroSec",
    NameOfCrossSection=panel_28,
    Material=matselect_5,
    Diameter_cm=panel_27,
    WallThickness_cm=thickness_cm,
    mode="Circular Hollow")
panel_29 = Panel(cross_section_2)
o_cross_section = CrossSectionKaramba3D(cross_section_2)
disassemble_4 = DisassembleCrossSectionKaramba3D(CroSec=o_cross_section)  # -> CrossSection, FamilyNameOfCrossSection, TypeNameOfCrossSection, ElemIdentifiers, Color, Material, LocalEccentricity_cm, Heights_cm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
rope_a_cm2 = Number(disassemble_4.Area_cm2)
panel_30 = Panel(disassemble_4.Area_cm2)

# ----
e_box_cs_kn_cm2 = Number(disassemble.YoungsModulusKNCm2Dir12)

# ---- group: Geometry / Check for doubbles
arch_pieces_2 = Line(arch_pieces)
tie_pieces_2 = Line(tie_pieces)
hangers_3 = Curve(hangers_2)
rdlines = RemoveDuplicateLinesKaramba3D(Line=tie_pieces_2, LimitDistance=0.005)  # -> OutLine, Info, Indexes
rdlines_2 = RemoveDuplicateLinesKaramba3D(Line=hangers_3, LimitDistance=0.005)  # -> OutLine, Info, Indexes
rdlines_3 = RemoveDuplicateLinesKaramba3D(Line=arch_pieces_2, LimitDistance=0.005)  # -> OutLine, Info, Indexes
panel_31 = Panel(rdlines.Indexes)
panel_32 = Panel(rdlines_2.Indexes)
panel_33 = Panel(rdlines_3.Indexes)

# ----
endpointarch = Point(end_3.End)
arch_nodes_3 = Point(arch_nodes)
line = Line(arch_pieces_2)
merge_3 = Merge(Data1=arch_nodes_3, Data2=endpointarch)
midpt = CurveMiddle(Curve=line)
sort_pt_3 = SortPoints(Points=merge_3)  # -> Points, Indices
ln_4 = Line(StartPoint=sort_pt_3.Points, EndPoint=midpt)
xy = XYPlane(Origin=midpt)
len = Length(Curve=ln_4)
arch_6 = Curve(arch_2)
sph = Sphere(Base=xy, Radius=len)
trim = TrimWithBrep(Curve=arch_6, Brep=sph)  # -> flatten(Inside), Outside
subtraction_2 = Subtraction(A="10", B="1")
divide_2 = DivideCurve(Curve=trim.Inside, Count="10", Kinks=False)  # -> Points, Tangents, Parameters
cull_i = CullIndex(List=divide_2.Points, Indices=0, Wrap=True)
cull_i_2 = CullIndex(List=cull_i, Indices=subtraction_2, Wrap=True)
archpiecesdivisionpoints = Point(cull_i_2)
archpiecesdivisionpoints_2 = Point(flatten(archpiecesdivisionpoints))
pt_4 = Point(sort_pt_2.Points)
merge_4 = Merge(Data1=pt_4, Data2=archpiecesdivisionpoints_2)  # -> flatten(Result)
sort_pt_4 = SortPoints(Points=merge_4)  # -> Points, Indices
lng_4 = ListLength(List=sort_pt_4.Points)
startpointarch = Point(end_3.Start)
endpointarch_2 = Point(end_3.End)
panel_34 = Panel(lng_4)
ins_5 = InsertItems(List=sort_pt_4.Points, Item=startpointarch, Indices="0", Wrap=True)
ins_6 = InsertItems(List=sort_pt_4.Points, Item=endpointarch_2, Indices=panel_34, Wrap=True)
ln_5 = Line(StartPoint=ins_5, EndPoint=ins_6)
arch_pieces_round_small = Line(ln_5)

# ---- group: Geometry / Output Geometry
arch_pieces_3 = Line(rdlines_3.OutLine)
tie_4 = Line(tie_2)
hangers_4 = Curve(rdlines_2.OutLine)
tie_pieces_3 = Line(rdlines.OutLine)
merge_5 = Merge(Data1=flatten(tie_pieces_3), Data2=flatten(arch_pieces_3), Data3=flatten(hangers_4))
arch_7 = Curve(arch_2)
complete_geometry = Curve(merge_5)

# ----
e_rope_kn_cm2 = Number(disassemble_3.YoungsModulusKNCm2Dir12)
item_8 = ListItem(List=cross_section_2, Index=-1, Wrap=True)

# ---- group: Geometry / Split Middle Tie Piece for a even number of Hangers
lng_5 = ListLength(List=tie_pieces_3)
panel_35 = Panel(lng_5)
division_5 = Division(A=panel_35, B="2")
panel_36 = Panel(division_5)
round_2 = Round(Number=panel_36)  # -> Nearest, Floor, Ceiling
split = SplitList(List=tie_pieces_3, Index=round_2.Floor)  # -> ListA, ListB
left_tie_pieces = Line(split.ListB)
right_tie_pieces = Line(split.ListA)

# ----
disassemble_5 = DisassembleCrossSectionKaramba3D(CroSec=item_8)  # -> CrossSection, FamilyNameOfCrossSection, TypeNameOfCrossSection, ElemIdentifiers, Color, Material, LocalEccentricity_cm, Heights_cm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
box_wel_cm3 = Number(disassemble_2.Wely_cm3)
panel_37 = Panel(disassemble_2.Area_cm2)
box_a_cm2 = Number(disassemble_2.Area_cm2)
panel_38 = Panel(disassemble_2.Wely_cm3)
panel_39 = Panel(disassemble_2.Wely_cm3_2)
box_i_cm4 = Number(disassemble_2.Iyy_cm4)

# ---- group: Geometry / Split Middle Tie Piece for a even number of Hangers
subtraction_3 = Subtraction(A=panel_36, B=round_2.Floor)
panel_40 = Panel(subtraction_3)
num_11 = Number(panel_40)
python_2 = GhPythonScript(x=num_11)  # -> out, a
# ---------- python_2: Python ----------
__author__ = "Sophia"
__version__ = "2021.05.27"

import rhinoscriptsyntax as rs

if x==0:
    a=1
    print("The Number of Hanger is odd.")
else:
    a=2
    print("The Number of Hanger is even.")
# ---------- end python_2 ----------
panel_41 = Panel(python_2.out)
split_2 = SplitList(List=left_tie_pieces, Index=1)  # -> ListA, ListB
line_2 = Line(flatten(right_tie_pieces))
middle_line = Line(flatten(split_2.ListA))
divide_3 = DivideCurve(Curve=middle_line, Count=python_2.a, Kinks=False)  # -> Points, Tangents, Parameters
shift = ShiftList(List=divide_3.Points, Shift=1, Wrap=True)
line_3 = Line(flatten(split_2.ListB))
ln_6 = Line(StartPoint=divide_3.Points, EndPoint=shift)
item_9 = ListItem(List=ln_6, Index=1, Wrap=True)  # -> flatten(Item)
item_10 = ListItem(List=ln_6, Index=0, Wrap=True)  # -> flatten(Item)
right_tie_pieces_2 = Line([line_2, item_10])
left_tie_pieces_2 = Line([line_3, item_9])
line_4 = Line([right_tie_pieces_2, left_tie_pieces_2])
rdlines_4 = RemoveDuplicateLinesKaramba3D(Line=line_4, LimitDistance=0.005)  # -> OutLine, Info, Indexes
lng_6 = ListLength(List=rdlines_4.OutLine)
panel_42 = Panel(lng_6)
division_6 = Division(A=panel_42, B="2")
panel_43 = Panel(division_6)
split_3 = SplitList(List=rdlines_4.OutLine, Index=panel_43)  # -> ListA, ListB
right_tie_pieces_3 = Line(split_3.ListA)
left_tie_pieces_3 = Line(split_3.ListB)

# ---- group: Cross Sections
crosec_list = CrossSectionKaramba3D(flatten([box_cross_section, o_cross_section]))
panel_44 = Panel(crosec_list)

# ---- group: Structural Elements
# This group tranforms the geometry lines into structural elements which can be read by the structural analysiser. Each element here get a definition of its cross section and material.
# The Hangers are with FALSE Bending set to be truss elements which can only carry normal forces. There are joints at each end of the hangers.
panel_45 = Panel(cross_section_type_arch_and_tie)
panel_46 = Panel(cross_sectiontype_hangers)
crosec_list_2 = CrossSectionKaramba3D(crosec_list)
crosec_list_3 = CrossSectionKaramba3D(crosec_list)
crosecselect = CrossSectionSelectorKaramba3D(CrossSections=flatten(crosec_list_3), NameOrListIndexOfCrossSection=panel_46)  # -> CrossSection, Info
crosecselect_2 = CrossSectionSelectorKaramba3D(CrossSections=flatten(crosec_list_2), NameOrListIndexOfCrossSection=panel_45)  # -> CrossSection, Info
tie_and_arch_cross_section = CrossSectionKaramba3D(crosecselect_2.CrossSection)
hangers_cross_section = CrossSectionKaramba3D(crosecselect.CrossSection)
left_tie_pieces_4 = Line(left_tie_pieces_3)
panel_47 = Panel("Tie_Left Side")
right_tie_pieces_4 = Line(right_tie_pieces_3)
panel_48 = Panel("Tie_RightSide")
toggle = BooleanToggle(False)
panel_49 = Panel("Hangers")
arch_pieces_4 = Line(arch_pieces_3)
hangers_5 = Curve(hangers_4)
linetobeam = LineToBeamKaramba3D(
    Line=left_tie_pieces_4,
    Identifier=panel_47,
    CrossSection=tie_and_arch_cross_section,
    New=True,
    Remove=True,
    LimitDistance_m=0.005)  # -> Element, Points, Info
linetobeam_2 = LineToBeamKaramba3D(
    Line=right_tie_pieces_4,
    Identifier=panel_48,
    CrossSection=tie_and_arch_cross_section,
    New=True,
    Remove=True,
    LimitDistance_m=0.005)  # -> Element, Points, Info
linetobeam_3 = LineToBeamKaramba3D(
    Line=arch_pieces_4,
    Identifier="Arch",
    CrossSection=tie_and_arch_cross_section,
    New=True,
    Remove=True,
    LimitDistance_m=0.005)  # -> Element, Points, Info
linetobeam_4 = LineToBeamKaramba3D(
    Line=hangers_5,
    Identifier=panel_49,
    CrossSection=hangers_cross_section,
    New=True,
    Remove=True,
    LimitDistance_m=0.005,
    Bending=toggle)  # -> Element, Points, Info
left_tie_element = ElementKaramba3D(linetobeam.Element)
right_tie_elements = ElementKaramba3D(linetobeam_2.Element)
arch_element = ElementKaramba3D(linetobeam_3.Element)
hanger_elements = ElementKaramba3D(linetobeam_4.Element)
tie_element = ElementKaramba3D([right_tie_elements, left_tie_element])
list_of_elements = Panel([panel_48, panel_47, "Arch", panel_49])
element = ElementKaramba3D(flatten([hanger_elements, arch_element, tie_element]))

# ---- group: SUPPORTS
end_4 = EndPoints(Curve=tie_4)  # -> Start, End
pinn_supp = SupportKaramba3D(PosInd=end_4.Start, menu=[buttons(on, on, on, on, off, off)])
roller_supp = SupportKaramba3D(PosInd=end_4.End, menu=[buttons(off, on, on, off, off, off)])
support_3 = SupportKaramba3D(flatten([pinn_supp, roller_supp]))

# ----
lng_7 = ListLength(List=left_tie_element)
panel_50 = Panel(lng_7)
division_7 = Division(A=panel_50, B="2")
panel_51 = Panel(division_7)
round_3 = Round(Number=panel_51)  # -> Nearest, Floor, Ceiling
subtraction_4 = Subtraction(A=round_3.Nearest, B="1")
split_4 = SplitList(List=left_tie_element, Index=subtraction_4)  # -> ListA, ListB
tie_elements_right_side = ElementKaramba3D(split_4.ListA)
tie_elements_left_side = ElementKaramba3D(split_4.ListB)

item_11 = ListItem(List=arch_pieces_4, Index=24, Wrap=True)
hanger_elements_2 = ElementKaramba3D(hanger_elements)
tie_element_2 = ElementKaramba3D(tie_element)
arch_element_2 = ElementKaramba3D(arch_element)
assemble = AssembleModelKaramba3D(Elem=flatten([tie_element_2, arch_element_2]), LimitDistance_m=0.005)  # -> Model, Info, Mass_kg, CenterOfGravity
assemble_2 = AssembleModelKaramba3D(Elem=flatten(hanger_elements_2), LimitDistance_m=0.005)  # -> Model, Info, Mass_kg, CenterOfGravity
panel_52 = Panel(assemble_2.Mass_kg)
panel_53 = Panel(assemble.Mass_kg)
addition = Addition(A=panel_53, B=panel_52)
ckeck = Panel(addition)
multiplication_7 = Multiplication(A=cost_structural_steel_chf_kg, B=panel_53)
multiplication_8 = Multiplication(A=cost_hangers_chf_kg, B=panel_52)
cost_structural_steel_chf = Panel(multiplication_7)
cost_hanger_chf = Panel(multiplication_8)
addition_2 = Addition(A=cost_structural_steel_chf, B=cost_hanger_chf)
total_cost_of_modeled_elements_chf = Panel(addition_2)
rise_to_span_ratio_2 = Number(rise_to_span_ratio)
rise_to_span_ratio_3 = Number(rise_to_span_ratio)
rise_to_span_ratio_4 = Number(rise_to_span_ratio)
material_cost_chf = Number(total_cost_of_modeled_elements_chf)
python_3 = GhPythonScript(ratio=rise_to_span_ratio_2, t=num_6, p1=num_3, p2=num_5)  # -> out, P
# ---------- python_3: Python ----------
__author__ = "Sophia"
__version__ = "2021.06.25"

import rhinoscriptsyntax as rs


if ratio < t:
    m=p1/t
    P=m*ratio
    
else:
    P=p2
# ---------- end python_3 ----------
python_4 = GhPythonScript(ratio=rise_to_span_ratio_3, t=num_7, p1=num_4, p2=num_2)  # -> out, P; same code as python_3
division_8 = Division(A=material_cost_chf, B="1000")
python_5 = GhPythonScript(ratio=rise_to_span_ratio_4, t=num_10, p1=num_8, p2=num_9)  # -> out, P; same code as python_3
material_cost_chf_2 = Number(material_cost_chf)
aesthetic_penalty_score_1 = Number(python_3.P)
aesthetic_penalty_score_2 = Number(python_4.P)
aesthetic_penalty_score_2_2 = Number(python_5.P)
material_cost_thausand_chf = Number(division_8)

# ---- group: LOADS
# Load Cases
# 0: Dead Weight
# 1: Asymetrical Traffic Load
# 2: Dead Weight and Asymetrical Traffic Load
# Other units weights need to be defined here.
load_case_nr = Panel("2")
load_case_nr_2 = Panel("0")
load_case_nr_3 = Panel("1")
panel_54 = Panel(panel_47)

# SIA 261 Chapter 10: The traffic loads considered are caluclated acc. to SIA 261, Chapter 10.
# Here only the uniform distributed load is considered. The point traffic loads are not considered.
# Here the loads are a little over the middle...not conservative? but maybe not so bad
# (but for certain hanger arrangements maybe)
bridge_width_m = Panel(width)
panel_55 = Panel("Traffic (Live) Load")
sia_261_q_rk_remaining_lains_and_other_k = Panel("2.5")  # "SIA 261: q_rk (remaining lains and other) (kN/m2)"
sia_261_q_ik_1_lane_kn_m2 = Panel("9")
sia_261_alpha_qr = Panel("0.9")
sia_261_alpha_qi = Panel("0.9")
lanewidth_m = Panel("3")
yq = Panel("-1.5")
eval_6 = Evaluate(
    F="(a_qr*q_rk*w/2)+((a_qi*q_ik)-(a_qr*q_rk))*lane_w*(((w-lane_w/2)/w)+(((w/2)-lane_w/2)/w))",
    w=bridge_width_m,
    lane_w=lanewidth_m,
    a_qi=sia_261_alpha_qi,
    a_qr=sia_261_alpha_qr,
    q_ik=sia_261_q_ik_1_lane_kn_m2,
    q_rk=sia_261_q_rk_remaining_lains_and_other_k)
traffic_load_on_one_tie_kn_m = Panel(eval_6)
multiplication_9 = Multiplication(A=yq, B=traffic_load_on_one_tie_kn_m)
design_traffic_load_on_one_tie_kn_m = Panel(multiplication_9)
Z = UnitZ(Factor=design_traffic_load_on_one_tie_kn_m)
loads = LoadsKaramba3D(Vector=Z, BeamIdentifiers=panel_54, LCase=load_case_nr_3, mode="Uniform Line", menu=[buttons(on, off, off)])

# dead load of modeled structure
yg = Panel("-1.5")
Z_2 = UnitZ(Factor=yg)
loads_2 = LoadsKaramba3D(Vector=Z_2, LCase=load_case_nr_2, mode="Gravity")

assumed_unit_weight_steel_deck_kn_m3 = Panel("0")
assumed_unit_weight_composite_deck_kn_m3 = Panel("6")
assumed_unit_weight_reinforced_concrete = Panel("0")  # "Assumed Unit Weight Reinforced Concrete Deck ( kN/m3)"
assumed_unit_weight_prestressed_concrete = Panel("0")  # "Assumed Unit Weight Prestressed Concrete Deck ( kN/m3)"
chosen_materiasls_2 = Number(chosen_materiasls)
item_12 = ListItem(List=chosen_materiasls_2, Index=2, Wrap=True)
num_12 = Number([assumed_unit_weight_steel_deck_kn_m3, assumed_unit_weight_reinforced_concrete, assumed_unit_weight_prestressed_concrete, assumed_unit_weight_composite_deck_kn_m3])
panel_56 = Panel("Non_modles dead load")
item_13 = ListItem(List=num_12, Index=item_12, Wrap=True)
deck_unit_weight_kn_m3 = Panel(item_13)
tie_cross_section_hight = Panel(tie_and_arch_cs_depth_m_4)
bridge_width_m_2 = Panel(width)
eval_7 = Evaluate(F="y*w*h/2", y=deck_unit_weight_kn_m3, w=bridge_width_m_2, h=tie_cross_section_hight)
deck_line_load_kn_m = Panel(eval_7)
multiplication_10 = Multiplication(A=yg, B=deck_line_load_kn_m)
panel_57 = Panel([panel_47, panel_48])
Z_3 = UnitZ(Factor=multiplication_10)
loads_3 = LoadsKaramba3D(Vector=Z_3, BeamIdentifiers=panel_57, LCase=load_case_nr_2, mode="Uniform Line", menu=[buttons(on, off, off)])

loads_4 = LoadsKaramba3D(Vector=Z_2, LCase=load_case_nr, mode="Gravity")
loads_5 = LoadsKaramba3D(Vector=Z_3, BeamIdentifiers=panel_57, LCase=load_case_nr, mode="Uniform Line", menu=[buttons(on, off, off)])
loads_6 = LoadsKaramba3D(Vector=Z, BeamIdentifiers=panel_54, LCase=load_case_nr, mode="Uniform Line", menu=[buttons(on, off, off)])

load = LoadKaramba3D(flatten([loads_2, loads, loads_3, loads_4, loads_5, loads_6]))

# ---- group: Assemble and Analyse
# This Component removes Hanger elements if they are under Compression (Toggle has for that be on False) so only the hangers that carry tension are kept. This way it is ensured that the Hangers are only loaded in tension, as they are not capable to tranfer compression.
assemble_3 = AssembleModelKaramba3D(Elem=element, Support=support_3, Load=load, LimitDistance_m=0.005)  # -> Model, Info, Mass_kg, CenterOfGravity
mass = Panel(assemble_3.Mass_kg)
center_of_gravity = Panel(assemble_3.Info)
analyze = AnalyzeKaramba3D(Model=assemble_3.Model)  # -> CalculatedModel, MaximumDisplacement_cm, ResultingForceOfGravity_kN, ElasticEnergy_kNm
# So we want to look at the mostly critical load case: Gravity loading and Traffic loading over half of the span.
# 
# We want to neglect the moments following the gravity loads in the Beam and Tie. (As we assume that the prestressing of tha hangers will reduce these substentially with an good prestressing scheeme)
# 
# Problem: when we use the only compression eliminator element, then the element is fully removed from static calculation.
# 
# Does it make sense to calculate them sepearatly and then add the normal forces and moments only from live load? or is it then wrong due to the cable elimination somehow?
number_slider_4 = Slider(100, range=0..100)
panel_58 = Panel(panel_49)
load_case_nr_4 = Panel(load_case_nr_3)
tencomelim = TensionCompressionEliminatorKaramba3D(
    Model=analyze.CalculatedModel,
    MaximumIerations=number_slider_4,
    BeamIdentifiers=panel_58,
    LoadCaseToConsider=load_case_nr_4,
    CompressionElementsOnly=Toggle(False))  # -> MaximumDisplacement, OptimizedModel, ElementIsActive

# ---- group: Artificial Mesh Creation (only visualisation purpose! -thicker Hangers)
cross_section_3 = CrossSectionKaramba3D(
    FamilyNameOfCrossSection="DefaultCroSec",
    NameOfCrossSection=panel_28,
    Material=matselect_5,
    Diameter_cm="50",
    WallThickness_cm=thickness_cm,
    mode="Circular Hollow")
enlarged_cross_section = CrossSectionKaramba3D(cross_section_3)
hangers_cross_section_2 = CrossSectionKaramba3D(crosecselect.CrossSection)
hangers_6 = Curve(hangers_4)
linetobeam_5 = LineToBeamKaramba3D(
    Line=hangers_6,
    Identifier="Hangers",
    CrossSection=enlarged_cross_section,
    New=True,
    Remove=True,
    LimitDistance_m=0.005,
    Bending=toggle)  # -> Element, Points, Info
hanger_elements_3 = ElementKaramba3D(linetobeam_5.Element)
element_2 = ElementKaramba3D(flatten([tie_element, arch_element, hanger_elements_3]))
assemble_4 = AssembleModelKaramba3D(Elem=element_2, Support=support_3, Load=load, LimitDistance_m=0.005)  # -> Model, Info, Mass_kg, CenterOfGravity
analyze_2 = AnalyzeKaramba3D(Model=assemble_4.Model)  # -> CalculatedModel, MaximumDisplacement_cm, ResultingForceOfGravity_kN, ElasticEnergy_kNm
modelview = ModelViewKaramba3D(Model=analyze_2.CalculatedModel, ResultFactors=1, ResultCase=-1)  # -> Model, DeformedMesh, DeformedAxes, DeformedModel
beamview = BeamViewKaramba3D(Model=modelview.Model)  # -> Model, MeshesOfRenderedBeams, DeformedBeamAxes, LegendColors, LegendTags
mesh = Mesh(beamview.MeshesOfRenderedBeams)

# ---- group: Artificial Mesh Creation (only visualisation purpose!- Round Arch Pieces)
tie_and_arch_cross_section_2 = CrossSectionKaramba3D(tie_and_arch_cross_section)
arch_pieces_round_small_2 = Line(arch_pieces_round_small)
linetobeam_6 = LineToBeamKaramba3D(
    Line=arch_pieces_round_small_2,
    Identifier="Arch",
    CrossSection=tie_and_arch_cross_section_2,
    New=True,
    Remove=True,
    LimitDistance_m=0.005,
    Bending=toggle)  # -> Element, Points, Info
hanger_elements_4 = ElementKaramba3D(linetobeam_6.Element)
element_3 = ElementKaramba3D(flatten([tie_element, hanger_elements, linetobeam_6.Element]))  # disabled
element_4 = ElementKaramba3D(flatten([tie_element, arch_element, hanger_elements_4, hanger_elements]))
element_5 = ElementKaramba3D(flatten([tie_element, hanger_elements, hanger_elements_4]))
assemble_5 = AssembleModelKaramba3D(Elem=element_5, Support=support_3, Load=load, LimitDistance_m=0.005)  # -> Model, Info, Mass_kg, CenterOfGravity
analyze_3 = AnalyzeKaramba3D(Model=assemble_5.Model)  # -> CalculatedModel, MaximumDisplacement_cm, ResultingForceOfGravity_kN, ElasticEnergy_kNm
modelview_2 = ModelViewKaramba3D(Model=analyze_3.CalculatedModel, ResultFactors=1, ResultCase=-1)  # -> Model, DeformedMesh, DeformedAxes, DeformedModel
beamview_2 = BeamViewKaramba3D(Model=modelview_2.Model)  # -> Model, MeshesOfRenderedBeams, DeformedBeamAxes, LegendColors, LegendTags
mesh_2 = Mesh(beamview_2.MeshesOfRenderedBeams)

# ---- group: ModelViewer
modelview_3 = ModelViewKaramba3D(Model=analyze.CalculatedModel, ResultFactors=1, ResultCase=-1)  # -> Model, DeformedMesh, DeformedAxes, DeformedModel
modelview_4 = ModelViewKaramba3D(Model=analyze.CalculatedModel, ResultFactors=1, ResultCase=-1)  # -> Model, DeformedMesh, DeformedAxes, DeformedModel
beamview_3 = BeamViewKaramba3D(Model=modelview_3.Model)  # -> Model, MeshesOfRenderedBeams, DeformedBeamAxes, LegendColors, LegendTags
beamview_4 = BeamViewKaramba3D(Model=modelview_4.Model)  # -> Model, MeshesOfRenderedBeams, DeformedBeamAxes, LegendColors, LegendTags
legend = Legend(Colour=beamview_3.LegendColors, Tags=beamview_3.LegendTags, LegendType=101)

# ---- group: DisplacementCalc
load_case_nr_5 = Panel("2")
nodedisp = NodalDisplacementsKaramba3D(AnalyzedModel=beamview_3.Model, ResultCase=load_case_nr_5)  # -> AnalyzedModel, NodalTranslations_m, NodalRotations_rad
translational_displacaments_m = Panel(nodedisp.NodalTranslations_m)
devec = DeconstructVector(Vector=nodedisp.NodalTranslations_m)  # -> XComponent, YComponent, ZComponent
sort = SortList(Keys=devec.XComponent, ValuesA=devec.XComponent)  # -> Keys, ValuesA
sort_2 = SortList(Keys=devec.ZComponent)  # -> Keys, ValuesA
item_14 = ListItem(List=sort.Keys, Index=-1, Wrap=True)
item_15 = ListItem(List=sort.Keys, Index=0, Wrap=True)
item_16 = ListItem(List=sort_2.Keys, Index=-1, Wrap=True)
item_17 = ListItem(List=sort_2.Keys, Index=0, Wrap=True)
min_displacement_in_x_direction = Panel(item_15)
min_displacement_in_z_direction = Panel(item_17)
max_displacement_in_x_direction = Panel(item_14)
max_displacement_in_z_direction = Panel(item_16)

# ----
translational_displacaments_m_2 = Panel(translational_displacaments_m)
mass_2 = Panel(assemble_3.Mass_kg)
abs = Absolute(Value=translational_displacaments_m_2)
ma = MassAddition(Input=abs)  # -> Result, PartialResults
weight_of_modeled_structural_elements = Number(mass_2)
panel_59 = Panel(ma.Result)
devec_2 = DeconstructVector(Vector=ma.Result)  # -> XComponent, YComponent, ZComponent
addition_3 = Addition(A=devec_2.XComponent, B=devec_2.YComponent, C=devec_2.ZComponent)
cumulative_displacement = Number(addition_3)
cumulative_displacement_m = Panel(cumulative_displacement)
weight_of_modeled_structural_elements_2 = Number(weight_of_modeled_structural_elements)
weight_of_modeled_structural_elements_3 = Number(weight_of_modeled_structural_elements)
mesh_3 = Mesh(flatten(mesh))
mesh_4 = Mesh(flatten(beamview_3.MeshesOfRenderedBeams))

# ---- group: Utilization (considering simplified 2nd order effects)
arch_pieces_5 = Line(arch_pieces_3)
len_2 = Length(Curve=arch_pieces_5)
sort_3 = SortList(Keys=len_2)  # -> Keys, ValuesA
item_18 = ListItem(List=sort_3.Keys, Index=-1, Wrap=True)
panel_60 = Panel("Arch-Utilization")
maxhangerspacing_on_arch = Number(item_18)
fy_box_cs_kn_cm2_2 = Number(fy_box_cs_kn_cm2)
e_box_cs_kn_cm2_2 = Number(e_box_cs_kn_cm2)
box_a_cm2_2 = Number(box_a_cm2)
box_i_cm4_2 = Number(box_i_cm4)
box_wel_cm3_2 = Number(box_wel_cm3)
multiplication_11 = Multiplication(A=fy_box_cs_kn_cm2_2, B="10000")
multiplication_12 = Multiplication(A=e_box_cs_kn_cm2_2, B="10000")
division_9 = Division(A=box_a_cm2_2, B="10000")
division_10 = Division(A=box_i_cm4_2, B="100000000")
division_11 = Division(A=box_wel_cm3_2, B="1000000")
max_l = Panel(maxhangerspacing_on_arch)
maxhangerspacing_on_arch_2 = Number(maxhangerspacing_on_arch)
beta = Panel("1.25")
fy_box_cs_kn_m2 = Number(multiplication_11)
e_box_cs_kn_m2 = Number(multiplication_12)
box_a_m2 = Number(division_9)
box_i_m4 = Number(division_10)
box_wel_m3 = Number(division_11)
multiplication_13 = Multiplication(A=len_2, B=beta)  # -> flatten(Result)
buckling_legth_m = Panel(multiplication_13)
eval_8 = Evaluate(F="(π*E*I)/(Lk)²", E=e_box_cs_kn_m2, I=box_i_m4, Lk=multiplication_13)
pcr = Number(eval_8)

panel_61 = Panel("Tie-Utilization")

ym1_sia_263_4_1_3_2013 = Panel("1.05")
ym1 = Number(ym1_sia_263_4_1_3_2013)

panel_62 = Panel("Hanger Utilization ")
fy_hanger_kn_cm2_2 = Number(fy_hanger_kn_cm2)
rope_a_cm2_2 = Number(rope_a_cm2)
multiplication_14 = Multiplication(A=fy_hanger_kn_cm2_2, B="10000")
division_12 = Division(A=rope_a_cm2_2, B="10000")
fy_hangercs_kn_m2 = Number(multiplication_14)
box_a_m2_2 = Number(division_12)
python_6 = GhPythonScript(fy=fy_hangercs_kn_m2, A=box_a_m2_2, ym1=ym1)  # -> out, Nrd
# ---------- python_6: Python ----------
__author__ = "Sophia"
__version__ = "2021.06.16"

import rhinoscriptsyntax as rs
import math as m


#a=A*fy
#b=P
#minimum=min(A*fy,Pcr)

Nrd=(A*fy)/ym1
# ---------- end python_6 ----------

# ---- group: ForcesCalc
# The Forces are calculated seperatedly for the defined load cases.
# 
# Definition of List levels:
# {0;Loadcase;Element}
# Bending Moments - My (kNm)
# Superposition of Load Cases
# Here the desired response combination is manually created. Here the Normal forces for both the Dead Load and the uniform traffic load are superimposed. For the Moments howver, only the Moments resulting from the life load (traffic) are here considered. This is / can be done as we assume that a preliminary prestressing of the hangers is reducing the moments in both the arch and the tie (so small that they can be neglected in comparison to the moments due to the life load).
# Bending Moments - My (kNm)
# Check: OK
# There are no moments in the hangers. Therefore, the definition as truss elements is done correctly.
# Check: OK
# Here all the normal forces in the Hangers are positive. As it is not possible of the Hangers to support compression forces. This is appropiate.
# This is not possible as the hangers are often built of wire ropes and therfore cannot support any compression forces, only tension.
# !!!!! Here Hanger 14 has in the combined load case a negative Normal force!!!!! This is not possible as the hangers are often built of wire ropes and therfore cannot support any compression forces, only tension.
# Check: OK
# There are no moments in the hangers. Therefore, the definition as truss elements is done correctly.
number_slider_5 = Slider(1, range=0..100)
list_of_elements_2 = Panel(list_of_elements)
load_case_nr_6 = Panel("1")
load_case_nr_7 = Panel("0")
load_case_nr_8 = Panel("2")
item_19 = ListItem(List=list_of_elements_2, Index=0, Wrap=True)
item_20 = ListItem(List=list_of_elements_2, Index=1, Wrap=True)
item_21 = ListItem(List=list_of_elements_2, Index=2, Wrap=True)
item_22 = ListItem(List=list_of_elements_2, Index=3, Wrap=True)
item_23 = ListItem(List=list_of_elements_2, Index=0, Wrap=True)
item_24 = ListItem(List=list_of_elements_2, Index=1, Wrap=True)
item_25 = ListItem(List=list_of_elements_2, Index=2, Wrap=True)
item_26 = ListItem(List=list_of_elements_2, Index=3, Wrap=True)
item_27 = ListItem(List=list_of_elements_2, Index=0, Wrap=True)
item_28 = ListItem(List=list_of_elements_2, Index=1, Wrap=True)
item_29 = ListItem(List=list_of_elements_2, Index=2, Wrap=True)
panel_63 = Panel(item_19)
item_30 = ListItem(List=list_of_elements_2, Index=3, Wrap=True)
panel_64 = Panel(item_20)
panel_65 = Panel(item_21)
panel_66 = Panel(item_22)
panel_67 = Panel(item_23)
panel_68 = Panel(item_24)
panel_69 = Panel(item_25)
panel_70 = Panel(item_26)
panel_71 = Panel(item_27)
panel_72 = Panel(item_28)
panel_73 = Panel(item_29)
panel_74 = Panel(item_30)
b_forces = BeamForcesKaramba3D(
    AnalyzedModel=beamview_3.Model,
    BeamIdentifiers=panel_63,
    LCase=load_case_nr_7,
    MaximumDistanceBetweenResults_m=-1,
    NumberOfResultsPerBeamElement=number_slider_5)  # -> AnalyzedModel, NormalForce_kN, ShearForceVz_kN, ShearForceVy_kN, BendingMomentMt_kNm, BendingMomentMy_kNm, BendingMomentMz_kNm
b_forces_2 = BeamForcesKaramba3D(
    AnalyzedModel=beamview_3.Model,
    BeamIdentifiers=panel_64,
    LCase=load_case_nr_7,
    MaximumDistanceBetweenResults_m=-1,
    NumberOfResultsPerBeamElement=number_slider_5)  # -> AnalyzedModel, NormalForce_kN, ShearForceVz_kN, ShearForceVy_kN, BendingMomentMt_kNm, BendingMomentMy_kNm, BendingMomentMz_kNm
b_forces_3 = BeamForcesKaramba3D(
    AnalyzedModel=beamview_3.Model,
    BeamIdentifiers=panel_65,
    LCase=load_case_nr_7,
    MaximumDistanceBetweenResults_m=-1,
    NumberOfResultsPerBeamElement=number_slider_5)  # -> AnalyzedModel, NormalForce_kN, ShearForceVz_kN, ShearForceVy_kN, BendingMomentMt_kNm, BendingMomentMy_kNm, BendingMomentMz_kNm
b_forces_4 = BeamForcesKaramba3D(
    AnalyzedModel=beamview_3.Model,
    BeamIdentifiers=panel_66,
    LCase=load_case_nr_7,
    MaximumDistanceBetweenResults_m=-1,
    NumberOfResultsPerBeamElement=number_slider_5)  # -> AnalyzedModel, NormalForce_kN, ShearForceVz_kN, ShearForceVy_kN, BendingMomentMt_kNm, BendingMomentMy_kNm, BendingMomentMz_kNm
b_forces_5 = BeamForcesKaramba3D(
    AnalyzedModel=beamview_3.Model,
    BeamIdentifiers=panel_67,
    LCase=load_case_nr_6,
    MaximumDistanceBetweenResults_m=-1,
    NumberOfResultsPerBeamElement=number_slider_5)  # -> AnalyzedModel, NormalForce_kN, ShearForceVz_kN, ShearForceVy_kN, BendingMomentMt_kNm, BendingMomentMy_kNm, BendingMomentMz_kNm
b_forces_6 = BeamForcesKaramba3D(
    AnalyzedModel=beamview_3.Model,
    BeamIdentifiers=panel_68,
    LCase=load_case_nr_6,
    MaximumDistanceBetweenResults_m=-1,
    NumberOfResultsPerBeamElement=number_slider_5)  # -> AnalyzedModel, NormalForce_kN, ShearForceVz_kN, ShearForceVy_kN, BendingMomentMt_kNm, BendingMomentMy_kNm, BendingMomentMz_kNm
b_forces_7 = BeamForcesKaramba3D(
    AnalyzedModel=beamview_3.Model,
    BeamIdentifiers=panel_69,
    LCase=load_case_nr_6,
    MaximumDistanceBetweenResults_m=-1,
    NumberOfResultsPerBeamElement=number_slider_5)  # -> AnalyzedModel, NormalForce_kN, ShearForceVz_kN, ShearForceVy_kN, BendingMomentMt_kNm, BendingMomentMy_kNm, BendingMomentMz_kNm
b_forces_8 = BeamForcesKaramba3D(
    AnalyzedModel=beamview_3.Model,
    BeamIdentifiers=panel_70,
    LCase=load_case_nr_6,
    MaximumDistanceBetweenResults_m=-1,
    NumberOfResultsPerBeamElement=number_slider_5)  # -> AnalyzedModel, NormalForce_kN, ShearForceVz_kN, ShearForceVy_kN, BendingMomentMt_kNm, BendingMomentMy_kNm, BendingMomentMz_kNm
b_forces_9 = BeamForcesKaramba3D(
    AnalyzedModel=beamview_3.Model,
    BeamIdentifiers=panel_71,
    LCase=load_case_nr_8,
    MaximumDistanceBetweenResults_m=-1,
    NumberOfResultsPerBeamElement=number_slider_5)  # -> AnalyzedModel, NormalForce_kN, ShearForceVz_kN, ShearForceVy_kN, BendingMomentMt_kNm, BendingMomentMy_kNm, BendingMomentMz_kNm
b_forces_10 = BeamForcesKaramba3D(
    AnalyzedModel=beamview_3.Model,
    BeamIdentifiers=panel_72,
    LCase=load_case_nr_8,
    MaximumDistanceBetweenResults_m=-1,
    NumberOfResultsPerBeamElement=number_slider_5)  # -> AnalyzedModel, NormalForce_kN, ShearForceVz_kN, ShearForceVy_kN, BendingMomentMt_kNm, BendingMomentMy_kNm, BendingMomentMz_kNm
b_forces_11 = BeamForcesKaramba3D(
    AnalyzedModel=beamview_3.Model,
    BeamIdentifiers=panel_73,
    LCase=load_case_nr_8,
    MaximumDistanceBetweenResults_m=-1,
    NumberOfResultsPerBeamElement=number_slider_5)  # -> AnalyzedModel, NormalForce_kN, ShearForceVz_kN, ShearForceVy_kN, BendingMomentMt_kNm, BendingMomentMy_kNm, BendingMomentMz_kNm
b_forces_12 = BeamForcesKaramba3D(
    AnalyzedModel=beamview_3.Model,
    BeamIdentifiers=panel_74,
    LCase=load_case_nr_8,
    MaximumDistanceBetweenResults_m=-1,
    NumberOfResultsPerBeamElement=number_slider_5)  # -> AnalyzedModel, NormalForce_kN, ShearForceVz_kN, ShearForceVy_kN, BendingMomentMt_kNm, BendingMomentMy_kNm, BendingMomentMz_kNm
panel_75 = Panel(b_forces_2.NormalForce_kN)
panel_76 = Panel(b_forces.NormalForce_kN)
panel_77 = Panel(b_forces_3.NormalForce_kN)
panel_78 = Panel(b_forces_4.NormalForce_kN)
panel_79 = Panel(b_forces_6.NormalForce_kN)
panel_80 = Panel(b_forces_5.NormalForce_kN)
panel_81 = Panel(b_forces_7.NormalForce_kN)
panel_82 = Panel(b_forces_8.NormalForce_kN)
panel_83 = Panel(b_forces_10.NormalForce_kN)
panel_84 = Panel(b_forces_9.NormalForce_kN)
panel_85 = Panel("Normal Forces - N (kN)")
panel_86 = Panel(b_forces_11.NormalForce_kN)
panel_87 = Panel(b_forces_12.NormalForce_kN)
panel_88 = Panel("Normal Forces - N")
panel_90 = Panel(b_forces_2.BendingMomentMy_kNm)
panel_91 = Panel(b_forces_4.BendingMomentMy_kNm)
panel_92 = Panel(b_forces.BendingMomentMy_kNm)
panel_93 = Panel(b_forces_3.BendingMomentMy_kNm)
panel_94 = Panel(b_forces_6.BendingMomentMy_kNm)
panel_95 = Panel(b_forces_8.BendingMomentMy_kNm)
panel_96 = Panel(b_forces_5.BendingMomentMy_kNm)
panel_97 = Panel(b_forces_7.BendingMomentMy_kNm)
panel_98 = Panel(b_forces_10.BendingMomentMy_kNm)
panel_99 = Panel(b_forces_12.BendingMomentMy_kNm)
panel_100 = Panel(b_forces_9.BendingMomentMy_kNm)
panel_101 = Panel(b_forces_11.BendingMomentMy_kNm)
panel_102 = Panel("Bending Moments - My")
panel_104 = Panel(panel_63)
panel_105 = Panel(panel_64)
panel_106 = Panel(panel_65)
panel_107 = Panel(panel_66)
addition_4 = Addition(A=panel_76, B=panel_80)
addition_5 = Addition(A=panel_75, B=panel_79)
addition_6 = Addition(A=panel_77, B=panel_81)
addition_7 = Addition(A=panel_78, B=panel_82)
panel_108 = Panel(addition_4)
panel_109 = Panel(addition_5)
panel_110 = Panel(addition_6)
panel_111 = Panel(addition_7)
panel_113 = Panel(b_forces_6.BendingMomentMy_kNm)
panel_115 = Panel(b_forces_5.BendingMomentMy_kNm)
panel_116 = Panel(b_forces_7.BendingMomentMy_kNm)
sort_4 = SortList(Keys=flatten([panel_115, panel_113]))  # -> Keys, ValuesA
sort_5 = SortList(Keys=flatten([panel_115, panel_113]))  # -> Keys, ValuesA
sort_6 = SortList(Keys=flatten(panel_116))  # -> Keys, ValuesA
sort_7 = SortList(Keys=flatten(panel_116))  # -> Keys, ValuesA
item_31 = ListItem(List=sort_4.Keys, Index=0, Wrap=True)
item_32 = ListItem(List=sort_5.Keys, Index=-1, Wrap=True)
item_33 = ListItem(List=sort_6.Keys, Index=0, Wrap=True)
item_34 = ListItem(List=sort_7.Keys, Index=-1, Wrap=True)
max_moment_knm = Panel(item_31)
max_moment_knm_2 = Panel(item_32)
max_moment_knm_3 = Panel(item_33)
max_moment_knm_4 = Panel(item_34)
abs_2 = Absolute(Value=max_moment_knm)
abs_3 = Absolute(Value=max_moment_knm_2)
abs_4 = Absolute(Value=max_moment_knm_3)
abs_5 = Absolute(Value=max_moment_knm_4)
merge_6 = Merge(Data1=abs_3, Data2=abs_2)
merge_7 = Merge(Data1=abs_5, Data2=abs_4)
sort_8 = SortList(Keys=flatten(merge_6))  # -> Keys, ValuesA
sort_9 = SortList(Keys=flatten(merge_7))  # -> Keys, ValuesA
item_35 = ListItem(List=sort_8.Keys, Index=-1, Wrap=True)
item_36 = ListItem(List=sort_9.Keys, Index=-1, Wrap=True)
max_moment_in_tie_knm = Number(item_35)
max_moment_in_arch_knm = Number(item_36)
max_moment_knm_5 = Panel(max_moment_in_tie_knm)
max_moment_knm_6 = Panel(max_moment_in_arch_knm)

# ----
division_13 = Division(A=panel_76, B=panel_80)
# Calculate Present Dead Load to Live Load Ratio
# 
# (from ratio of Tie Normal Force under eather)
panel_117 = Panel(division_13)
max_moment_in_arch_knm_2 = Number(max_moment_in_arch_knm)

# ---- group: Utilization (considering simplified 2nd order effects) (continued)
normal_foces_in_hanger_kn = Number(panel_111)
abs_6 = Absolute(Value=normal_foces_in_hanger_kn)
item_37 = ListItem(List=abs_6, Index=0, Wrap=True)
item_38 = ListItem(List=abs_6, Index=-1, Wrap=True)
num_13 = Number(flatten(item_38))
num_14 = Number(flatten(item_37))
python_7 = GhPythonScript(a=num_14, b=num_13)  # -> out, max
# ---------- python_7: Python ----------
__author__ = "Sophia"
__version__ = "2021.06.16"

import rhinoscriptsyntax as rs


if a>b:
    max=a
else:
    max=b
# ---------- end python_7 ----------
single_normal_forces_in_hangers_kn = Number(flatten(python_7.max))
eval_9 = Evaluate(F="(Ned/Nrd)", Ned=single_normal_forces_in_hangers_kn, Nrd=python_6.Nrd)
panel_118 = Panel(eval_9)

normal_foces_in_arch_kn = Number(panel_110)
moments_in_arch_knm = Number(panel_116)
abs_7 = Absolute(Value=normal_foces_in_arch_kn)
abs_8 = Absolute(Value=moments_in_arch_knm)
item_39 = ListItem(List=abs_7, Index=0, Wrap=True)
item_40 = ListItem(List=abs_8, Index=-1, Wrap=True)
item_41 = ListItem(List=abs_8, Index=0, Wrap=True)
single_normal_foces_in_arch_kn = Number(flatten(item_39))
num_15 = Number(flatten(item_40))
num_16 = Number(flatten(item_41))
python_8 = GhPythonScript(a=num_16, b=num_15)  # -> out, max; same code as python_7
single_moments_in_arch_kn = Number(flatten(python_8.max))
python_9 = GhPythonScript(fy=fy_box_cs_kn_m2, A=box_a_m2, Pcr=pcr, ym1=ym1)  # -> out, flatten(Nkrd)
# ---------- python_9: Python ----------
__author__ = "Sophia"
__version__ = "2021.06.16"

import rhinoscriptsyntax as rs
import math as m


#a=A*fy
#b=P
#minimum=min(A*fy,Pcr)

Nkrd=(min(A*fy,Pcr))/ym1
# ---------- end python_9 ----------
python_10 = GhPythonScript(fy=fy_box_cs_kn_m2, A=box_a_m2, ym1=ym1)  # -> out, Nrd; same code as python_6
eval_10 = Evaluate(F="(fy*Wel)/ym1", fy=fy_box_cs_kn_m2, Wel=box_wel_m3, ym1=ym1)
eval_11 = Evaluate(
    F="(Ned/Nkrd)+(1/(1-(Ned/Pcr)))*(Med/Mrd)",
    Ned=single_normal_foces_in_arch_kn,
    Nkrd=python_9.Nkrd,
    Pcr=eval_8,
    Med=single_moments_in_arch_kn,
    Mrd=eval_10)
eval_12 = Evaluate(
    F="(Ned/Nrd)+(Med/Mrd)",
    Ned=single_normal_foces_in_arch_kn,
    Nrd=python_10.Nrd,
    Med=single_moments_in_arch_kn,
    Mrd=eval_10)
panel_119 = Panel(eval_12)
panel_120 = Panel(eval_11)
sort_10 = SortList(Keys=panel_120)  # -> Keys, ValuesA
item_42 = ListItem(List=sort_10.Keys, Index=-1, Wrap=True)
item_43 = ListItem(List=sort_10.Keys, Index=0, Wrap=True)
minutilization = Number(item_43)
maxutilization = Number(item_42)
max_value = Panel(maxutilization)
min_value = Panel(minutilization)

# ---- group: UtilizationCalc
panel_121 = Panel(panel_63)
panel_122 = Panel(panel_64)
panel_123 = Panel(panel_65)
panel_124 = Panel(panel_66)
panel_125 = Panel([panel_121, panel_122])
load_case_nr_9 = Panel("2")
load_case_nr_10 = Panel("2")
load_case_nr_11 = Panel("2")
utilization = UtilizationOfElementsKaramba3D(
    AnalyzedModel=beamview_3.Model,
    ElemIdentifiers=panel_125,
    ResultCase=load_case_nr_9,
    NumberOfSamplePoints=3,
    ElasticDesign=True,
    GammaM0=1,
    GammaM1=1,
    WithDetails=False,
    mode="Beams")  # -> AnalyzedModel, Utilization, SigMax_kN_cm2, SigMin_kN_cm2, TauMax_kN_cm2, UtilN, UtilVy, UtilVz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
utilization_2 = UtilizationOfElementsKaramba3D(
    AnalyzedModel=beamview_3.Model,
    ElemIdentifiers=panel_123,
    ResultCase=load_case_nr_10,
    NumberOfSamplePoints=3,
    ElasticDesign=True,
    GammaM0=1,
    GammaM1=1,
    WithDetails=False,
    mode="Beams")  # -> AnalyzedModel, Utilization, SigMax_kN_cm2, SigMin_kN_cm2, TauMax_kN_cm2, UtilN, UtilVy, UtilVz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
load_case_nr_12 = Panel("1")
utilization_3 = UtilizationOfElementsKaramba3D(
    AnalyzedModel=beamview_3.Model,
    ElemIdentifiers=panel_124,
    ResultCase=load_case_nr_11,
    NumberOfSamplePoints=3,
    ElasticDesign=True,
    GammaM0=1,
    GammaM1=1,
    WithDetails=False,
    mode="Beams")  # -> AnalyzedModel, Utilization, SigMax_kN_cm2, SigMin_kN_cm2, TauMax_kN_cm2, UtilN, UtilVy, UtilVz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
load_case_nr_13 = Panel("1")
panel_126 = Panel(utilization.UtilN)
utilization_4 = UtilizationOfElementsKaramba3D(
    AnalyzedModel=beamview_3.Model,
    ElemIdentifiers=panel_125,
    ResultCase=load_case_nr_13,
    NumberOfSamplePoints=3,
    ElasticDesign=True,
    GammaM0=1,
    GammaM1=1,
    WithDetails=False,
    mode="Beams")  # -> AnalyzedModel, Utilization, SigMax_kN_cm2, SigMin_kN_cm2, TauMax_kN_cm2, UtilN, UtilVy, UtilVz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
utilization_5 = UtilizationOfElementsKaramba3D(
    AnalyzedModel=beamview_3.Model,
    ElemIdentifiers=panel_123,
    ResultCase=load_case_nr_12,
    NumberOfSamplePoints=3,
    ElasticDesign=True,
    GammaM0=1,
    GammaM1=1,
    WithDetails=False,
    mode="Beams")  # -> AnalyzedModel, Utilization, SigMax_kN_cm2, SigMin_kN_cm2, TauMax_kN_cm2, UtilN, UtilVy, UtilVz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
panel_127 = Panel(utilization_2.UtilN)
panel_128 = Panel(utilization_4.UtilMy)
panel_129 = Panel(utilization_5.UtilMy)
addition_8 = Addition(A=panel_126, B=panel_128)
addition_9 = Addition(A=panel_127, B=panel_129)
panel_130 = Panel(addition_8)
panel_131 = Panel(addition_9)
panel_132 = Panel(utilization_3.Utilization)
sort_11 = SortList(Keys=[panel_132, panel_130, panel_131])  # -> Keys, ValuesA
panel_133 = Panel(sort_11.Keys)
item_44 = ListItem(List=sort_11.Keys, Index=-1, Wrap=True)
item_45 = ListItem(List=sort_11.Keys, Index=0, Wrap=True)
minutilization_2 = Number(item_45)
maxutilization_2 = Number(item_44)
max_value_2 = Panel(maxutilization_2)
min_value_2 = Panel(minutilization_2)

# ---- group: Check V-Utilization
v_utilisation = Panel([utilization.UtilVz, utilization_2.UtilVz])
# Ok if all False.
# Then Ved<0.5Vrd is fulfilled.
larger = LargerThan(FirstNumber=v_utilisation, SecondNumber="0.5")  # -> flatten(LargerThan), OrEqualTo
panel_134 = Panel(larger.LargerThan)

# ----
sort_12 = SortList(Keys=flatten([panel_108, panel_109]))  # -> Keys, ValuesA
item_46 = ListItem(List=panel_109, Index=0, Wrap=True)
sort_13 = SortList(Keys=flatten(panel_110))  # -> Keys, ValuesA
sort_14 = SortList(Keys=flatten(panel_111))  # -> Keys, ValuesA
sort_15 = SortList(Keys=flatten(panel_111))  # -> Keys, ValuesA
item_47 = ListItem(List=panel_110, Index=0, Wrap=True)
item_48 = ListItem(List=sort_12.Keys, Index=-1, Wrap=True)
item_49 = ListItem(List=sort_13.Keys, Index=0, Wrap=True)
item_50 = ListItem(List=sort_14.Keys, Index=-1, Wrap=True)
abs_9 = Absolute(Value=item_47)
num_17 = Number(flatten(abs_9))
item_51 = ListItem(List=sort_15.Keys, Index=0, Wrap=True)
abs_10 = Absolute(Value=item_49)
max_normal_foce_in_tie_kn = Number(item_48)

# ---- group: Utilization (considering simplified 2nd order effects) (continued)
normal_foces_in_tie_kn = Number(flatten([panel_108, panel_109]))
moments_in_tie_knm = Number(flatten([panel_115, panel_113]))
max_normal_foce_in_tie_kn_2 = Number(max_normal_foce_in_tie_kn)
max_moment_in_tie_knm_2 = Number(max_moment_in_tie_knm)
nrd = Number(python_10.Nrd)
mrd = Number(eval_10)
eval_13 = Evaluate(F="(Ned/Nrd)+(Med/Mrd)", Ned=normal_foces_in_tie_kn, Nrd=nrd, Med=moments_in_tie_knm, Mrd=mrd)
panel_135 = Panel(eval_13)
sort_16 = SortList(Keys=panel_135)  # -> Keys, ValuesA
item_52 = ListItem(List=sort_16.Keys, Index=-1, Wrap=True)
item_53 = ListItem(List=sort_16.Keys, Index=0, Wrap=True)
minutilization_3 = Number(item_53)
maxutilization_3 = Number(item_52)
max_value_3 = Panel(maxutilization_3)
min_value_3 = Panel(minutilization_3)

# ----
max_normal_foce_in_hanger_kn = Number(item_50)
panel_136 = Panel(num_17)
max_normal_force_in_arch_knn = Number(abs_10)
max_normal_force_in_arch_knn_2 = Number(max_normal_force_in_arch_knn)
min_normal_foce_in_hanger_kn = Number(item_51)
max_normal_force_kn = Panel(max_normal_foce_in_tie_kn)
max_normal_force_kn_2 = Panel(max_normal_foce_in_hanger_kn)
max_normal_force_kn_3 = Panel(max_normal_force_in_arch_knn)
max_normal_force_kn_4 = Panel(min_normal_foce_in_hanger_kn)

# ---- group: ForcesCalc (continued)
larger_2 = LargerThan(FirstNumber=max_normal_force_kn_4, SecondNumber="0")  # -> flatten(LargerThan), OrEqualTo
check_for_no_compression_in_hangers_true = Panel(larger_2.LargerThan)  # "Check for no Compression in Hangers -> True -> ok"

# ---- group: Utilization (considering simplified 2nd order effects) (continued)
# This altered definition of Utilization also captures 2nd order effects by including an approach similar to SIA 263 5.1.9 -> buckling
# 
# However local buckling is not considered here !!!
sort_17 = SortList(Keys=flatten([eval_9, panel_120, eval_13]))  # -> Keys, ValuesA
panel_137 = Panel(sort_17.Keys)
item_54 = ListItem(List=sort_17.Keys, Index=-1, Wrap=True)
item_55 = ListItem(List=sort_17.Keys, Index=0, Wrap=True)
minutilization_4 = Number(item_55)
maxutilization_4 = Number(item_54)
max_value_4 = Panel(maxutilization_4)
min_value_4 = Panel(minutilization_4)

# ----
item_56 = ListItem(List=panel_116, Index=1, Wrap=True)
abs_11 = Absolute(Value=item_56)
num_18 = Number(flatten(abs_11))
panel_138 = Panel(num_18)
utilizationlist = Number(sort_17.Keys)
panel_139 = Panel(utilizationlist)
python_11 = GhPythonScript(x=flatten(utilizationlist), y=penalty_value)  # -> out, a
# ---------- python_11: Python ----------
__author__ = "Sophia"
__version__ = "2021.06.08"

import rhinoscriptsyntax as rs

if 1-x >= 0:
    a=1
else:
    a=y
# ---------- end python_11 ----------
eval_14 = Evaluate(F="(1-u)²", u=utilizationlist)
# Objective Definition and including penealties an loss functions.
ma_2 = MassAddition(Input=panel_139)  # -> Result, PartialResults
lng_8 = ListLength(List=panel_139)
panel_140 = Panel(python_11.a)
division_14 = Division(A=ma_2.Result, B=lng_8)
multiplication_15 = Multiplication(A=eval_14, B=python_11.a)
ma_3 = MassAddition(Input=eval_14)  # -> Result, PartialResults
ma_4 = MassAddition(Input=multiplication_15)  # -> Result, PartialResults
panel_141 = Panel(multiplication_15)
weighted_summ_of_eucledian_distance_to_a = Panel(ma_4.Result)  # "Weighted Summ of Eucledian Distance to a Utilization of 1"
summ_of_eucledian_distance_to_a_utilizat = Panel(ma_3.Result)  # "Summ of Eucledian Distance to a Utilization of 1"
utilization_distance_sum = Number(summ_of_eucledian_distance_to_a_utilizat)
utilization_loss = Number(weighted_summ_of_eucledian_distance_to_a)
weighted_utilisation_distance_sum = Number(utilization_loss)
addition_10 = Addition(A=utilization_loss, B=aesthetic_penalty_score_1)
maxutilisation = Number(maxutilization_2)
addition_11 = Addition(A=utilization_loss, B=aesthetic_penalty_score_2)
addition_12 = Addition(A=utilization_loss, B=aesthetic_penalty_score_2_2)
maxutilization_5 = Number(maxutilization_4)
lossvalue1 = Number(addition_10)
lossvalue3 = Number(addition_11)
lossvalue3_2 = Number(lossvalue3)
lossvalue2 = Number(addition_12)
merge_8 = Merge(
    Data1=flatten(material_cost_thausand_chf),
    Data2=flatten(maxutilization_5),
    Data3=flatten(weighted_utilisation_distance_sum))
objectives_2 = Number(flatten(merge_8))
panel_142 = Panel(objectives_2)
weighted_utilisation_distance_sum_2 = Number(utilization_loss)
maxutilisation_2 = Number(maxutilization_2)
# Octopus tries to minimize everything.
# -> to maximize an objective needs to be multiplied by -1 (so the algorithm can also minimize the objective)
# 2. Optimization: Fully optimized Bridge
# Parameters:
# -Arch rise
# - Hanger spacing
# -Tie/ Arch CS Thicknesses
# - Hanger CS Area
objectives_to_minimize = Panel(objectives_2)
merge_9 = Merge(
    Data1=flatten(weight_of_modeled_structural_elements_3),
    Data2=flatten(maxutilisation_2),
    Data3=flatten(weighted_utilisation_distance_sum_2))
objectives_3 = Number(flatten(merge_9))
objectives_to_minimize_2 = Panel(objectives_3)
