# Grasshopper definition gh_test_write_to_file.gh (Grasshopper 1.0.7)

python = GhPythonScript()  # -> out, a
# ---------- python: Python ----------
from datetime import datetime

a = datetime.now().strftime("%d/%m/%Y %H:%M:%S")

with open("/Users/mnbucher/git/eth-master-thesis/rhino-gh/asdf.txt", "w+") as file:
    file.write(a)
# ---------- end python ----------
python_2 = GhPythonScript()  # -> out, a
# ---------- python_2: Python ----------
  
import Rhino

gh = Rhino.RhinoApp.GetPlugInObject("Grasshopper")

gh.EnableSolver()

gh.RunSolver(True)

#print(gh)

ghcomp = ghenv.Component
ghdoc = ghcomp.OnPingDocument()

print(ghdoc)
# ---------- end python_2 ----------
