# Grasshopper definition network-martin.gh (Grasshopper 1.0.7)

arch_pieces = Line([Line((-98.75, 0, 0), (-87.59107107, 0, 5.106456312)), Line((87.59107107, 0, 5.106456312), (98.75, 0, 0))])
panel = Panel("/Users/mnbucher/git/eth-master-thesis/rhino/export/network.json")

right_tie_pieces = Line([Line((-98.75, 0, 0), (-84.64285714, 0, 0)), Line((-84.64285714, 0, 0), (-70.53571429, 0, 0)), Line((-70.53571429, 0, 0), (-56.42857143, 0, 0)), Line((-56.42857143, 0, 0), (-42.32142857, 0, 0)), Line((-42.32142857, 0, 0), (-28.21428571, 0, 0)), Line((-28.21428571, 0, 0), (-14.10714286, 0, 0)), Line((-14.10714286, 0, 0), (0, 0, 0))])
left_tie_pieces = Line([Line((0, 0, 0), (14.10714286, 0, 0)), Line((14.10714286, 0, 0), (28.21428571, 0, 0)), Line((28.21428571, 0, 0), (42.32142857, 0, 0)), Line((42.32142857, 0, 0), (56.42857143, 0, 0)), Line((56.42857143, 0, 0), (70.53571429, 0, 0)), Line((70.53571429, 0, 0), (84.64285714, 0, 0)), Line((84.64285714, 0, 0), (98.75, 0, 0))])
arch_pieces_2 = Line([Line((-98.75, 0, 0), (-87.59107107, 0, 5.106456312)), Line((-87.59107107, 0, 5.106456312), (-79.85848006, 0, 8.286784182)), Line((-79.85848006, 0, 8.286784182), (-76.14218465, 0, 9.710691522)), Line((-76.14218465, 0, 9.710691522), (-64.37887124, 0, 13.77032321)), Line((-64.37887124, 0, 13.77032321), (-62.19289384, 0, 14.45018889)), Line((-62.19289384, 0, 14.45018889), (-52.27412907, 0, 17.23858293))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])
hangers = Curve([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])
lines = Data(flatten([right_tie_pieces, left_tie_pieces, arch_pieces_2, hangers]))
panel_2 = Panel("C:\Users\rustr\Downloads\network.json")
py = GhPythonScript(lines=lines)  # -> network, data; inputs lines: list
# ---------- py: Python ----------
from compas.datastructures import Network
import Rhino.Geometry as rg

edges = []
for line in lines:
    if type(line) == rg.Line:
        a, b = line
    else:
        a = line.PointAtStart
        b = line.PointAtEnd
    edges.append([a, b])

network = Network.from_lines(edges)

data = [network.data]
# ---------- end py ----------
panel_3 = Panel("RPC call")
ghpython_script = GhPythonScript(network=py.network)  # -> adjacency
# ---------- ghpython_script: Python ----------
from compas.rpc import Proxy

with Proxy('compas.datastructures') as datastructures:
    adjacency = datastructures.network_adjacency_matrix(network)
# ---------- end ghpython_script ----------
to_json = ToJSON(data=py.data, filepath=panel, pretty=Toggle(True), write=Button())  # -> json; inputs pretty: Boolean
#   port data: COMPAS data objects to serialize.
#   port filepath: File path where to store the JSON file. If empty, it will not store to disk but instead return the JSON string.
#   port pretty: If True, JSON data will be formatted with indentation and key sorting.
#   port json: JSON file path or JSON string.
# ---------- to_json: Python ----------
"""
Serializes COMPAS objects to JSON.
"""
from ghpythonlib.componentbase import executingcomponent as component

import compas


class CompasInfo(component):
    def RunScript(self, data, filepath, pretty, write):
        json = filepath
        if write:
            if filepath:
                compas.json_dump(data, filepath, pretty)
            else:
                json = compas.json_dumps(data, pretty)

        return json
# ---------- end to_json ----------
panel_4 = Panel(ghpython_script)

ghpython_script_2 = GhPythonScript(x=py.network)  # -> out, a
# ---------- ghpython_script_2: Python ----------
import compas
from compas.datastructures import Network
from compas_plotters import NetworkPlotter

network = x

plotter = NetworkPlotter(network)
plotter.draw_nodes(
 text='key',
 facecolor={key: '#ff0000' for key in network.leaves()},
 radius=0.15
)
plotter.draw_edges()
plotter.show()
# ---------- end ghpython_script_2 ----------
ghpython_script_3 = GhPythonScript(lines=lines)  # -> out, a; inputs lines: list
# ---------- ghpython_script_3: Python ----------
from compas.datastructures import Network
import Rhino.Geometry as rg
from compas.rpc import Proxy

# get network from segments
edges = []
for line in lines:
    if type(line) == rg.Line:
        a, b = line
    else:
        a = line.PointAtStart
        b = line.PointAtEnd
    edges.append([a, b])
network = Network.from_lines(edges)

# get adjacency matrix vom network
with Proxy('compas.datastructures') as datastructures:
    
    adjacency_matrix = datastructures.network_adjacency_matrix(network)
    
    #len(adjacency_matrix)
    lines_written = 0

    with open("/Users/mnbucher/git/eth-master-thesis/rhino/export/network_adj.csv", "w+") as file:
        for row in adjacency_matrix:
            file.write(','.join([str(int(elem)) for elem in row]) + "\n")
            lines_written += 1
        
        print("lines written (shape of matrix):", lines_written)
# ---------- end ghpython_script_3 ----------
ghpython_script_4 = GhPythonScript(x=ghpython_script)  # -> out, a; inputs x: list
# ---------- ghpython_script_4: Python ----------
from compas.datastructures import Network
import Rhino.Geometry as rg
from compas.rpc import Proxy

# get network from segments
edges = []
for line in lines:
    if type(line) == rg.Line:
        a, b = line
    else:
        a = line.PointAtStart
        b = line.PointAtEnd
    edges.append([a, b])
network = Network.from_lines(edges)

# get adjacency matrix vom network
with Proxy('compas.datastructures') as datastructures:
    
    adjacency_matrix = datastructures.network_adjacency_matrix(network)

    with open("/Users/mnbucher/git/eth-master-thesis/rhino/export/network_adj.csv", "w+") as file:
        for row in adjacency_matrix:
            file.write(','.join([str(int(elem)) for elem in row]) + "\n")
            #file.write(','.join([str(elem) for elem in x[0]]) + "\n")
# ---------- end ghpython_script_4 ----------
panel_5 = Panel(ghpython_script_3.out)
