# Grasshopper definition test-01.gh (Grasshopper 1.0.7)

# ---- group: Various objects for manually defining numeric and textual values
# There are lots of special objects
# for inputting values. You will find
# most of them in the PARAMS tab,
# INPUT panel.
C = DigitScroller(Scroller_Digits=12, Scroller_Prefix="C", Scroller_Radix=10, Scroller_Value=1.3)
B = Slider(1.25, range=0..10)
equation_format = Panel("({0} + {1}) / {2}")
A = ControlKnob(Decimals=2, Limit=True, Maximum=10, Minimum=0, Range=1, Value=0.2)

# ----
readcsv = GhPythonScript()  # -> out, b, a; disabled
# ---------- readcsv: Python ----------
import csv


filename = '/Users/mnbucher/git/eth-master-thesis/rhino-gh-test/SobolParameterSamples32768_test5.csv'

parsed_rows = []

with open(filename) as f:
    cf = csv.reader(f)
    
    for row in cf:
        row = [float(i) for i in row]
        parsed_rows.append(row)
        
    a = parsed_rows
    b = len(parsed_rows)
# ---------- end readcsv ----------
getindex = GhPythonScript()  # -> out, a; disabled
# ---------- getindex: Python ----------
__author__ = "mnbucher"

import rhinoscriptsyntax as rs

f = open("/Users/mnbucher/git/eth-master-thesis/rhino-gh-test/index.txt", "r")
a = int(f.readline())
f.close()
# ---------- end getindex ----------
getrow = GhPythonScript(x=getindex.a, y=readcsv.a)  # -> out, a; inputs y: list; disabled
# ---------- getrow: Python ----------
__author__ = "mnbucher"

import rhinoscriptsyntax as rs

a = y[x]
# ---------- end getrow ----------
num = Number(300000)  # disabled
idxcheck = GhPythonScript(x=num, z=readcsv.b, y=getrow.a)  # -> out, a; inputs y: list; disabled
# ---------- idxcheck: Python ----------
__author__ = "mnbucher"

import rhinoscriptsyntax as rs

if x <= z:
    a = y
else:
    a = None
# ---------- end idxcheck ----------
number_slider = Slider(0.25, range=0..1)  # disabled
panel = Panel(getrow.a)  # disabled
extractparams = GhPythonScript(x=idxcheck.a)  # -> out, p2, p1; inputs x: list; disabled
# ---------- extractparams: Python ----------
import rhinoscriptsyntax as rs

if isinstance(x, list) and x[0] != None:
    p1 = x[0]
    p2 = x[1]
# ---------- end extractparams ----------
paramgate = GhPythonScript(x=number_slider, y=extractparams.p2)  # -> out, a; disabled
# ---------- paramgate: Python ----------
if y != None:
    a = y
else:
    a = x
# ---------- end paramgate ----------
num_2 = Number(extractparams.p1)  # disabled
panel_2 = Panel(paramgate.a)  # disabled
multiplication = Multiplication(A=paramgate.a, B=num_2)  # disabled
storeoutput = GhPythonScript(x=multiplication, y=idxcheck.a)  # -> out, a; inputs y: list; disabled
# ---------- storeoutput: Python ----------
import rhinoscriptsyntax as rs
import Grasshopper as gh


output_filename = "/Users/mnbucher/git/eth-master-thesis/rhino-gh-test/output.csv"
index_filename = "/Users/mnbucher/git/eth-master-thesis/rhino-gh-test/index.txt"

with open(output_filename, "a+") as myfile:
    print("writing: ", x)
    myfile.write(str(x))
    
with open(index_filename, "r+") as f:
    old_index = int(f.read())
    f.seek(0)
    new_index = old_index + 1
    print("writing: ", new_index)
    f.write(str(new_index))
    f.truncate()

# if not finished yet (idx <= max_idx)
# start full pipeline from scratch
if y != None:
    gh.Instances.ActiveCanvas.Document.NewSolution(True)
# ---------- end storeoutput ----------
panel_3 = Panel(multiplication)  # disabled

number_slider_2 = Slider(3, range=1..20)  # disabled
python = GhPythonScript()  # -> out, a; disabled
# ---------- python: Python ----------
__author__ = "mnbucher"

import rhinoscriptsyntax as rs
import sys

print(sys.path)

print(sys.version)
# ---------- end python ----------
phi = GoldenRatio(Factor=1)  # disabled
int = Integer(4)  # disabled
series = Series(Start=0, Step=1, Count=number_slider_2)  # disabled
pow = Power(A=phi, B=series)  # disabled
multiplication_2 = Multiplication(A=pow, B=int)  # disabled
python_2 = GhPythonScript(x=multiplication_2)  # -> out, a; inputs x: list; disabled
# ---------- python_2: Python ----------
__author__ = "mnbucher"

import rhinoscriptsyntax as rs
from Rhino.Geometry import Point3d

from compas.geometry import Point

points = []

for i, _ in enumerate(x):
    if i == 0:
        points.append(Point3d(0,0,0))
    else:
        new_x = points[i-1][0]+x[i-1]+3
        print(points[i-1][0])
        points.append(Point3d(new_x,0,0))
    
a = points
# ---------- end python_2 ----------
int_2 = Integer(5)  # disabled
pt = Point(python_2.a)  # disabled
rectangle = Rectangle(Plane=python_2.a, XSize=multiplication_2, YSize=int_2, Radius=0)  # -> Rectangle, Length; disabled
int_3 = Integer(5)  # disabled
boxrec = BoxRectangle(Rectangle=rectangle.Rectangle, Height=int_3)  # disabled
sph = Sphere(Base=PlaneXY(0, 0, 0), Radius=1)  # disabled
geo = Geometry(boxrec)  # disabled
sph_2 = Sphere(Base=PlaneXY(0, 0, 0), Radius=1)  # disabled
mesh = Mesh(geo)  # disabled
python_3 = GhPythonScript(x=geo)  # -> out, a; inputs x: list, y: tree; disabled
# ---------- python_3: Python ----------
__author__ = "mnbucher"

import compas
import rhinoscriptsyntax as rs

import os

from compas_rhino.geometry import BaseRhinoGeometry as bgm
from compas_rhino.geometry import RhinoMesh
from compas_rhino.utilities import volmesh_from_polysurfaces
import compas_rhino

#print(rs.coercegeometry(x[0]))
#print(bgm.from_guid(x[0]))
#print(find_object(x[0]))

"""
for curr_guid in x:
    mesh = RhinoMesh.from_guid(curr_guid).to_compas()
    fn = str(curr_guid) + '_mesh_compas_export.json'
    fn = os.path.join('/Users/mnbucher/git/eth-master-thesis/rhino-gh-test/export', fn)
    compas.json_dump(mesh, fn)
"""

#mesh = RhinoBrep.from_guid(x[0]).to_compas()
#print(mesh.connected_components())

a = volmesh_from_polysurfaces(compas.datastructures.VolMesh, guids=x)

print(a)

#a = x
# ---------- end python_3 ----------

# ---- group: Combine various values according to a formatting rule
format = Format(Format=equation_format, Culture=127, Data0=A, Data1=B, Data2=C)

# ----
# Panels are a great way to inspect your
# values, just be careful to not insert them
# into the data-flow. Panels convert all data
# to text, which may lead to loss of accuracy.
formatting_result = Panel(format)

# ---- group: Resolve equation by running it through a Number parameter
# If the provided data is of a different type
# than the required data, it will often get
# automatically converted. In this case text
# is re-interpreted as a numeric value.
# 
# Some auto-conversions are more
# sensible than others, be careful when
# making files that rely on this 'silent'
# feature.
num_3 = Number(format)
equation_result = Panel(num_3)

# ----
readcsv_2 = GhPythonScript()  # -> out, a
# ---------- readcsv_2: Python ----------
import csv


datafile = "/Users/mnbucher/git/eth-master-thesis/rhino-gh-test/SobolParameterSamples32768_test5.csv"
indexfile = "/Users/mnbucher/git/eth-master-thesis/rhino-gh-test/index.txt"

with open(datafile) as dfile:
    
    all_rows = []
    cf = csv.reader(dfile)
    
    for row in cf:
        all_rows.append([float(i) for i in row])

    with open(indexfile) as ifile:
        
        idx = int(ifile.readline())
        
        print(len(all_rows))
        print(idx)
        
        if idx < len(all_rows):
            a = all_rows[idx]
            print(a)
        else:
            a = None
# ---------- end readcsv_2 ----------
extractparams_2 = GhPythonScript(x=readcsv_2.a)  # -> out, p2, p1; inputs x: list; same code as extractparams
paramgate_2 = GhPythonScript(x=Slider(0.25, range=0..1), y=extractparams_2.p2)  # -> out, a; same code as paramgate
num_4 = Number(extractparams_2.p1)
python_4 = GhPythonScript()  # -> out, a
# ---------- python_4: Python ----------
__author__ = "mnbucher"

import Grasshopper as gh
import System

#print(dir(gh.GH_InstanceServer))

"""
ghdoc = ghenv.Component.Attributes.Owner.OnPingDocument()
print(ghdoc.SolutionState)
print(gh.Kernel.GH_ProcessStep.Process)
ghcomp = ghenv.Component
ghcomp.ExpireSolution(False)
"""

ghdoc = ghenv.Component.Attributes.Owner.OnPingDocument()
names = System.Collections.Generic.List[str](["ReadCSV"])
comp = ghdoc.FindObjects(names, 1)[0]
comp.ExpireSolution(True)

#components = gh.Instances.ActiveCanvas.Document.NewSolution(True)
#canvas = gh.Instances.ActiveCanvas
#print(canvas.Document.Objects)

#if canvas.IsDocument : canvas.Document.NewSolution(True)

#print(components)

"""
ghcomp = ghenv.Component
ghdoc = ghcomp.OnPingDocument()

def callback(ghdoc):
    if ghdoc.SolutionState != gh.Kernel.GH_ProcessStep.Process:
        ghcomp.ExpireSolution(False)

ghdoc.ScheduleSolution(
    delay, gh.Kernel.GH_Document.GH_ScheduleDelegate(callback))

"""
# ---------- end python_4 ----------
multiplication_3 = Multiplication(A=paramgate_2.a, B=num_4)
storeoutput_2 = GhPythonScript(x=multiplication_3, y=readcsv_2.a)  # -> out, a; inputs y: list
# ---------- storeoutput_2: Python ----------
import rhinoscriptsyntax as rs
import Grasshopper as gh
import System


outputfile = "/Users/mnbucher/git/eth-master-thesis/rhino-gh-test/output.csv"
indexfile = "/Users/mnbucher/git/eth-master-thesis/rhino-gh-test/index.txt"

if isinstance(y, list) and y[0] != None:

    with open(outputfile, "a+") as ofp:
        
        print("writing: ", x)
        ofp.write(str(x) + "\n")
        
        with open(indexfile, "r+") as idxfp:
            
            old_index = int(idxfp.read())
            idxfp.seek(0)
            new_index = old_index + 1
            print("writing: ", new_index)
            idxfp.write(str(new_index))
            idxfp.truncate()

            # if not finished yet (idx <= max_idx)
            # start full pipeline from scratch
            
            ghdoc = ghenv.Component.Attributes.Owner.OnPingDocument()
            names = System.Collections.Generic.List[str](["ReadCSV"])
            comp = ghdoc.FindObjects(names, 1)[0]
            comp.ExpireSolution(True)
            
            a = new_index
            #gh.Instances.ActiveCanvas.Document.NewSolution(True)
# ---------- end storeoutput_2 ----------
panel_4 = Panel(storeoutput_2.a)
